# Grasshopper definition 2.5D_VS_3D.gh (Grasshopper 1.0.7)
# Copyright: Coprat

# Morpho
# 
# 2.5D vs 3D
# ++++++++++++++++++++++++++++
# Requirements:
# - Rhino6/Rhino7
# - Morpho
# ++++++++++++++++++++++++++++
# Author: Antonello Di Nunzio
# www.antonellodinunzio.online
# License: GPL V.3.0+
pt = ConstructPoint(XCoordinate=0, YCoordinate=0, ZCoordinate=0)

# ---- group: Grid
number_slider = Slider(2, range=1..5)
morpho_grid_size = MorphoGridSize(point=pt, dim_x=number_slider, dim_y=number_slider, dim_z=number_slider, num_x="80", num_y="80", num_z="27")  # -> read_me, grid_size; inputs point: Point3d, num_x: Int32, num_y: Int32, num_z: Int32
# ---------- morpho_grid_size: Python ----------
# Morpho: A plugin to write Envimet models.
# This file is part of Morpho project.
#
# Copyright (c) 2022, Antonello Di Nunzio <antonellodinunzio@gmail.com>.
# You should have received a copy of the GNU General Public License
# along with Morpho project; If not, see <http://www.gnu.org/licenses/>.
# 
# @license AGPL-3.0-or-later <https://spdx.org/licenses/AGPL-3.0-or-later>

"""
Set Inx Grid properties.
    Args:
        _point: Reference point of the grid [Point3d].
        _dim_x_: X dimension of the grid cell [float].
        _dim_y_: Y dimension of the grid cell [float].
        _dim_z_: Z dimension of the grid cell [float].
        _num_x_: Number of grid cells in X [integer].
        _num_y_: Number of grid cells in Y [integer].
        _num_y_: Number of grid cells in Z [integer].
    
    Returns:
        read_me: Message for users.
        grid_size: Inx Grid attributes. Connect it to Grid component.
"""

ghenv.Component.Name = "Morpho Grid Size"
ghenv.Component.NickName = "morpho_grid_size"
ghenv.Component.Category = "Morpho"
ghenv.Component.SubCategory = "1 || Settings"
try: ghenv.Component.AdditionalHelpFromDocStrings = "2"
except: pass

import scriptcontext as sc
import os
import sys
import clr
##################Envimet INX####################
try:
    user_path = os.getenv("APPDATA")
    sys.path.append(os.path.join(user_path, "Morpho"))
    clr.AddReferenceToFile("Morpho25.dll")
    clr.AddReferenceToFile("MorphoRhino.dll")
    from Morpho25.Geometry import CellDimension, Size
    from MorphoRhino.RhinoAdapter import RhinoConvert
    
except ImportError as e:
    raise ImportError("\nFailed to import Morpho: {0}\n\nCheck your 'Morpho' folder in {1}".format(e, os.getenv("APPDATA")))
################################################
ghenv.Component.Message = "1.1.0"

def main():
    
    if _point:
        
        origin = RhinoConvert.FromRhPointToVector(_point)
        dim_x = _dim_x_ if _dim_x_ else 3.0
        dim_y = _dim_y_ if _dim_y_ else 3.0
        dim_z = _dim_z_ if _dim_z_ else 3.0
        num_x = _num_x_ if _num_x_ else 50
        num_y = _num_y_ if _num_y_ else 50
        num_z = _num_z_ if _num_z_ else 40
        
        dimension = CellDimension(dim_x, dim_y, dim_z)
        size = Size(origin, dimension, num_x, num_y, num_z)
        
        return size
    else:
        return

grid_size = main()
if not _point: print("Please, connect _point.")
# ---------- end morpho_grid_size ----------
morpho_nesting_grids = MorphoNestingGrids(soil_profile_a="0100ST", soil_profile_b="0100LO", number_of_cells="3")  # -> read_me, nesting_grids; inputs number_of_cells: Int32
# ---------- morpho_nesting_grids: Python ----------
# Morpho: A plugin to write Envimet models.
# This file is part of Morpho project.
#
# Copyright (c) 2021, Antonello Di Nunzio <antonellodinunzio@gmail.com>.
# You should have received a copy of the GNU General Public License
# along with Morpho project; If not, see <http://www.gnu.org/licenses/>.
# 
# @license AGPL-3.0-or-later <https://spdx.org/licenses/AGPL-3.0-or-later>

"""
Set Nesting Grids properties.
    Args:
        _soil_profile_a: First profile material to use [str].
        _soil_profile_b: Second profile material to use [str].
        _number_of_cells: Number of nesting cells to add [int].
    
    Returns:
        read_me: Message for users.
        nesting_grids: Nesting Grids attributes. Connect it to Grid component.
"""

ghenv.Component.Name = "Morpho Nesting Grids"
ghenv.Component.NickName = "morpho_nesting_grids"
ghenv.Component.Category = "Morpho"
ghenv.Component.SubCategory = "1 || Settings"
try: ghenv.Component.AdditionalHelpFromDocStrings = "2"
except: pass

import scriptcontext as sc
import os
import sys
import clr
##################Envimet INX####################
try:
    user_path = os.getenv("APPDATA")
    sys.path.append(os.path.join(user_path, "Morpho"))
    clr.AddReferenceToFile("Morpho25.dll")
    clr.AddReferenceToFile("MorphoRhino.dll")
    from Morpho25.Geometry import NestingGrids
    from Morpho25.Geometry import Material
    
except ImportError as e:
    raise ImportError("\nFailed to import Morpho: {0}\n\nCheck your 'Morpho' folder in {1}".format(e, os.getenv("APPDATA")))
################################################
ghenv.Component.Message = "1.1.0"

def main():
    soil_profile_a = _soil_profile_a if _soil_profile_a else Material.DEFAULT_SOIL
    soil_profile_b = _soil_profile_b if _soil_profile_b else Material.DEFAULT_SOIL
    
    num_of_cells = _number_of_cells if _number_of_cells else 0
    
    nesting_grids = NestingGrids(num_of_cells, soil_profile_a, soil_profile_b)
    
    return nesting_grids

nesting_grids = main()
# ---------- end morpho_nesting_grids ----------
morpho_grid = MorphoGrid(
    grid_size=morpho_grid_size.grid_size,
    telescope=Slider(8, range=0..10),
    telescope_start_height=Slider(3.31, range=0..10),
    nesting_grids=morpho_nesting_grids.nesting_grids)  # -> read_me, inx_grid; inputs combined_grid: Boolean
# ---------- morpho_grid: Python ----------
# Morpho: A plugin to write Envimet models.
# This file is part of Morpho project.
#
# Copyright (c) 2022, Antonello Di Nunzio <antonellodinunzio@gmail.com>.
# You should have received a copy of the GNU General Public License
# along with Morpho project; If not, see <http://www.gnu.org/licenses/>.
# 
# @license AGPL-3.0-or-later <https://spdx.org/licenses/AGPL-3.0-or-later>

"""
Construct an Inx Grid.
    Args:
        _grid_size: Grid properties created by 'Envimet INX Grid Size'.
        _telescope_: Connect a number to change grid type from equidistant grid into telescopic grid [float].
        _telescope_start_height_: Height where to start telescoping Z grid growth [float].
        _combined_grid_: Set it to 'True' if you want to combine equidistant and telescopic grid [bool].
        nesting_grids_: Add nesting grids if needed [NestingGrids].
    
    Returns:
        read_me: Message for users.
        inx_grid: Inx Grid.
"""

ghenv.Component.Name = "Morpho Grid"
ghenv.Component.NickName = "morpho_grid"
ghenv.Component.Category = "Morpho"
ghenv.Component.SubCategory = "1 || Settings"
try: ghenv.Component.AdditionalHelpFromDocStrings = "2"
except: pass

import scriptcontext as sc
import os
import sys
import clr
##################Envimet INX####################
try:
    user_path = os.getenv("APPDATA")
    sys.path.append(os.path.join(user_path, "Morpho"))
    clr.AddReferenceToFile("Morpho25.dll")
    from Morpho25.Geometry import Grid, NestingGrids
    
except ImportError as e:
    raise ImportError("\nFailed to import Morpho: {0}\n\nCheck your 'Morpho' folder in {1}".format(e, os.getenv("APPDATA")))
################################################
ghenv.Component.Message = "1.1.0"

def main():
    
    if _grid_size:
        grid = Grid(_grid_size, nesting_grids_)
        if (_telescope_ > 0 and _telescope_start_height_ > 0):
            grid = Grid(_grid_size, 
                _telescope_, 
                _telescope_start_height_, 
                _combined_grid_, 
                nesting_grids_)
        
        return grid
    else:
        return

inx_grid = main()
if not _grid_size: print("Please, connect _grid_size.")
# ---------- end morpho_grid ----------
morpho_decomp_grid = MorphoDecomposeGrid(inx_grid=morpho_grid.inx_grid, dir=Slider(0, range=0..2))  # -> read_me, points; inputs dir: Int32
# ---------- morpho_decomp_grid: Python ----------
# Morpho: A plugin to write Envimet models.
# This file is part of Morpho project.
#
# Copyright (c) 2022, Antonello Di Nunzio <antonellodinunzio@gmail.com>.
# You should have received a copy of the GNU General Public License
# along with Morpho project; If not, see <http://www.gnu.org/licenses/>.
# 
# @license AGPL-3.0-or-later <https://spdx.org/licenses/AGPL-3.0-or-later>

"""
Decompose Inx Grid to visualize its points (centroids).
    Args:
        _inx_grid: Inx Grid.
        _dir_: Connect an number [integer].
        -
        0 = XY
        1 = XZ
        2 = YZ
    
    Returns:
        read_me: Message for users.
        points: Preview of Envimet Grid.
"""

ghenv.Component.Name = "Morpho Decompose Grid"
ghenv.Component.NickName = "morpho_decomp_grid"
ghenv.Component.Category = "Morpho"
ghenv.Component.SubCategory = "1 || Settings"
try: ghenv.Component.AdditionalHelpFromDocStrings = "2"
except: pass

import scriptcontext as sc
import os
import sys
import clr
import Rhino
##################Envimet INX####################
try:
    user_path = os.getenv("APPDATA")
    sys.path.append(os.path.join(user_path, "Morpho"))
    clr.AddReferenceToFile("Morpho25.dll")
    from Morpho25.Geometry import Grid
    
except ImportError as e:
    raise ImportError("\nFailed to import Morpho: {0}\n\nCheck your 'Morpho' folder in {1}".format(e, os.getenv("APPDATA")))
################################################
ghenv.Component.Message = "1.1.0"

def main():
    
    if _inx_grid:
        
        points = []
        
        x_axis = _inx_grid.Xaxis;
        y_axis = _inx_grid.Yaxis;
        z_axis = _inx_grid.Zaxis;
        
        dir = 0 if _dir_ == None else _dir_
        
        if dir == 0:
            for x in x_axis:
                for y in y_axis:
                    points.append(Rhino.Geometry.Point3d(x, y, 0))
        
        if dir == 1:
            for x in x_axis:
                for z in z_axis:
                    points.append(Rhino.Geometry.Point3d(x, y_axis[0], z))
        
        if dir == 2:
            for y in y_axis:
                for z in z_axis:
                    points.append(Rhino.Geometry.Point3d(x_axis[0], y, z))
        
        return points
    else:
        return

points = main()
if not points: print("Please, connect _inx_grid.")
# ---------- end morpho_decomp_grid ----------
morpho_decomp_grid_2 = MorphoDecomposeGrid(inx_grid=morpho_grid.inx_grid, dir=Slider(1, range=0..2))  # -> read_me, points; inputs dir: Int32; same code as morpho_decomp_grid
morpho_decomp_grid_3 = MorphoDecomposeGrid(inx_grid=morpho_grid.inx_grid, dir=Slider(2, range=0..2))  # -> read_me, points; inputs dir: Int32; same code as morpho_decomp_grid
bbox = BoundingBox(
    Content=[morpho_decomp_grid.points, morpho_decomp_grid_2.points, morpho_decomp_grid_3.points],
    Plane=PlaneXY(0, 0, 0),
    UnionBox=True)  # -> Box, Box_2
edges = BrepEdges(Brep=bbox.Box)  # -> Naked, Interior, NonManifold

# ---- group: Workspace and locatio
morpho_location = MorphoLocation(name="Boston", latitude="42.3615101", longitude="-71.0616249", time_zone="-5", longitude_reference="-75")  # -> read_me, inx_location; inputs time_zone: Int32
# ---------- morpho_location: Python ----------
# Morpho: A plugin to write Envimet models.
# This file is part of Morpho project.
#
# Copyright (c) 2022, Antonello Di Nunzio <antonellodinunzio@gmail.com>.
# You should have received a copy of the GNU General Public License
# along with Morpho project; If not, see <http://www.gnu.org/licenses/>.
# 
# @license AGPL-3.0-or-later <https://spdx.org/licenses/AGPL-3.0-or-later>

"""
Construct a Inx Location.
-
You can decompose location data from other plugin, such as Ladybug and Gismo!
    Args:
        _name_: Name of Location.
        _latitude: Latitude of Location WGS84 [float].
        _longitude_: Longitude of Location WGS84 [float].
        _time_zone_: UTC timezone of location [integer].
        _model_rotation_: Rotation angle of your model [float].
        utm_: UTM object from "Morpho UTM" [UTM].
        _longitude_reference_: Longitude reference of your Location. Default is 15.0. [float].
    
    Returns:
        read_me: Message for users.
        inx_location: Inx Location.
"""

ghenv.Component.Name = "Morpho Location"
ghenv.Component.NickName = "morpho_location"
ghenv.Component.Category = "Morpho"
ghenv.Component.SubCategory = "1 || Settings"
try: ghenv.Component.AdditionalHelpFromDocStrings = "1"
except: pass

import scriptcontext as sc
import os
import sys
import clr
################### Morpho #####################
try:
    user_path = os.getenv("APPDATA")
    sys.path.append(os.path.join(user_path, "Morpho"))
    clr.AddReferenceToFile("Morpho25.dll")
    from Morpho25.Settings import Location
    
except ImportError as e:
    raise ImportError("\nFailed to import Morpho: {0}\n\nCheck your 'Morpho' folder in {1}".format(e, os.getenv("APPDATA")))
################################################
ghenv.Component.Message = "1.1.0"

def main():
    
    if _latitude and _longitude:
        
        location = Location(_latitude, _longitude)
        
        if _name_:
            location = Location(_latitude, _longitude, _name_)
        if _name_ and _time_zone_:
            location = Location(_latitude, _longitude, _name_, str(_time_zone_))
        if _name_ and _time_zone_ and _model_rotation_:
            location = Location(_latitude, _longitude, _name_, str(_time_zone_), _model_rotation_)
        
        if _model_rotation_: location.ModelRotation = _model_rotation_ 
        if utm_: location.UTM = utm_ 
        if _longitude_reference_: location.TimezoneReference = _longitude_reference_ 
        
        return location
    else:
        return

inx_location = main()
if not inx_location: print("Please, connect latitude and longitude.")
# ---------- end morpho_location ----------
morpho_workspace = MorphoWorkspace(workspace_folder="C:\Boston", project_name="Boston_project", model_name="Boston_model")  # -> read_me, inx_workspace; inputs userDB: Boolean
# ---------- morpho_workspace: Python ----------
# Morpho: A plugin to write Envimet models.
# This file is part of Morpho project.
#
# Copyright (c) 2022, Antonello Di Nunzio <antonellodinunzio@gmail.com>.
# You should have received a copy of the GNU General Public License
# along with Morpho project; If not, see <http://www.gnu.org/licenses/>.
# 
# @license AGPL-3.0-or-later <https://spdx.org/licenses/AGPL-3.0-or-later>

"""
Set Envimet Model.
-
Model structure of ENVI-Met.
. Workspace -> Project -> Model (inx)
    Args:
        _workspace_folder: Main folder where to save an Envimet project (e.g. C:\Example) [string].
        _project_name_: Name of the current project [string].
        _model_name_: Name of the model to write [string].
        _userDB_: Set it 'True' to user user database instead of project database.
        -
        Database structure of ENVI-Met.
        1. System database is part of envimet software. It contains standard materials.
        2. Project database is part of the project and it is custom.
        3. User database is shared among all projects that do not use project database.
        -
        If you use project database you cannot use user database and vice-versa.
        envimetFolder_: Envimet folder on your machine. If it does not recognize Envimet connect it (e.g. C:\ENVImet445).
    
    Returns:
        read_me: Message for users.
        inx_workspace: Inx Workspace.
"""

ghenv.Component.Name = "Morpho Workspace"
ghenv.Component.NickName = "morpho_workspace"
ghenv.Component.Category = "Morpho"
ghenv.Component.SubCategory = "1 || Settings"
try: ghenv.Component.AdditionalHelpFromDocStrings = "1"
except: pass

import scriptcontext as sc
import os
import sys
import clr
##################Envimet INX####################
try:
    user_path = os.getenv("APPDATA")
    sys.path.append(os.path.join(user_path, "Morpho"))
    clr.AddReferenceToFile("Morpho25.dll")
    from Morpho25.Management import Workspace, DatabaseSource
    
except ImportError as e:
    raise ImportError("\nFailed to import Morpho: {0}\n\nCheck your 'Morpho' folder in {1}".format(e, os.getenv("APPDATA")))
################################################
ghenv.Component.Message = "1.1.0"

def main():
    
    db_type = DatabaseSource.Project if not _userDB_ else DatabaseSource.User
    
    if _workspace_folder:
        
        if _project_name_ and _model_name_:
            workspace = Workspace(_workspace_folder, db_type, _project_name_, _model_name_, envimetFolder_)
        else:
            workspace = Workspace(_workspace_folder, db_type, envimetFolder_)
        
        return workspace
    else:
        return

inx_workspace = main()
if not inx_workspace: print("Please, connect _workspace_folder.")
# ---------- end morpho_workspace ----------

# ---- group: Geometry
srf = Surface(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)
morpho_facegroup = MorphoFacegroup(geometry=srf)  # -> read_me, inx_facegroup; inputs geometry: list of Mesh
# ---------- morpho_facegroup: Python ----------
# Morpho: A plugin to write Envimet models.
# This file is part of Morpho project.
#
# Copyright (c) 2022, Antonello Di Nunzio <antonellodinunzio@gmail.com>.
# You should have received a copy of the GNU General Public License
# along with Morpho project; If not, see <http://www.gnu.org/licenses/>.
# 
# @license AGPL-3.0-or-later <https://spdx.org/licenses/AGPL-3.0-or-later>

"""
Construct a Inx Faces from rh mesh or brep to use with Envimet Entities.
-
Icon made by Freepik <https://www.flaticon.com/authors/freepik>.
See license for more details.
    Args:
        _geometry: Rhino mesh or brep [List or Item or Tree of Mesh]
    
    Returns:
        read_me: Message for users.
        inx_facegroup: Inx geometry (FaceGroup) to use with Envimet Entities.
        mesh: Rhino mesh for checking.
"""

ghenv.Component.Name = "Morpho Facegroup"
ghenv.Component.NickName = "morpho_facegroup"
ghenv.Component.Category = "Morpho"
ghenv.Component.SubCategory = "0 || Geometry"
try: ghenv.Component.AdditionalHelpFromDocStrings = "1"
except: pass

import scriptcontext as sc
import os
import sys
import clr
################### Morpho #####################
try:
    user_path = os.getenv("APPDATA")
    sys.path.append(os.path.join(user_path, "Morpho"))
    clr.AddReferenceToFile("MorphoRhino.dll")
    from MorphoRhino.RhinoAdapter import RhinoConvert
    
except ImportError as e:
    raise ImportError("\nFailed to import Morpho: {0}\n\nCheck your 'Morpho' folder in {1}".format(e, os.getenv("APPDATA")))
################################################
ghenv.Component.Message = "1.1.0"

def main():
    
    if _geometry != None:
        
        inx_facegroup = [RhinoConvert.FromRhMeshToFacegroup(geo) for geo in _geometry]
        
        return inx_facegroup
    else:
        return

inx_facegroup = main()
if not inx_facegroup: print("Please, connect _geometry.")
# ---------- end morpho_facegroup ----------

mesh = Mesh(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)
morpho_facegroup_2 = MorphoFacegroup(geometry=mesh)  # -> read_me, inx_facegroup; inputs geometry: list of Mesh; same code as morpho_facegroup

# ----
evalsrf = EvaluateSurface(Surface=reparameterize(srf), Point="0.5, 0.5")  # -> Point, Normal, UDirection, VDirection, Frame
vdis = VectorDisplay(Anchor=evalsrf.Point, Vector=evalsrf.Normal)

# ---- group: Material
morpho_library = MorphoLibrary(inx_workspace=morpho_workspace.inx_workspace, type="wall", keyword="glass")  # -> read_me, code, description, XML; inputs systemDB: Boolean
# ---------- morpho_library: Python ----------
# Morpho: A plugin to write Envimet models.
# This file is part of Morpho project.
#
# Copyright (c) 2022, Antonello Di Nunzio <antonellodinunzio@gmail.com>.
# You should have received a copy of the GNU General Public License
# along with Morpho project; If not, see <http://www.gnu.org/licenses/>.
# 
# @license AGPL-3.0-or-later <https://spdx.org/licenses/AGPL-3.0-or-later>

"""
Read Envimet materials.
-
You can connect 'code' to customize inx object materials.
    Args:
        _inx_workspace:  Workspace of your current project.
        _type_: Type of material to read. Write one of following string
        profile
        soil
        material
        wall
        source
        plant
        plant3d
        greening
        -
        Default value is 'profile'.
        _keyword_: Connect a string to filter library. E.g. asphalt [string].
        systemDB_: Set it 'True' to use system database.
        If you set 'False' user or profile library will be used. Default is 'True' [bool].
    
    Returns:
        read_me: Message for users.
        code: Material code to use with inx_objects.
        description: Material description.
        XML: XML detail of material.
"""

ghenv.Component.Name = "Morpho Library"
ghenv.Component.NickName = "morpho_library"
ghenv.Component.Category = "Morpho"
ghenv.Component.SubCategory = "1 || Settings"
try: ghenv.Component.AdditionalHelpFromDocStrings = "1"
except: pass

import scriptcontext as sc
import os
import sys
import clr
################### Morpho #####################
try:
    user_path = os.getenv("APPDATA")
    sys.path.append(os.path.join(user_path, "Morpho"))
    clr.AddReferenceToFile("Morpho25.dll")
    from Morpho25.Management import Workspace
    from Morpho25.IO import Library
    
except ImportError as e:
    raise ImportError("\nFailed to import Morpho: {0}\n\nCheck your 'Morpho' folder in {1}".format(e, os.getenv("APPDATA")))
################################################
ghenv.Component.Message = "1.1.0"

def main():
    
    if systemDB_ == None:
        systemDB = True
    else:
        systemDB = systemDB_
    
    type = _type_.upper() if _type_ else Library.PROFILE
    
    alternative_lib = _inx_workspace.UserDB if _inx_workspace.UserDB else _inx_workspace.ProjectDB
    lib = _inx_workspace.SystemDB if systemDB else alternative_lib
    
    library = Library(lib, type, _keyword_)
    
    return library.Code, library.Description, library.Detail

if not _inx_workspace:
    print("Please, connect _inx_workspace.")
else:
    code, description, XML = main()
# ---------- end morpho_library ----------
item = ListItem(List=morpho_library.code, Index=0, Wrap=True)
morpho_building_mat = MorphoBuildingMaterial(wall_code=item)  # -> read_me, material
# ---------- morpho_building_mat: Python ----------
# Morpho: A plugin to write Envimet models.
# This file is part of Morpho project.
#
# Copyright (c) 2022, Antonello Di Nunzio <antonellodinunzio@gmail.com>.
# You should have received a copy of the GNU General Public License
# along with Morpho project; If not, see <http://www.gnu.org/licenses/>.
# 
# @license AGPL-3.0-or-later <https://spdx.org/licenses/AGPL-3.0-or-later>

"""
Construct material code to create a building material.
    Args:
        _wall_code_: Code of wall material [string]. E.g. 000000.
        -
        Type of material to connect: wall
        _roof_code_: Code of roof material [string]. E.g. 000000.
        -
        Type of material to connect: wall
        _green_wall_code_: Code of green wall material [string].
        -
        Type of material to connect: greening
        _green_roof_code_: Code of green roof material [string].
        -
        Type of material to connect: greening
    
    Returns:
        read_me: Message for users.
        material: Inx Building material.
"""

ghenv.Component.Name = "Morpho Building Material"
ghenv.Component.NickName = "morpho_building_mat"
ghenv.Component.Category = "Morpho"
ghenv.Component.SubCategory = "1 || Settings"
try: ghenv.Component.AdditionalHelpFromDocStrings = "2"
except: pass

import scriptcontext as sc
import os
import sys
import clr
##################Envimet INX####################
try:
    user_path = os.getenv("APPDATA")
    sys.path.append(os.path.join(user_path, "Morpho"))
    clr.AddReferenceToFile("Morpho25.dll")
    from Morpho25.Geometry import Building
    
except ImportError as e:
    raise ImportError("\nFailed to import Morpho: {0}\n\nCheck your 'Morpho' folder in {1}".format(e, os.getenv("APPDATA")))
################################################
ghenv.Component.Message = "1.1.0"

def main():
    
    material = Building.CreateMaterial(_wall_code_, _roof_code_, _green_wall_code_, _green_roof_code_)
    
    return material

material = main()
# ---------- end morpho_building_mat ----------

# ---- group: 1
toggle = BooleanToggle(False)

# ---- group: Building
morpho_building = MorphoBuilding(
    inx_grid=morpho_grid.inx_grid,
    inx_facegroup=flatten(morpho_facegroup_2.inx_facegroup),
    ID="1",
    name="Bunny",
    material=morpho_building_mat.material,
    run=toggle)  # -> read_me, inx_building, id_count; inputs inx_facegroup: list, ID: Int32, enable_BPS: Boolean, run: Boolean
# ---------- morpho_building: Python ----------
# Morpho: A plugin to write Envimet models.
# This file is part of Morpho project.
#
# Copyright (c) 2022, Antonello Di Nunzio <antonellodinunzio@gmail.com>.
# You should have received a copy of the GNU General Public License
# along with Morpho project; If not, see <http://www.gnu.org/licenses/>.
# 
# @license AGPL-3.0-or-later <https://spdx.org/licenses/AGPL-3.0-or-later>

"""
Construct an Inx Building.
-
Behavior:
The component will assign automatically IDs starting from _ID connected
    Args:
        _inx_grid: Inx Grid.
        _inx_facegroup: Inx Facegroup that represents a building <Item or List>.
        -
        If you connect a list of inx_facegroup ID will be added automatically.
        _ID: An integer to identify a building [integer].
        _name_: Optional name to give to building [string].
        _material_: Material to apply to buildings [Material]. Default material is 000000.
        -
        Use output of 'Morpho Building Material' component to change it.
        enable_BPS_: It enables Building Performance Simulation output [bool]. For business version only.
        _run: Set it to True to run it.
    
    Returns:
        read_me: Message for users.
        inx_building: Inx Building to use as input of 'Morpho Model' component.
        id_count: Connect this number to the _ID of another 'morpho_building' component to keep the correct ID order
"""

ghenv.Component.Name = "Morpho Building"
ghenv.Component.NickName = "morpho_building"
ghenv.Component.Category = "Morpho"
ghenv.Component.SubCategory = "2 || Entity"
try: ghenv.Component.AdditionalHelpFromDocStrings = "1"
except: pass


import scriptcontext as sc
import os
import sys
import clr
import Grasshopper.Kernel as gh
##################Envimet INX####################
try:
    user_path = os.getenv("APPDATA")
    sys.path.append(os.path.join(user_path, "Morpho"))
    clr.AddReferenceToFile("Morpho25.dll")
    from Morpho25.Geometry import Building
    
except ImportError as e:
    raise ImportError("\nFailed to import Morpho: {0}\n\nCheck your 'Morpho' folder in {1}".format(e, os.getenv("APPDATA")))
################################################
ghenv.Component.Message = "1.1.1"

def main():
    
    if _run and _inx_grid and _inx_facegroup and _ID:
        IDs = [i+_ID for i in xrange(len(_inx_facegroup))]
        
        building = [Building(_inx_grid, mesh, index, 
            _material_, _name_, enable_BPS_) for mesh, index in zip(_inx_facegroup, IDs)]
        
        return building
    else:
        return

inx_building = main()
if not inx_building:
    w = gh.GH_RuntimeMessageLevel.Warning
    msg = "Please, connect _inx_grid, _inx_facegroup, _ID, _run."
    ghenv.Component.AddRuntimeMessage(w, msg)
    print(msg)
if inx_building:
    id_count = len(inx_building) + 1
# ---------- end morpho_building ----------

# ---- group: Terrain
morpho_terrain = MorphoTerrain(inx_grid=morpho_grid.inx_grid, inx_facegroup=flatten(morpho_facegroup.inx_facegroup), ID="1")  # -> read_me, inx_terrain, id_count; inputs inx_facegroup: list, ID: Int32
# ---------- morpho_terrain: Python ----------
# Morpho: A plugin to write Envimet models.
# This file is part of Morpho project.
#
# Copyright (c) 2022, Antonello Di Nunzio <antonellodinunzio@gmail.com>.
# You should have received a copy of the GNU General Public License
# along with Morpho project; If not, see <http://www.gnu.org/licenses/>.
# 
# @license AGPL-3.0-or-later <https://spdx.org/licenses/AGPL-3.0-or-later>

"""
Construct an Inx Terrain.
-
If you have a single mesh or surface split it in many parts to speed up calculation.
-
Behavior:
The component will assign automatically IDs starting from _ID connected
    Args:
        _inx_grid: Inx Grid.
        _inx_facegroup: Inx Facegroup.
        _ID: An integer to identify terrain group [integer].
        _name_: Optional name to give to terrain group [string].
    
    Returns:
        read_me: Message for users.
        inx_terrain: Inx Terrain to use as input of 'Envimet INX Model' component.
        id_count: Connect this number to the _ID of another 'morpho_terrain' component to keep the correct ID order
"""

ghenv.Component.Name = "Morpho Terrain"
ghenv.Component.NickName = "morpho_terrain"
ghenv.Component.Category = "Morpho"
ghenv.Component.SubCategory = "2 || Entity"
try: ghenv.Component.AdditionalHelpFromDocStrings = "1"
except: pass

import scriptcontext as sc
import os
import sys
import clr
##################Envimet INX####################
try:
    user_path = os.getenv("APPDATA")
    sys.path.append(os.path.join(user_path, "Morpho"))
    clr.AddReferenceToFile("Morpho25.dll")
    from Morpho25.Geometry import Terrain
    
except ImportError as e:
    raise ImportError("\nFailed to import Morpho: {0}\n\nCheck your 'Morpho' folder in {1}".format(e, os.getenv("APPDATA")))
################################################
ghenv.Component.Message = "1.1.0"

def main():
    
    if _inx_grid and _inx_facegroup and _ID:
        
        IDs = [i+_ID for i in xrange(len(_inx_facegroup))]
        
        terrain = [Terrain(_inx_grid, mesh, index, _name_) for mesh, index in zip(_inx_facegroup, IDs)]
        
        return terrain
    
    else:
        return

inx_terrain = main()
if not inx_terrain: print("Please, connect _inx_grid, _inx_facegroup, _ID.")
if inx_terrain:
    id_count = len(inx_terrain) + 1
# ---------- end morpho_terrain ----------

# ----
# PARAMETRIC PART
panel = Panel(morpho_building.inx_building)

# ---- group: Create model / 3 - try 'True' and 'False'
toggle_2 = BooleanToggle(False)

# ---- group: Create model / 4
toggle_3 = BooleanToggle(False)

# ---- group: Create model / 2 - try 'True' and 'False'
toggle_4 = BooleanToggle(False)

# ---- group: Create model
morpho_model = MorphoModel(
    inx_workspace=morpho_workspace.inx_workspace,
    inx_grid=morpho_grid.inx_grid,
    inx_location=morpho_location.inx_location,
    inx_objects=flatten([morpho_building.inx_building, morpho_terrain.inx_terrain]),
    is_detailed=toggle_4,
    follow_terrain=toggle_2,
    run_it=toggle_3)  # -> read_me, inx_model; inputs inx_objects: list, is_detailed: Boolean, follow_terrain: Boolean, run_it: Boolean
# ---------- morpho_model: Python ----------
# Morpho: A plugin to write Envimet models.
# This file is part of Morpho project.
#
# Copyright (c) 2022, Antonello Di Nunzio <antonellodinunzio@gmail.com>.
# You should have received a copy of the GNU General Public License
# along with Morpho project; If not, see <http://www.gnu.org/licenses/>.
# 
# @license AGPL-3.0-or-later <https://spdx.org/licenses/AGPL-3.0-or-later>

"""
Construct an Inx 2.5D Model or 3D Model
-
You can connect many envimet objects to it.
-
Icon by Envimet INX for Sketchup.
    Args:
        _inx_workspace: Workspace of your current project.
        _inx_grid: Inx Grid.
        _inx_location: Inx Location.
        _inx_objects_: Connect envimet objects [list]
        . inx_building;
        . inx_plant3d;
        . inx_plant2d;
        . inx_receptor;
        . inx_soil;
        . inx_source;
        . inx_terrain.
        _is_detailed_: Set it to 'True' to convert to detailed model.
        follow_terrain_: Set it to 'True' if you want buildings to follow terrain shape.
        'False' if you want to move buildings up by min height of the projected footprint on the terrain.
        _run_it: Set it to 'True' to create INX Model.
    
    Returns:
        read_me: Message for users.
        inx_model: INX Model.
        -
        Connect it to 'Morpho Write Model' to save *.inx file on your machine.
"""

ghenv.Component.Name = "Morpho Model"
ghenv.Component.NickName = "morpho_model"
ghenv.Component.Category = "Morpho"
ghenv.Component.SubCategory = "1 || IO"
try: ghenv.Component.AdditionalHelpFromDocStrings = "1"
except: pass

import scriptcontext as sc
import os
import sys
import clr
##################Envimet INX####################
from System.Collections.Generic import *
try:
    user_path = os.getenv("APPDATA")
    sys.path.append(os.path.join(user_path, "Morpho"))
    clr.AddReferenceToFile("Morpho25.dll")
    from Morpho25.Settings import Model
    from Morpho25.Utility import EnvimetUtility
    from Morpho25.Geometry import *
    
except ImportError as e:
    raise ImportError("\nFailed to import Morpho: {0}\n\nCheck your 'Morpho' folder in {1}".format(e, os.getenv("APPDATA")))
################################################
ghenv.Component.Message = "1.1.0"

def main():
    
    if _inx_grid and _inx_location and _inx_workspace and _run_it:
        
        model = Model(_inx_grid, _inx_location, _inx_workspace)
        
        building = []
        plant3d = []
        plant2d = []
        receptor = []
        soil = []
        source = []
        terrain = []
        
        if _inx_objects_:
            for obj in _inx_objects_:
                if (type(obj) == Building):
                    building.append(obj)
                if (type(obj) == Plant3d):
                    plant3d.append(obj)
                if (type(obj) == Plant2d):
                    plant2d.append(obj)
                if (type(obj) == Receptor):
                    receptor.append(obj)
                if (type(obj) == Soil):
                    soil.append(obj)
                if (type(obj) == Source):
                    source.append(obj)
                if (type(obj) == Terrain):
                    terrain.append(obj)
        
        if building: model.BuildingObjects = List[Building](building)
        if plant3d: model.Plant3dObjects = List[Plant3d](plant3d)
        if plant2d: model.Plant2dObjects = List[Plant2d](plant2d)
        if receptor: model.ReceptorObjects = List[Receptor](receptor)
        if soil: model.SoilObjects = List[Soil](soil)
        if source: model.SourceObjects = List[Source](source)
        if terrain: model.TerrainObjects = List[Terrain](terrain)
        
        model.Calculation()
        
        if _is_detailed_:
            model.IsDetailed = _is_detailed_
            if follow_terrain_:
                model.ShiftEachVoxel = follow_terrain_
        
        return model
    else:
        return

inx_model = main()
if not inx_model: print("Please, connect _inx_workspace, _inx_grid, _inx_location and set _run_it to 'True'.")
# ---------- end morpho_model ----------
panel_2 = Panel(morpho_model.inx_model)

# ---- group: Write and check the model by Spaces / 6
# READ/WRITE PART
toggle_5 = BooleanToggle(False)

# ---- group: Write and check the model by Spaces / 7
toggle_6 = BooleanToggle(False)

# ---- group: Write and check the model by Spaces
morpho_write_model = MorphoWriteModel(inx_model=morpho_model.inx_model, write_it=toggle_5)  # -> read_me, file_path; inputs write_it: Boolean
# ---------- morpho_write_model: Python ----------
# Morpho: A plugin to write Envimet models.
# This file is part of Morpho project.
#
# Copyright (c) 2022, Antonello Di Nunzio <antonellodinunzio@gmail.com>.
# You should have received a copy of the GNU General Public License
# along with Morpho project; If not, see <http://www.gnu.org/licenses/>.
# 
# @license AGPL-3.0-or-later <https://spdx.org/licenses/AGPL-3.0-or-later>

"""
Write an Inx Model. You must use it before running simulation.
-
Use this component to save INX file on your machine.
-
Icon made by Freepik <https://www.flaticon.com/authors/freepik>.
See license for more details.
    Args:
        _inx_model: Inx Model.
        _write_it: Set it to 'True' to write model on your machine.
    
    Returns:
        read_me: Message for users.
        file_path: Path where inx file is on your machine.
"""

ghenv.Component.Name = "Morpho Write Model"
ghenv.Component.NickName = "morpho_write_model"
ghenv.Component.Category = "Morpho"
ghenv.Component.SubCategory = "3 || IO"
try: ghenv.Component.AdditionalHelpFromDocStrings = "1"
except: pass

import scriptcontext as sc
import os
import sys
import clr
##################Envimet INX####################
try:
    user_path = os.getenv("APPDATA")
    sys.path.append(os.path.join(user_path, "Morpho"))
    clr.AddReferenceToFile("Morpho25.dll")
    from Morpho25.IO import Inx
    
except ImportError as e:
    raise ImportError("\nFailed to import Morpho: {0}\n\nCheck your 'Morpho' folder in {1}".format(e, os.getenv("APPDATA")))
################################################
ghenv.Component.Message = "1.1.0"

def main():
    
    if _inx_model and _write_it:
        
        inx = Inx(_inx_model)
        inx.WriteInx()
        
        return inx.Model.Workspace.ModelPath
    else:
        return

file_path = main()
if not file_path: print("Please, connect _inx_model and set _write_it to 'True'.")
# ---------- end morpho_write_model ----------
panel_3 = Panel(morpho_write_model.file_path)
morpho_run_inx = MorphoRunINX(file_path=morpho_write_model.file_path, run_it=toggle_6)  # inputs run_it: Boolean
# ---------- morpho_run_inx: Python ----------
# Morpho: A plugin to write Envimet models.
# This file is part of Morpho project.
#
# Copyright (c) 2022, Antonello Di Nunzio <antonellodinunzio@gmail.com>.
# You should have received a copy of the GNU General Public License
# along with Morpho project; If not, see <http://www.gnu.org/licenses/>.
# 
# @license AGPL-3.0-or-later <https://spdx.org/licenses/AGPL-3.0-or-later>

"""
This component open ENVI_MET Spaces to check the model.
    Args:
        _file_path: Full path of the Model (INX).
        _run_it: Set it to 'True' to run simulation.
        
    Returns:
        read_me: Message for users.
"""

ghenv.Component.Name = "Morpho Run INX"
ghenv.Component.NickName = "morpho_run_inx"
ghenv.Component.Category = "Morpho"
ghenv.Component.SubCategory = "5 || Util"
try: ghenv.Component.AdditionalHelpFromDocStrings = "1"
except: pass

import scriptcontext as sc
import os
import sys
import clr
##################Envimet INX####################
try:
    user_path = os.getenv("APPDATA")
    sys.path.append(os.path.join(user_path, "Morpho"))
    clr.AddReferenceToFile("Morpho25.dll")
    from Morpho25.IO import SimulationBatch
    
except ImportError as e:
    raise ImportError("\nFailed to import Morpho: {0}\n\nCheck your 'Morpho' folder in {1}".format(e, os.getenv("APPDATA")))
################################################
ghenv.Component.Message = "1.1.0"


def main():
    
    if _file_path and _run_it:
        
        os.startfile(_file_path)
        
        return "OK"
    else:
        return

result = main()
if not result: print("Please, connect INX file address and _run_it to 'True'.")
# ---------- end morpho_run_inx ----------
