# Grasshopper definition model_with_ASCII_terrain.gh (Grasshopper 1.0.7)
# Copyright: Coprat

pt = Point(Point(-314.0861209, -473.5879558, 0))

# ---- group: Grid
# Morpho
# 
# Add terrain as ASCII DEM matrix
# ++++++++++++++++++++++++++++
# Requirements:
# - Rhino6/Rhino7
# - Morpho
# ++++++++++++++++++++++++++++
# Author: Antonello Di Nunzio
# www.antonellodinunzio.online
# License: GPL V.3.0+
number_slider = Slider(4, range=1..5)
morpho_grid_size = MorphoGridSize(point=pt, dim_x=number_slider, dim_y=number_slider, dim_z=number_slider, num_x="250", num_y="150", num_z="28")  # -> out, grid_size; inputs point: Point3d, num_x: Int32, num_y: Int32, num_z: Int32
# ---------- morpho_grid_size: Python ----------
# Morpho: A plugin to write Envimet models.
# This file is part of Morpho project.
#
# Copyright (c) 2023, Antonello Di Nunzio <plugin@antonellodinunzio.online>.
# You should have received a copy of the GNU General Public License
# along with Morpho project; If not, see <http://www.gnu.org/licenses/>.
# 
# @license AGPL-3.0-or-later <https://spdx.org/licenses/AGPL-3.0-or-later>

"""
Set Inx Grid properties.
    Args:
        _point: Reference point of the grid [Point3d].
        _dim_x_: X dimension of the grid cell [float].
        _dim_y_: Y dimension of the grid cell [float].
        _dim_z_: Z dimension of the grid cell [float].
        _num_x_: Number of grid cells in X [integer].
        _num_y_: Number of grid cells in Y [integer].
        _num_y_: Number of grid cells in Z [integer].
    
    Returns:
        read_me: Message for users.
        grid_size: Inx Grid attributes. Connect it to Grid component.
"""

ghenv.Component.Name = "Morpho Grid Size"
ghenv.Component.NickName = "morpho_grid_size"
ghenv.Component.Category = "Morpho"
ghenv.Component.SubCategory = "1 || Settings"
try: ghenv.Component.AdditionalHelpFromDocStrings = "2"
except: pass

import scriptcontext as sc
import os
import sys
import clr
##################Envimet INX####################
try:
    user_path = os.getenv("APPDATA")
    sys.path.append(os.path.join(user_path, "Morpho"))
    clr.AddReferenceToFile("Morpho25.dll")
    clr.AddReferenceToFile("MorphoRhino.dll")
    from Morpho25.Geometry import CellDimension, Size
    from MorphoRhino.RhinoAdapter import RhinoConvert
    
except ImportError as e:
    raise ImportError("\nFailed to import Morpho: {0}\n\nCheck your 'Morpho' folder in {1}".format(e, os.getenv("APPDATA")))
################################################
ghenv.Component.Message = "2.0.0"

def main():
    
    if _point:
        
        origin = RhinoConvert.FromRhPointToVector(_point)
        dim_x = _dim_x_ if _dim_x_ else 3.0
        dim_y = _dim_y_ if _dim_y_ else 3.0
        dim_z = _dim_z_ if _dim_z_ else 3.0
        num_x = _num_x_ if _num_x_ else 50
        num_y = _num_y_ if _num_y_ else 50
        num_z = _num_z_ if _num_z_ else 40
        
        dimension = CellDimension(dim_x, dim_y, dim_z)
        size = Size(origin, dimension, num_x, num_y, num_z)
        
        return size
    else:
        return

grid_size = main()
if not _point: print("Please, connect _point.")
# ---------- end morpho_grid_size ----------
morpho_nesting_grids = MorphoNestingGrids(soil_profile_a="0100ST", soil_profile_b="0100LO", number_of_cells="3")  # -> out, nesting_grids; inputs number_of_cells: Int32
# ---------- morpho_nesting_grids: Python ----------
# Morpho: A plugin to write Envimet models.
# This file is part of Morpho project.
#
# Copyright (c) 2023, Antonello Di Nunzio <plugin@antonellodinunzio.online>.
# You should have received a copy of the GNU General Public License
# along with Morpho project; If not, see <http://www.gnu.org/licenses/>.
# 
# @license AGPL-3.0-or-later <https://spdx.org/licenses/AGPL-3.0-or-later>

"""
Set Nesting Grids properties.
    Args:
        _soil_profile_a: First profile material to use [str].
        _soil_profile_b: Second profile material to use [str].
        _number_of_cells: Number of nesting cells to add [int].
    
    Returns:
        read_me: Message for users.
        nesting_grids: Nesting Grids attributes. Connect it to Grid component.
"""

ghenv.Component.Name = "Morpho Nesting Grids"
ghenv.Component.NickName = "morpho_nesting_grids"
ghenv.Component.Category = "Morpho"
ghenv.Component.SubCategory = "1 || Settings"
try: ghenv.Component.AdditionalHelpFromDocStrings = "2"
except: pass

import scriptcontext as sc
import os
import sys
import clr
##################Envimet INX####################
try:
    user_path = os.getenv("APPDATA")
    sys.path.append(os.path.join(user_path, "Morpho"))
    clr.AddReferenceToFile("Morpho25.dll")
    clr.AddReferenceToFile("MorphoRhino.dll")
    from Morpho25.Geometry import NestingGrids
    from Morpho25.Geometry import Material
    
except ImportError as e:
    raise ImportError("\nFailed to import Morpho: {0}\n\nCheck your 'Morpho' folder in {1}".format(e, os.getenv("APPDATA")))
################################################
ghenv.Component.Message = "2.0.0"

def main():
    soil_profile_a = _soil_profile_a if _soil_profile_a else Material.DEFAULT_SOIL
    soil_profile_b = _soil_profile_b if _soil_profile_b else Material.DEFAULT_SOIL
    
    num_of_cells = _number_of_cells if _number_of_cells else 0
    
    nesting_grids = NestingGrids(num_of_cells, soil_profile_a, soil_profile_b)
    
    return nesting_grids

nesting_grids = main()
# ---------- end morpho_nesting_grids ----------
morpho_grid = MorphoGrid(
    grid_size=morpho_grid_size.grid_size,
    telescope=Slider(8, range=0..10),
    telescope_start_height=Slider(3.31, range=0..10),
    nesting_grids=morpho_nesting_grids.nesting_grids)  # -> out, inx_grid; inputs combined_grid: Boolean
# ---------- morpho_grid: Python ----------
# Morpho: A plugin to write Envimet models.
# This file is part of Morpho project.
#
# Copyright (c) 2023, Antonello Di Nunzio <plugin@antonellodinunzio.online>.
# You should have received a copy of the GNU General Public License
# along with Morpho project; If not, see <http://www.gnu.org/licenses/>.
# 
# @license AGPL-3.0-or-later <https://spdx.org/licenses/AGPL-3.0-or-later>

"""
Construct an Inx Grid.
    Args:
        _grid_size: Grid properties created by 'Envimet INX Grid Size'.
        _telescope_: Connect a number to change grid type from equidistant grid into telescopic grid [float].
        _telescope_start_height_: Height where to start telescoping Z grid growth [float].
        _combined_grid_: Set it to 'True' if you want to combine equidistant and telescopic grid [bool].
        nesting_grids_: Add nesting grids if needed [NestingGrids].
    
    Returns:
        read_me: Message for users.
        inx_grid: Inx Grid.
"""

ghenv.Component.Name = "Morpho Grid"
ghenv.Component.NickName = "morpho_grid"
ghenv.Component.Category = "Morpho"
ghenv.Component.SubCategory = "1 || Settings"
try: ghenv.Component.AdditionalHelpFromDocStrings = "2"
except: pass

import scriptcontext as sc
import os
import sys
import clr
##################Envimet INX####################
try:
    user_path = os.getenv("APPDATA")
    sys.path.append(os.path.join(user_path, "Morpho"))
    clr.AddReferenceToFile("Morpho25.dll")
    from Morpho25.Geometry import Grid, NestingGrids
    
except ImportError as e:
    raise ImportError("\nFailed to import Morpho: {0}\n\nCheck your 'Morpho' folder in {1}".format(e, os.getenv("APPDATA")))
################################################
ghenv.Component.Message = "2.0.0"

def main():
    
    if _grid_size:
        grid = Grid(_grid_size, nesting_grids_)
        if (_telescope_ > 0 and _telescope_start_height_ > 0):
            grid = Grid(_grid_size, 
                _telescope_, 
                _telescope_start_height_, 
                _combined_grid_, 
                nesting_grids_)
        
        return grid
    else:
        return

inx_grid = main()
if not _grid_size: print("Please, connect _grid_size.")
# ---------- end morpho_grid ----------
panel = Panel("""0
1
2""")
morpho_decomp_grid = MorphoDecomposeGrid(inx_grid=morpho_grid.inx_grid, dir=graft(panel))  # -> out, points; inputs dir: Int32
# ---------- morpho_decomp_grid: Python ----------
# Morpho: A plugin to write Envimet models.
# This file is part of Morpho project.
#
# Copyright (c) 2023, Antonello Di Nunzio <plugin@antonellodinunzio.online>.
# You should have received a copy of the GNU General Public License
# along with Morpho project; If not, see <http://www.gnu.org/licenses/>.
# 
# @license AGPL-3.0-or-later <https://spdx.org/licenses/AGPL-3.0-or-later>

"""
Decompose Inx Grid to visualize its points (centroids).
    Args:
        _inx_grid: Inx Grid.
        _dir_: Connect an number [integer].
        -
        0 = XY
        1 = XZ
        2 = YZ
    
    Returns:
        read_me: Message for users.
        points: Preview of Envimet Grid.
"""

ghenv.Component.Name = "Morpho Decompose Grid"
ghenv.Component.NickName = "morpho_decomp_grid"
ghenv.Component.Category = "Morpho"
ghenv.Component.SubCategory = "1 || Settings"
try: ghenv.Component.AdditionalHelpFromDocStrings = "2"
except: pass

import scriptcontext as sc
import os
import sys
import clr
import Rhino
##################Envimet INX####################
try:
    user_path = os.getenv("APPDATA")
    sys.path.append(os.path.join(user_path, "Morpho"))
    clr.AddReferenceToFile("Morpho25.dll")
    from Morpho25.Geometry import Grid
    
except ImportError as e:
    raise ImportError("\nFailed to import Morpho: {0}\n\nCheck your 'Morpho' folder in {1}".format(e, os.getenv("APPDATA")))
################################################
ghenv.Component.Message = "2.0.0"

def main():
    
    if _inx_grid:
        
        points = []
        
        x_axis = _inx_grid.Xaxis;
        y_axis = _inx_grid.Yaxis;
        z_axis = _inx_grid.Zaxis;
        
        dir = 0 if _dir_ == None else _dir_
        
        if dir == 0:
            for x in x_axis:
                for y in y_axis:
                    points.append(Rhino.Geometry.Point3d(x, y, 0))
        
        if dir == 1:
            for x in x_axis:
                for z in z_axis:
                    points.append(Rhino.Geometry.Point3d(x, y_axis[0], z))
        
        if dir == 2:
            for y in y_axis:
                for z in z_axis:
                    points.append(Rhino.Geometry.Point3d(x_axis[0], y, z))
        
        return points
    else:
        return

points = main()
if not points: print("Please, connect _inx_grid.")
# ---------- end morpho_decomp_grid ----------
bbox = BoundingBox(Content=flatten(morpho_decomp_grid.points), Plane=PlaneXY(0, 0, 0), UnionBox=True)  # -> Box, Box_2
edges = BrepEdges(Brep=bbox.Box)  # -> Naked, Interior, NonManifold

# ---- group: Workspace and location
morpho_location = MorphoLocation(name="Boston", latitude="42.3615101", longitude="-71.0616249", time_zone="-5", longitude_reference="-75")  # -> out, inx_location; inputs time_zone: Int32
# ---------- morpho_location: Python ----------
# Morpho: A plugin to write Envimet models.
# This file is part of Morpho project.
#
# Copyright (c) 2023, Antonello Di Nunzio <plugin@antonellodinunzio.online>.
# You should have received a copy of the GNU General Public License
# along with Morpho project; If not, see <http://www.gnu.org/licenses/>.
# 
# @license AGPL-3.0-or-later <https://spdx.org/licenses/AGPL-3.0-or-later>

"""
Construct a Inx Location.
-
You can decompose location data from other plugin, such as Ladybug and Gismo!
    Args:
        _name_: Name of Location.
        _latitude: Latitude of Location WGS84 [float].
        _longitude_: Longitude of Location WGS84 [float].
        _time_zone_: UTC timezone of location [integer].
        _model_rotation_: Rotation angle of your model [float].
        utm_: UTM object from "Morpho UTM" [UTM].
        _longitude_reference_: Longitude reference of your Location. Default is 15.0. [float].
    
    Returns:
        read_me: Message for users.
        inx_location: Inx Location.
"""

ghenv.Component.Name = "Morpho Location"
ghenv.Component.NickName = "morpho_location"
ghenv.Component.Category = "Morpho"
ghenv.Component.SubCategory = "1 || Settings"
try: ghenv.Component.AdditionalHelpFromDocStrings = "1"
except: pass

import scriptcontext as sc
import os
import sys
import clr
################### Morpho #####################
try:
    user_path = os.getenv("APPDATA")
    sys.path.append(os.path.join(user_path, "Morpho"))
    clr.AddReferenceToFile("Morpho25.dll")
    from Morpho25.Settings import Location
    
except ImportError as e:
    raise ImportError("\nFailed to import Morpho: {0}\n\nCheck your 'Morpho' folder in {1}".format(e, os.getenv("APPDATA")))
################################################
ghenv.Component.Message = "2.0.0"

def main():
    
    if _latitude and _longitude:
        
        location = Location(_latitude, _longitude)
        
        if _name_:
            location = Location(_latitude, _longitude, _name_)
        if _name_ and _time_zone_:
            location = Location(_latitude, _longitude, _name_, str(_time_zone_))
        if _name_ and _time_zone_ and _model_rotation_:
            location = Location(_latitude, _longitude, _name_, str(_time_zone_), _model_rotation_)
        
        if _model_rotation_: location.ModelRotation = _model_rotation_ 
        if utm_: location.UTM = utm_ 
        if _longitude_reference_: location.TimezoneReference = _longitude_reference_ 
        
        return location
    else:
        return

inx_location = main()
if not inx_location: print("Please, connect latitude and longitude.")
# ---------- end morpho_location ----------
morpho_workspace = MorphoWorkspace(workspace_folder="C:\Boston", project_name="Boston_project", model_name="Boston_model")  # -> out, inx_workspace; inputs userDB: Boolean
# ---------- morpho_workspace: Python ----------
# Morpho: A plugin to write Envimet models.
# This file is part of Morpho project.
#
# Copyright (c) 2023, Antonello Di Nunzio <plugin@antonellodinunzio.online>.
# You should have received a copy of the GNU General Public License
# along with Morpho project; If not, see <http://www.gnu.org/licenses/>.
# 
# @license AGPL-3.0-or-later <https://spdx.org/licenses/AGPL-3.0-or-later>

"""
Set Envimet Model.
-
Model structure of ENVI-Met.
. Workspace -> Project -> Model (inx)
    Args:
        _workspace_folder: Main folder where to save an Envimet project (e.g. C:\Example) [string].
        _project_name_: Name of the current project [string].
        _model_name_: Name of the model to write [string].
        _userDB_: Set it 'True' to user user database instead of project database.
        -
        Database structure of ENVI-Met.
        1. System database is part of envimet software. It contains standard materials.
        2. Project database is part of the project and it is custom.
        3. User database is shared among all projects that do not use project database.
        -
        If you use project database you cannot use user database and vice-versa.
        envimetFolder_: Envimet folder on your machine. If it does not recognize Envimet connect it (e.g. C:\ENVImet445).
    
    Returns:
        read_me: Message for users.
        inx_workspace: Inx Workspace.
"""

ghenv.Component.Name = "Morpho Workspace"
ghenv.Component.NickName = "morpho_workspace"
ghenv.Component.Category = "Morpho"
ghenv.Component.SubCategory = "1 || Settings"
try: ghenv.Component.AdditionalHelpFromDocStrings = "1"
except: pass

import scriptcontext as sc
import os
import sys
import clr
##################Envimet INX####################
try:
    user_path = os.getenv("APPDATA")
    sys.path.append(os.path.join(user_path, "Morpho"))
    clr.AddReferenceToFile("Morpho25.dll")
    from Morpho25.Management import Workspace, DatabaseSource
    
except ImportError as e:
    raise ImportError("\nFailed to import Morpho: {0}\n\nCheck your 'Morpho' folder in {1}".format(e, os.getenv("APPDATA")))
################################################
ghenv.Component.Message = "2.0.0"

def main():
    
    db_type = DatabaseSource.Project if not _userDB_ else DatabaseSource.User
    
    if _workspace_folder:
        
        if _project_name_ and _model_name_:
            workspace = Workspace(_workspace_folder, db_type, _project_name_, _model_name_, envimetFolder_)
        else:
            workspace = Workspace(_workspace_folder, db_type, envimetFolder_)
        
        return workspace
    else:
        return

inx_workspace = main()
if not inx_workspace: print("Please, connect _workspace_folder.")
# ---------- end morpho_workspace ----------

# ----
crv = Curve(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)
divide = DivideCurve(Curve=crv, Count="50", Kinks=False)  # -> Points, Tangents, Parameters

# ---- group: Trees
morpho_point = MorphoPoint(point=divide.Points)  # -> out, inx_point; inputs point: list of Point3d
# ---------- morpho_point: Python ----------
# Morpho: A plugin to write Envimet 2.5D models.
# This file is part of Morpho project.
#
# Copyright (c) 2023, Antonello Di Nunzio <plugin@antonellodinunzio.online>.
# You should have received a copy of the GNU General Public License
# along with Morpho project; If not, see <http://www.gnu.org/licenses/>.
# 
# @license AGPL-3.0-or-later <https://spdx.org/licenses/AGPL-3.0-or-later>

"""
Construct a Inx Point to use with Envimet Entities.
-
Icon made by Freepik <https://www.flaticon.com/authors/freepik>.
See license for more details.
    Args:
        _point: Rhino point [list Point3d]
    
    Returns:
        read_me: Message for users.
        inx_point: Inx Point to use with Envimet Entities.
"""

ghenv.Component.Name = "Morpho Point"
ghenv.Component.NickName = "morpho_point"
ghenv.Component.Category = "Morpho"
ghenv.Component.SubCategory = "0 || Geometry"
try: ghenv.Component.AdditionalHelpFromDocStrings = "1"
except: pass

import scriptcontext as sc
import os
import sys
import clr
################### Morpho #####################
try:
    user_path = os.getenv("APPDATA")
    sys.path.append(os.path.join(user_path, "Morpho"))
    clr.AddReferenceToFile("MorphoRhino.dll")
    from MorphoRhino.RhinoAdapter import RhinoConvert
    
except ImportError as e:
    raise ImportError("\nFailed to import Morpho: {0}\n\nCheck your 'Morpho' folder in {1}".format(e, os.getenv("APPDATA")))
################################################
ghenv.Component.Message = "2.0.0"

def main():
    
    if _point != None:
        
        inx_point = [RhinoConvert.FromRhPointToVector(pt) for pt in _point]
        
        return inx_point
    else:
        return

inx_point = main()
if not _point: print("Please, connect _point.")
# ---------- end morpho_point ----------
morpho_plant3d = MorphoPlant3d(inx_point=flatten(morpho_point.inx_point))  # -> out, inx_plant3d; inputs inx_point: list
# ---------- morpho_plant3d: Python ----------
# Morpho: A plugin to write Envimet models.
# This file is part of Morpho project.
#
# Copyright (c) 2023, Antonello Di Nunzio <plugin@antonellodinunzio.online>.
# You should have received a copy of the GNU General Public License
# along with Morpho project; If not, see <http://www.gnu.org/licenses/>.
# 
# @license AGPL-3.0-or-later <https://spdx.org/licenses/AGPL-3.0-or-later>

"""
Construct an Inx Plant3d.
    Args:
        _inx_point: Inx Point.
        _name_: Optional name to give to plant3d group [string].
        _code_: Code of material to apply to plant3d [string]. E.g. 0000C2.
        -
        Type of material to connect: plant3d
    
    Returns:
        read_me: Message for users.
        inx_plant3d: Inx Plant3d to use as input of 'Morpho Model' component.
"""

ghenv.Component.Name = "Morpho Plant3d"
ghenv.Component.NickName = "morpho_plant3d"
ghenv.Component.Category = "Morpho"
ghenv.Component.SubCategory = "2 || Entity"
try: ghenv.Component.AdditionalHelpFromDocStrings = "1"
except: pass

import scriptcontext as sc
import os
import sys
import clr
import Grasshopper.Kernel as gh
##################Envimet INX####################
try:
    user_path = os.getenv("APPDATA")
    sys.path.append(os.path.join(user_path, "Morpho"))
    clr.AddReferenceToFile("Morpho25.dll")
    from Morpho25.Geometry import Plant3d
    
except ImportError as e:
    raise ImportError("\nFailed to import Morpho: {0}\n\nCheck your 'Morpho' folder in {1}".format(e, os.getenv("APPDATA")))
################################################
ghenv.Component.Message = "2.0.0"

def main():
    trees = []
    if _inx_point:
        
        trees = [Plant3d(vec, _code_, _name_) for vec in _inx_point]
        
        return trees
    else:
        return

inx_plant3d = main()
if not inx_plant3d:
    w = gh.GH_RuntimeMessageLevel.Warning
    msg = "Please, connect _inx_point."
    ghenv.Component.AddRuntimeMessage(w, msg)
    print(msg)
# ---------- end morpho_plant3d ----------

# ---- group: Model / 1
toggle = BooleanToggle(False)

# ---- group: Model
morpho_model = MorphoModel(
    inx_workspace=morpho_workspace.inx_workspace,
    inx_grid=morpho_grid.inx_grid,
    inx_location=morpho_location.inx_location,
    inx_objects=flatten(morpho_plant3d.inx_plant3d),
    run_it=toggle)  # -> out, inx_model; inputs inx_objects: list, is_detailed: Boolean, follow_terrain: Boolean, run_it: Boolean
# ---------- morpho_model: Python ----------
# Morpho: A plugin to write Envimet models.
# This file is part of Morpho project.
#
# Copyright (c) 2023, Antonello Di Nunzio <plugin@antonellodinunzio.online>.
# You should have received a copy of the GNU General Public License
# along with Morpho project; If not, see <http://www.gnu.org/licenses/>.
# 
# @license AGPL-3.0-or-later <https://spdx.org/licenses/AGPL-3.0-or-later>

"""
Construct an Inx 2.5D Model or 3D Model
-
You can connect many envimet objects to it.
-
Icon by Envimet INX for Sketchup.
    Args:
        _inx_workspace: Workspace of your current project.
        _inx_grid: Inx Grid.
        _inx_location: Inx Location.
        _inx_objects_: Connect envimet objects [list]
        . inx_building;
        . inx_plant3d;
        . inx_plant2d;
        . inx_receptor;
        . inx_soil;
        . inx_source;
        . inx_terrain.
        _is_detailed_: Set it to 'True' to convert to detailed model.
        follow_terrain_: Set it to 'True' if you want buildings to follow terrain shape.
        'False' if you want to move buildings up by min height of the projected footprint on the terrain.
        _run_it: Set it to 'True' to create INX Model.
    
    Returns:
        read_me: Message for users.
        inx_model: INX Model.
        -
        Connect it to 'Morpho Write Model' to save *.inx file on your machine.
"""

ghenv.Component.Name = "Morpho Model"
ghenv.Component.NickName = "morpho_model"
ghenv.Component.Category = "Morpho"
ghenv.Component.SubCategory = "1 || IO"
try: ghenv.Component.AdditionalHelpFromDocStrings = "1"
except: pass

import scriptcontext as sc
import os
import sys
import clr
##################Envimet INX####################
from System.Collections.Generic import *
try:
    user_path = os.getenv("APPDATA")
    sys.path.append(os.path.join(user_path, "Morpho"))
    clr.AddReferenceToFile("Morpho25.dll")
    from Morpho25.Settings import Model
    from Morpho25.Utility import EnvimetUtility
    from Morpho25.Geometry import *
    
except ImportError as e:
    raise ImportError("\nFailed to import Morpho: {0}\n\nCheck your 'Morpho' folder in {1}".format(e, os.getenv("APPDATA")))
################################################
ghenv.Component.Message = "2.0.0"

def main():
    
    if _inx_grid and _inx_location and _inx_workspace and _run_it:
        
        model = Model(_inx_grid, _inx_location, _inx_workspace)
        
        building = []
        plant3d = []
        plant2d = []
        receptor = []
        soil = []
        source = []
        terrain = []
        
        if _inx_objects_:
            for obj in _inx_objects_:
                if (type(obj) == Building):
                    building.append(obj)
                if (type(obj) == Plant3d):
                    plant3d.append(obj)
                if (type(obj) == Plant2d):
                    plant2d.append(obj)
                if (type(obj) == Receptor):
                    receptor.append(obj)
                if (type(obj) == Soil):
                    soil.append(obj)
                if (type(obj) == Source):
                    source.append(obj)
                if (type(obj) == Terrain):
                    terrain.append(obj)
        
        if building: model.BuildingObjects = List[Building](building)
        if plant3d: model.Plant3dObjects = List[Plant3d](plant3d)
        if plant2d: model.Plant2dObjects = List[Plant2d](plant2d)
        if receptor: model.ReceptorObjects = List[Receptor](receptor)
        if soil: model.SoilObjects = List[Soil](soil)
        if source: model.SourceObjects = List[Source](source)
        if terrain: model.TerrainObjects = List[Terrain](terrain)
        
        model.Calculation()
        
        if _is_detailed_:
            model.IsDetailed = _is_detailed_
            if follow_terrain_:
                model.ShiftEachVoxel = follow_terrain_
        
        return model
    else:
        return

inx_model = main()
if not inx_model: print("Please, connect _inx_workspace, _inx_grid, _inx_location and set _run_it to 'True'.")
# ---------- end morpho_model ----------

# ---- group: Use ASCII Terrain / 2
toggle_2 = BooleanToggle(False)

# ---- group: Use ASCII Terrain / Replace with a full path of ASCII file
python = GhPythonScript()  # -> shp
# ---------- python: Python ----------
"""Get current path - for examples only"""

__author__ = "antonellodinunzio"

import os
file_name = ghenv.Component.OnPingDocument().FilePath
shp = os.path.join(os.path.dirname(file_name), "ASCII\\dem.txt")
# ---------- end python ----------

# ---- group: Use ASCII Terrain
morpho_write_model_ascii_dem = MorphoWriteModelASCIIDEM(inx_model=morpho_model.inx_model, ASCII_DEM_file=python, write_it=toggle_2)  # -> out, file_path; inputs write_it: Boolean
# ---------- morpho_write_model_ascii_dem: Python ----------
# Morpho: A plugin to write Envimet models.
# This file is part of Morpho project.
#
# Copyright (c) 2023, Antonello Di Nunzio <plugin@antonellodinunzio.online>.
# You should have received a copy of the GNU General Public License
# along with Morpho project; If not, see <http://www.gnu.org/licenses/>.
# 
# @license AGPL-3.0-or-later <https://spdx.org/licenses/AGPL-3.0-or-later>

"""
EXPERT ONLY - Write an 2.5D Inx Model adding custom ASCII terrain matrix. You must use it before running simulation.
-
Use this component to save INX file on your machine and only if you want to use a DEM matrix from custom text, otherwise you can use Morpho Terrain to generate terrain from Rhino geometries.
-
Icon made by Freepik <https://www.flaticon.com/authors/freepik>.
See license for more details.
    Args:
        _inx_model: Inx Model.
        _ASCII_DEM_file: absolute path of text file that contain only ASCII matrix of terrain.E.g. C:\Example\dem.txt
        -
        Terrain ASCII matrix is made by integers divided by comma and each row is divided by newline. E.g. 
        2,2,3,4,5,6,6
        2,2,3,4,5,6,6
        ...
        Number of row must be equal to numY of Grid. Number of integers for each row must be equal to numX of Grid.
        _write_it: Set it to 'True' to write model on your machine.
    
    Returns:
        read_me: Message for users.
        file_path: Path where inx file is on your machine.
"""

ghenv.Component.Name = "Morpho Write Model ASCII DEM"
ghenv.Component.NickName = "morpho_write_model_ASCII_DEM"
ghenv.Component.Category = "Morpho"
ghenv.Component.SubCategory = "3 || IO"
try: ghenv.Component.AdditionalHelpFromDocStrings = "1"
except: pass

import scriptcontext as sc
import os
import sys
import clr
##################Envimet INX####################
try:
    user_path = os.getenv("APPDATA")
    sys.path.append(os.path.join(user_path, "Morpho"))
    clr.AddReferenceToFile("Morpho25.dll")
    from Morpho25.IO import Inx
    
except ImportError as e:
    raise ImportError("\nFailed to import Morpho: {0}\n\nCheck your 'Morpho' folder in {1}".format(e, os.getenv("APPDATA")))
################################################
ghenv.Component.Message = "2.0.0"

def main():
    
    if _inx_model and _ASCII_DEM_file and _write_it:
        
        with open(_ASCII_DEM_file, 'r') as f:
            text = f.read()
        
        inx = Inx(_inx_model, text)
        
        inx.WriteInx()
        
        return inx.Model.Workspace.ModelPath
    else:
        return

file_path = main()
if not file_path: print("Please, connect _inx_model, _ASCII_DEM_file and set _write_it to 'True'.")
# ---------- end morpho_write_model_ascii_dem ----------

# ---- group: Open Envimet Spaces / 3
toggle_3 = BooleanToggle(False)

# ---- group: Open Envimet Spaces
morpho_run_inx = MorphoRunINX(file_path=morpho_write_model_ascii_dem.file_path, run_it=toggle_3)  # inputs run_it: Boolean
# ---------- morpho_run_inx: Python ----------
# Morpho: A plugin to write Envimet models.
# This file is part of Morpho project.
#
# Copyright (c) 2023, Antonello Di Nunzio <plugin@antonellodinunzio.online>.
# You should have received a copy of the GNU General Public License
# along with Morpho project; If not, see <http://www.gnu.org/licenses/>.
# 
# @license AGPL-3.0-or-later <https://spdx.org/licenses/AGPL-3.0-or-later>

"""
This component open ENVI_MET Spaces to check the model.
    Args:
        _file_path: Full path of the Model (INX).
        _run_it: Set it to 'True' to run simulation.
        
    Returns:
        read_me: Message for users.
"""

ghenv.Component.Name = "Morpho Run INX"
ghenv.Component.NickName = "morpho_run_inx"
ghenv.Component.Category = "Morpho"
ghenv.Component.SubCategory = "5 || Util"
try: ghenv.Component.AdditionalHelpFromDocStrings = "1"
except: pass

import scriptcontext as sc
import os
import sys
import clr
##################Envimet INX####################
try:
    user_path = os.getenv("APPDATA")
    sys.path.append(os.path.join(user_path, "Morpho"))
    clr.AddReferenceToFile("Morpho25.dll")
    from Morpho25.IO import SimulationBatch
    
except ImportError as e:
    raise ImportError("\nFailed to import Morpho: {0}\n\nCheck your 'Morpho' folder in {1}".format(e, os.getenv("APPDATA")))
################################################
ghenv.Component.Message = "2.0.0"


def main():
    
    if _file_path and _run_it:
        
        os.startfile(_file_path)
        
        return "OK"
    else:
        return

result = main()
if not result: print("Please, connect INX file address and _run_it to 'True'.")
# ---------- end morpho_run_inx ----------
