# Grasshopper definition modeling_simulation_results.gh (Grasshopper 1.0.7)
# Copyright: Coprat

# ---- group: Grid
# Morpho 1.0.1
# 
# from modeling to simulation
# ++++++++++++++++++++++++++++
# Requirements:
# - Rhino6/Rhino7
# - Morpho
# - Ladybug Legacy 0.0.69
# - Human
# ++++++++++++++++++++++++++++
# Author: Antonello Di Nunzio
# www.antonellodinunzio.online
# License: GPL V.3.0+
number_slider = Slider(2, range=1..5)
pt = Point(Point(15, 19, 0))
morpho_grid_size = MorphoGridSize(point=pt, dim_x=number_slider, dim_y=number_slider, dim_z=number_slider, num_x="39", num_y="37", num_z="15")  # -> read_me, grid_size; inputs point: Point3d, num_x: Int32, num_y: Int32, num_z: Int32
# ---------- morpho_grid_size: Python ----------
# Morpho: A plugin to write Envimet 2.5D models.
# This file is part of Morpho project.
#
# Copyright (c) 2020, Antonello Di Nunzio <antonellodinunzio@gmail.com>.
# You should have received a copy of the GNU General Public License
# along with Morpho project; If not, see <http://www.gnu.org/licenses/>.
# 
# @license GPL-3.0+ <http://spdx.org/licenses/GPL-3.0+>

"""
Set Inx Grid properties.
    Args:
        _point: Reference point of the grid [Point3d].
        _dim_x_: X dimension of the grid cell [float].
        _dim_y_: Y dimension of the grid cell [float].
        _dim_z_: Z dimension of the grid cell [float].
        _num_x_: Number of grid cells in X [integer].
        _num_y_: Number of grid cells in Y [integer].
        _num_y_: Number of grid cells in Z [integer].
    
    Returns:
        read_me: Message for users.
        grid_size: Inx Grid attributes. Connect it to Grid component.
"""

ghenv.Component.Name = "Morpho Grid Size"
ghenv.Component.NickName = "morpho_grid_size"
ghenv.Component.Category = "Morpho"
ghenv.Component.SubCategory = "1 || Settings"
try: ghenv.Component.AdditionalHelpFromDocStrings = "2"
except: pass

import scriptcontext as sc
import os
import sys
import clr
##################Envimet INX####################
try:
    user_path = os.getenv("APPDATA")
    sys.path.append(os.path.join(user_path, "Morpho"))
    clr.AddReferenceToFile("Morpho25.dll")
    clr.AddReferenceToFile("MorphoRhino.dll")
    from Morpho25.Geometry import CellDimension, Size
    from MorphoRhino.RhinoAdapter import RhinoConvert
    
except ImportError as e:
    raise ImportError("\nFailed to import Morpho: {0}\n\nCheck your 'Morpho' folder in {1}".format(e, os.getenv("APPDATA")))
################################################
ghenv.Component.Message = "1.0.1 2.5D"

def main():
    
    if _point:
        
        origin = RhinoConvert.FromRhPointToVector(_point)
        dim_x = _dim_x_ if _dim_x_ else 3.0
        dim_y = _dim_y_ if _dim_y_ else 3.0
        dim_z = _dim_z_ if _dim_z_ else 3.0
        num_x = _num_x_ if _num_x_ else 50
        num_y = _num_y_ if _num_y_ else 50
        num_z = _num_z_ if _num_z_ else 40
        
        dimension = CellDimension(dim_x, dim_y, dim_z)
        size = Size(origin, dimension, num_x, num_y, num_z)
        
        return size
    else:
        return

grid_size = main()
if not _point: print("Please, connect _point.")
# ---------- end morpho_grid_size ----------
morpho_grid = MorphoGrid(grid_size=morpho_grid_size.grid_size, telescope=Slider(8, range=0..10), telescope_start_height=Slider(3.31, range=0..10))  # -> read_me, inx_grid; inputs combined_grid: Boolean
# ---------- morpho_grid: Python ----------
# Morpho: A plugin to write Envimet 2.5D models.
# This file is part of Morpho project.
#
# Copyright (c) 2020, Antonello Di Nunzio <antonellodinunzio@gmail.com>.
# You should have received a copy of the GNU General Public License
# along with Morpho project; If not, see <http://www.gnu.org/licenses/>.
# 
# @license GPL-3.0+ <http://spdx.org/licenses/GPL-3.0+>

"""
Construct an Inx Grid.
    Args:
        _grid_size: Grid properties created by 'Envimet INX Grid Size'.
        _telescope_: Connect a number to change grid type from equidistant grid into telescopic grid [float].
        _telescope_start_height_: Height where to start telescoping Z grid growth [float].
        _combined_grid_: Set it to 'True' if you want to combine equidistant and telescopic grid [bool].
    
    Returns:
        read_me: Message for users.
        inx_grid: Inx Grid.
"""

ghenv.Component.Name = "Morpho Grid"
ghenv.Component.NickName = "morpho_grid"
ghenv.Component.Category = "Morpho"
ghenv.Component.SubCategory = "1 || Settings"
try: ghenv.Component.AdditionalHelpFromDocStrings = "2"
except: pass

import scriptcontext as sc
import os
import sys
import clr
##################Envimet INX####################
try:
    user_path = os.getenv("APPDATA")
    sys.path.append(os.path.join(user_path, "Morpho"))
    clr.AddReferenceToFile("Morpho25.dll")
    from Morpho25.Geometry import Grid
    
except ImportError as e:
    raise ImportError("\nFailed to import Morpho: {0}\n\nCheck your 'Morpho' folder in {1}".format(e, os.getenv("APPDATA")))
################################################
ghenv.Component.Message = "1.0.1 2.5D"

def main():
    
    if _grid_size:
        
        grid = Grid(_grid_size)
        if (_telescope_ > 0 and _telescope_start_height_ > 0):
            grid = Grid(_grid_size, _telescope_, _telescope_start_height_, _combined_grid_)
        
        return grid
    else:
        return

inx_grid = main()
if not _grid_size: print("Please, connect _grid_size.")
# ---------- end morpho_grid ----------
morpho_decomp_grid = MorphoDecomposeGrid(inx_grid=morpho_grid.inx_grid, dir=Slider(2, range=0..2))  # -> read_me, points; inputs dir: Int32
# ---------- morpho_decomp_grid: Python ----------
# Morpho: A plugin to write Envimet 2.5D models.
# This file is part of Morpho project.
#
# Copyright (c) 2020, Antonello Di Nunzio <antonellodinunzio@gmail.com>.
# You should have received a copy of the GNU General Public License
# along with Morpho project; If not, see <http://www.gnu.org/licenses/>.
# 
# @license GPL-3.0+ <http://spdx.org/licenses/GPL-3.0+>

"""
Decompose Inx Grid to visualize its points (centroids).
    Args:
        _inx_grid: Inx Grid.
        _dir_: Connect an number [integer].
        -
        0 = XY
        1 = XZ
        2 = YZ
    
    Returns:
        read_me: Message for users.
        points: Preview of Envimet Grid.
"""

ghenv.Component.Name = "Morpho Decompose Grid"
ghenv.Component.NickName = "morpho_decomp_grid"
ghenv.Component.Category = "Morpho"
ghenv.Component.SubCategory = "1 || Settings"
try: ghenv.Component.AdditionalHelpFromDocStrings = "2"
except: pass

import scriptcontext as sc
import os
import sys
import clr
import Rhino
##################Envimet INX####################
try:
    user_path = os.getenv("APPDATA")
    sys.path.append(os.path.join(user_path, "Morpho"))
    clr.AddReferenceToFile("Morpho25.dll")
    from Morpho25.Geometry import Grid
    
except ImportError as e:
    raise ImportError("\nFailed to import Morpho: {0}\n\nCheck your 'Morpho' folder in {1}".format(e, os.getenv("APPDATA")))
################################################
ghenv.Component.Message = "1.0.1 2.5D"

def main():
    
    if _inx_grid:
        
        points = []
        
        x_axis = _inx_grid.Xaxis;
        y_axis = _inx_grid.Yaxis;
        z_axis = _inx_grid.Zaxis;
        
        dir = 0 if _dir_ == None else _dir_
        
        if dir == 0:
            for x in x_axis:
                for y in y_axis:
                    points.append(Rhino.Geometry.Point3d(x, y, 0))
        
        if dir == 1:
            for x in x_axis:
                for z in z_axis:
                    points.append(Rhino.Geometry.Point3d(x, y_axis[0], z))
        
        if dir == 2:
            for y in y_axis:
                for z in z_axis:
                    points.append(Rhino.Geometry.Point3d(x_axis[0], y, z))
        
        return points
    else:
        return

points = main()
if not points: print("Please, connect _inx_grid.")
# ---------- end morpho_decomp_grid ----------
morpho_decomp_grid_2 = MorphoDecomposeGrid(inx_grid=morpho_grid.inx_grid, dir=Slider(0, range=0..2))  # -> read_me, points; inputs dir: Int32; same code as morpho_decomp_grid
morpho_decomp_grid_3 = MorphoDecomposeGrid(inx_grid=morpho_grid.inx_grid, dir=Slider(1, range=0..2))  # -> read_me, points; inputs dir: Int32; same code as morpho_decomp_grid
bbox = BoundingBox(
    Content=[morpho_decomp_grid_2.points, morpho_decomp_grid_3.points, morpho_decomp_grid.points],
    Plane=PlaneXY(0, 0, 0),
    UnionBox=True)  # -> Box, Box_2
edges = BrepEdges(Brep=bbox.Box)  # -> Naked, Interior, NonManifold

# ---- group: Workspace and Location
morpho_location = MorphoLocation(name="Larino", latitude="41.809018", longitude="14.9230298", time_zone="1")  # -> read_me, inx_location; inputs time_zone: Int32
# ---------- morpho_location: Python ----------
# Morpho: A plugin to write Envimet 2.5D models.
# This file is part of Morpho project.
#
# Copyright (c) 2020, Antonello Di Nunzio <antonellodinunzio@gmail.com>.
# You should have received a copy of the GNU General Public License
# along with Morpho project; If not, see <http://www.gnu.org/licenses/>.
# 
# @license GPL-3.0+ <http://spdx.org/licenses/GPL-3.0+>

"""
Construct a Inx Location.
-
You can decompose location data from other plugin, such as Ladybug and Gismo!
    Args:
        _name_: Name of Location.
        _latitude: Latitude of Location WGS84 [float].
        _longitude_: Longitude of Location WGS84 [float].
        _time_zone_: UTC timezone of location [integer].
        _model_rotation_: Rotation angle of your model [float].
        utm_: UTM object from "Morpho UTM" [UTM].
        _longitude_reference_: Longitude reference of your Location. Default is 15.0. [float].
    
    Returns:
        read_me: Message for users.
        inx_location: Inx Location.
"""

ghenv.Component.Name = "Morpho Location"
ghenv.Component.NickName = "morpho_location"
ghenv.Component.Category = "Morpho"
ghenv.Component.SubCategory = "1 || Settings"
try: ghenv.Component.AdditionalHelpFromDocStrings = "1"
except: pass

import scriptcontext as sc
import os
import sys
import clr
################### Morpho #####################
try:
    user_path = os.getenv("APPDATA")
    sys.path.append(os.path.join(user_path, "Morpho"))
    clr.AddReferenceToFile("Morpho25.dll")
    from Morpho25.Settings import Location
    
except ImportError as e:
    raise ImportError("\nFailed to import Morpho: {0}\n\nCheck your 'Morpho' folder in {1}".format(e, os.getenv("APPDATA")))
################################################
ghenv.Component.Message = "1.0.1 2.5D"

def main():
    
    if _latitude and _longitude:
        
        location = Location(_latitude, _longitude)
        
        if _name_:
            location = Location(_latitude, _longitude, _name_)
        if _name_ and _time_zone_:
            location = Location(_latitude, _longitude, _name_, str(_time_zone_))
        if _name_ and _time_zone_ and _model_rotation_:
            location = Location(_latitude, _longitude, _name_, str(_time_zone_), _model_rotation_)
        
        if _model_rotation_: location.ModelRotation = _model_rotation_ 
        if utm_: location.UTM = utm_ 
        if _longitude_reference_: location.TimezoneReference = _longitude_reference_ 
        
        return location
    else:
        return

inx_location = main()
if not inx_location: print("Please, connect latitude and longitude.")
# ---------- end morpho_location ----------
morpho_workspace = MorphoWorkspace(workspace_folder="C:\Envimet\Small_town_prj", project_name="Small_town", model_name="Small_town_model")  # -> read_me, inx_workspace; inputs userDB: Boolean
# ---------- morpho_workspace: Python ----------
# Morpho: A plugin to write Envimet 2.5D models.
# This file is part of Morpho project.
#
# Copyright (c) 2020, Antonello Di Nunzio <antonellodinunzio@gmail.com>.
# You should have received a copy of the GNU General Public License
# along with Morpho project; If not, see <http://www.gnu.org/licenses/>.
# 
# @license GPL-3.0+ <http://spdx.org/licenses/GPL-3.0+>

"""
Set Envimet Model.
-
Model structure of ENVI-Met.
. Workspace -> Project -> Model (inx)
    Args:
        _workspace_folder: Main folder where to save an Envimet project (e.g. C:\Example) [string].
        _project_name_: Name of the current project [string].
        _model_name_: Name of the model to write [string].
        _userDB_: Set it 'True' to user user database instead of project database.
        -
        Database structure of ENVI-Met.
        1. System database is part of envimet software. It contains standard materials.
        2. Project database is part of the project and it is custom.
        3. User database is shared among all projects that do not use project database.
        -
        If you use project database you cannot use user database and vice-versa.
        envimetFolder_: Envimet folder on your machine. If it does not recognize Envimet connect it (e.g. C:\ENVImet445).
    
    Returns:
        read_me: Message for users.
        inx_workspace: Inx Workspace.
"""

ghenv.Component.Name = "Morpho Workspace"
ghenv.Component.NickName = "morpho_workspace"
ghenv.Component.Category = "Morpho"
ghenv.Component.SubCategory = "1 || Settings"
try: ghenv.Component.AdditionalHelpFromDocStrings = "1"
except: pass

import scriptcontext as sc
import os
import sys
import clr
##################Envimet INX####################
try:
    user_path = os.getenv("APPDATA")
    sys.path.append(os.path.join(user_path, "Morpho"))
    clr.AddReferenceToFile("Morpho25.dll")
    from Morpho25.Management import Workspace, DatabaseSource
    
except ImportError as e:
    raise ImportError("\nFailed to import Morpho: {0}\n\nCheck your 'Morpho' folder in {1}".format(e, os.getenv("APPDATA")))
################################################
ghenv.Component.Message = "1.0.1 2.5D"

def main():
    
    db_type = DatabaseSource.Project if not _userDB_ else DatabaseSource.User
    
    if _workspace_folder:
        
        if _project_name_ and _model_name_:
            workspace = Workspace(_workspace_folder, db_type, _project_name_, _model_name_, envimetFolder_)
        else:
            workspace = Workspace(_workspace_folder, db_type, envimetFolder_)
        
        return workspace
    else:
        return

inx_workspace = main()
if not inx_workspace: print("Please, connect _workspace_folder.")
# ---------- end morpho_workspace ----------

# ---- group: Geometry
# Normal of a 2D surface for soil has to be in -z direction.
# OR you can extrude it a bit if you do not want to check normals
# Divide terrain surface into chuncks to speed up calculation
brep = Brep([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])
brep_2 = Brep([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])
crv = Curve([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])
brep_3 = Brep([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])
brep_4 = Brep([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])
divide = DivideCurve(Curve=crv, Count=10, Kinks=False)  # -> Points, Tangents, Parameters
morpho_facegroup = MorphoFacegroup(geometry=brep_2)  # -> read_me, inx_facegroup; inputs geometry: list of Mesh
# ---------- morpho_facegroup: Python ----------
# Morpho: A plugin to write Envimet 2.5D models.
# This file is part of Morpho project.
#
# Copyright (c) 2020, Antonello Di Nunzio <antonellodinunzio@gmail.com>.
# You should have received a copy of the GNU General Public License
# along with Morpho project; If not, see <http://www.gnu.org/licenses/>.
# 
# @license GPL-3.0+ <http://spdx.org/licenses/GPL-3.0+>

"""
Construct a Inx Faces from rh mesh or brep to use with Envimet Entities.
-
Icon made by Freepik <https://www.flaticon.com/authors/freepik>.
See license for more details.
    Args:
        _geometry: Rhino mesh or brep [List or Item or Tree of Mesh]
    
    Returns:
        read_me: Message for users.
        inx_facegroup: Inx geometry (FaceGroup) to use with Envimet Entities.
        mesh: Rhino mesh for checking.
"""

ghenv.Component.Name = "Morpho Facegroup"
ghenv.Component.NickName = "morpho_facegroup"
ghenv.Component.Category = "Morpho"
ghenv.Component.SubCategory = "0 || Geometry"
try: ghenv.Component.AdditionalHelpFromDocStrings = "1"
except: pass

import scriptcontext as sc
import os
import sys
import clr
################### Morpho #####################
try:
    user_path = os.getenv("APPDATA")
    sys.path.append(os.path.join(user_path, "Morpho"))
    clr.AddReferenceToFile("MorphoRhino.dll")
    from MorphoRhino.RhinoAdapter import RhinoConvert
    
except ImportError as e:
    raise ImportError("\nFailed to import Morpho: {0}\n\nCheck your 'Morpho' folder in {1}".format(e, os.getenv("APPDATA")))
################################################
ghenv.Component.Message = "1.0.1 2.5D"

def main():
    
    if _geometry != None:
        
        inx_facegroup = [RhinoConvert.FromRhMeshToFacegroup(geo) for geo in _geometry]
        
        return inx_facegroup
    else:
        return

inx_facegroup = main()
if not inx_facegroup: print("Please, connect _geometry.")
# ---------- end morpho_facegroup ----------
morpho_facegroup_2 = MorphoFacegroup(geometry=brep)  # -> read_me, inx_facegroup; inputs geometry: list of Mesh; same code as morpho_facegroup
morpho_facegroup_3 = MorphoFacegroup(geometry=brep_3)  # -> read_me, inx_facegroup; inputs geometry: list of Mesh; same code as morpho_facegroup
morpho_facegroup_4 = MorphoFacegroup(geometry=brep_4)  # -> read_me, inx_facegroup; inputs geometry: list of Mesh; same code as morpho_facegroup
morpho_point = MorphoPoint(point=divide.Points)  # -> read_me, inx_point; inputs point: list of Point3d
# ---------- morpho_point: Python ----------
# Morpho: A plugin to write Envimet 2.5D models.
# This file is part of Morpho project.
#
# Copyright (c) 2020, Antonello Di Nunzio <antonellodinunzio@gmail.com>.
# You should have received a copy of the GNU General Public License
# along with Morpho project; If not, see <http://www.gnu.org/licenses/>.
# 
# @license GPL-3.0+ <http://spdx.org/licenses/GPL-3.0+>

"""
Construct a Inx Point to use with Envimet Entities.
-
Icon made by Freepik <https://www.flaticon.com/authors/freepik>.
See license for more details.
    Args:
        _point: Rhino point [list Point3d]
    
    Returns:
        read_me: Message for users.
        inx_point: Inx Point to use with Envimet Entities.
"""

ghenv.Component.Name = "Morpho Point"
ghenv.Component.NickName = "morpho_point"
ghenv.Component.Category = "Morpho"
ghenv.Component.SubCategory = "0 || Geometry"
try: ghenv.Component.AdditionalHelpFromDocStrings = "1"
except: pass

import scriptcontext as sc
import os
import sys
import clr
################### Morpho #####################
try:
    user_path = os.getenv("APPDATA")
    sys.path.append(os.path.join(user_path, "Morpho"))
    clr.AddReferenceToFile("MorphoRhino.dll")
    from MorphoRhino.RhinoAdapter import RhinoConvert
    
except ImportError as e:
    raise ImportError("\nFailed to import Morpho: {0}\n\nCheck your 'Morpho' folder in {1}".format(e, os.getenv("APPDATA")))
################################################
ghenv.Component.Message = "1.0.1 2.5D"

def main():
    
    if _point != None:
        
        inx_point = [RhinoConvert.FromRhPointToVector(pt) for pt in _point]
        
        return inx_point
    else:
        return

inx_point = main()
if not _point: print("Please, connect _point.")
# ---------- end morpho_point ----------

# ----
panel = Panel(morpho_facegroup.inx_facegroup)

# ---- group: Material
morpho_library = MorphoLibrary(inx_workspace=morpho_workspace.inx_workspace, type="wall", keyword="brick")  # -> read_me, code, description, XML; inputs systemDB: Boolean
# ---------- morpho_library: Python ----------
# Morpho: A plugin to write Envimet 2.5D models.
# This file is part of Morpho project.
#
# Copyright (c) 2020, Antonello Di Nunzio <antonellodinunzio@gmail.com>.
# You should have received a copy of the GNU General Public License
# along with Morpho project; If not, see <http://www.gnu.org/licenses/>.
# 
# @license GPL-3.0+ <http://spdx.org/licenses/GPL-3.0+>

"""
Read Envimet materials.
-
You can connect 'code' to customize inx object materials.
    Args:
        _inx_workspace:  Workspace of your current project.
        _type_: Type of material to read. Write one of following string
        profile
        soil
        material
        wall
        source
        plant
        plant3d
        greening
        -
        Default value is 'profile'.
        _keyword_: Connect a string to filter library. E.g. asphalt [string].
        systemDB_: Set it 'True' to use system database.
        If you set 'False' user or profile library will be used. Default is 'True' [bool].
    
    Returns:
        read_me: Message for users.
        code: Material code to use with inx_objects.
        description: Material description.
        XML: XML detail of material.
"""

ghenv.Component.Name = "Morpho Library"
ghenv.Component.NickName = "morpho_library"
ghenv.Component.Category = "Morpho"
ghenv.Component.SubCategory = "1 || Settings"
try: ghenv.Component.AdditionalHelpFromDocStrings = "1"
except: pass

import scriptcontext as sc
import os
import sys
import clr
################### Morpho #####################
try:
    user_path = os.getenv("APPDATA")
    sys.path.append(os.path.join(user_path, "Morpho"))
    clr.AddReferenceToFile("Morpho25.dll")
    from Morpho25.Management import Workspace
    from Morpho25.IO import Library
    
except ImportError as e:
    raise ImportError("\nFailed to import Morpho: {0}\n\nCheck your 'Morpho' folder in {1}".format(e, os.getenv("APPDATA")))
################################################
ghenv.Component.Message = "1.0.1 2.5D"

def main():
    
    if systemDB_ == None:
        systemDB = True
    else:
        systemDB = systemDB_
    
    type = _type_.upper() if _type_ else Library.PROFILE
    
    alternative_lib = _inx_workspace.UserDB if _inx_workspace.UserDB else _inx_workspace.ProjectDB
    lib = _inx_workspace.SystemDB if systemDB else alternative_lib
    
    library = Library(lib, type, _keyword_)
    
    return library.Code, library.Description, library.Detail

if not _inx_workspace:
    print("Please, connect _inx_workspace.")
else:
    code, description, XML = main()
# ---------- end morpho_library ----------
item = ListItem(List=morpho_library.code, Index=0, Wrap=True)
morpho_building_mat = MorphoBuildingMaterial(wall_code=item)  # -> read_me, material
# ---------- morpho_building_mat: Python ----------
# Morpho: A plugin to write Envimet 2.5D models.
# This file is part of Morpho project.
#
# Copyright (c) 2020, Antonello Di Nunzio <antonellodinunzio@gmail.com>.
# You should have received a copy of the GNU General Public License
# along with Morpho project; If not, see <http://www.gnu.org/licenses/>.
# 
# @license GPL-3.0+ <http://spdx.org/licenses/GPL-3.0+>

"""
Construct material code to create a building material.
    Args:
        _wall_code_: Code of wall material [string]. E.g. 000000.
        -
        Type of material to connect: wall
        _roof_code_: Code of roof material [string]. E.g. 000000.
        -
        Type of material to connect: wall
        _green_wall_code_: Code of green wall material [string].
        -
        Type of material to connect: greening
        _green_roof_code_: Code of green roof material [string].
        -
        Type of material to connect: greening
    
    Returns:
        read_me: Message for users.
        material: Inx Building material.
"""

ghenv.Component.Name = "Morpho Building Material"
ghenv.Component.NickName = "morpho_building_mat"
ghenv.Component.Category = "Morpho"
ghenv.Component.SubCategory = "1 || Settings"
try: ghenv.Component.AdditionalHelpFromDocStrings = "2"
except: pass

import scriptcontext as sc
import os
import sys
import clr
##################Envimet INX####################
try:
    user_path = os.getenv("APPDATA")
    sys.path.append(os.path.join(user_path, "Morpho"))
    clr.AddReferenceToFile("Morpho25.dll")
    from Morpho25.Geometry import Building
    
except ImportError as e:
    raise ImportError("\nFailed to import Morpho: {0}\n\nCheck your 'Morpho' folder in {1}".format(e, os.getenv("APPDATA")))
################################################
ghenv.Component.Message = "1.0.1 2.5D"

def main():
    
    material = Building.CreateMaterial(_wall_code_, _roof_code_, _green_wall_code_, _green_roof_code_)
    
    return material

material = main()
# ---------- end morpho_building_mat ----------

morpho_library_2 = MorphoLibrary(inx_workspace=morpho_workspace.inx_workspace, type="plant3d", keyword="5")  # -> read_me, code, description, XML; inputs systemDB: Boolean; same code as morpho_library
item_2 = ListItem(List=morpho_library_2.code, Index="4", Wrap=True)

morpho_library_3 = MorphoLibrary(inx_workspace=morpho_workspace.inx_workspace, type="profile", keyword="road")  # -> read_me, code, description, XML; inputs systemDB: Boolean; same code as morpho_library
item_3 = ListItem(List=morpho_library_3.code, Index="1", Wrap=True)

# ---- group: 1
toggle = BooleanToggle(False)

# ---- group: Buildings
panel_2 = Panel("4")
morpho_building = MorphoBuilding(
    inx_grid=morpho_grid.inx_grid,
    inx_facegroup=flatten(morpho_facegroup_2.inx_facegroup),
    ID="1",
    name="BuildingType1",
    run=toggle)  # -> read_me, inx_building, id_count; inputs inx_facegroup: list, ID: Int32, enable_BPS: Boolean, run: Boolean
# ---------- morpho_building: Python ----------
# Morpho: A plugin to write Envimet models.
# This file is part of Morpho project.
#
# Copyright (c) 2022, Antonello Di Nunzio <antonellodinunzio@gmail.com>.
# You should have received a copy of the GNU General Public License
# along with Morpho project; If not, see <http://www.gnu.org/licenses/>.
# 
# @license AGPL-3.0-or-later <https://spdx.org/licenses/AGPL-3.0-or-later>

"""
Construct an Inx Building.
-
Behavior:
The component will assign automatically IDs starting from _ID connected
    Args:
        _inx_grid: Inx Grid.
        _inx_facegroup: Inx Facegroup that represents a building <Item or List>.
        -
        If you connect a list of inx_facegroup ID will be added automatically.
        _ID: An integer to identify a building [integer].
        _name_: Optional name to give to building [string].
        _material_: Material to apply to buildings [Material]. Default material is 000000.
        -
        Use output of 'Morpho Building Material' component to change it.
        enable_BPS_: It enables Building Performance Simulation output [bool]. For business version only.
        _run: Set it to True to run it.
    
    Returns:
        read_me: Message for users.
        inx_building: Inx Building to use as input of 'Morpho Model' component.
        id_count: Connect this number to the _ID of another 'morpho_building' component to keep the correct ID order
"""

ghenv.Component.Name = "Morpho Building"
ghenv.Component.NickName = "morpho_building"
ghenv.Component.Category = "Morpho"
ghenv.Component.SubCategory = "2 || Entity"
try: ghenv.Component.AdditionalHelpFromDocStrings = "1"
except: pass


import scriptcontext as sc
import os
import sys
import clr
import Grasshopper.Kernel as gh
##################Envimet INX####################
try:
    user_path = os.getenv("APPDATA")
    sys.path.append(os.path.join(user_path, "Morpho"))
    clr.AddReferenceToFile("Morpho25.dll")
    from Morpho25.Geometry import Building
    
except ImportError as e:
    raise ImportError("\nFailed to import Morpho: {0}\n\nCheck your 'Morpho' folder in {1}".format(e, os.getenv("APPDATA")))
################################################
ghenv.Component.Message = "1.1.1"

def main():
    
    if _run and _inx_grid and _inx_facegroup and _ID:
        IDs = [i+_ID for i in xrange(len(_inx_facegroup))]
        
        building = [Building(_inx_grid, mesh, index, 
            _material_, _name_, enable_BPS_) for mesh, index in zip(_inx_facegroup, IDs)]
        
        return building
    else:
        return

inx_building = main()
if not inx_building:
    w = gh.GH_RuntimeMessageLevel.Warning
    msg = "Please, connect _inx_grid, _inx_facegroup, _ID, _run."
    ghenv.Component.AddRuntimeMessage(w, msg)
    print(msg)
if inx_building:
    id_count = len(inx_building) + 1
# ---------- end morpho_building ----------
morpho_building_2 = MorphoBuilding(
    inx_grid=morpho_grid.inx_grid,
    inx_facegroup=flatten(morpho_facegroup.inx_facegroup),
    ID=morpho_building.id_count,
    name="BuildingType2",
    material=morpho_building_mat.material,
    run=toggle)  # -> read_me, inx_building, id_count; inputs inx_facegroup: list, ID: Int32, enable_BPS: Boolean, run: Boolean; same code as morpho_building

# ---- group: Terrain
morpho_terrain = MorphoTerrain(inx_grid=morpho_grid.inx_grid, inx_facegroup=flatten(morpho_facegroup_4.inx_facegroup), ID="1")  # -> read_me, inx_terrain; inputs inx_facegroup: list, ID: Int32
# ---------- morpho_terrain: Python ----------
# Morpho: A plugin to write Envimet 2.5D models.
# This file is part of Morpho project.
#
# Copyright (c) 2020, Antonello Di Nunzio <antonellodinunzio@gmail.com>.
# You should have received a copy of the GNU General Public License
# along with Morpho project; If not, see <http://www.gnu.org/licenses/>.
# 
# @license GPL-3.0+ <http://spdx.org/licenses/GPL-3.0+>

"""
Construct an Inx Terrain.
-
If you have a single mesh or surface split it in many parts to speed up calculation.
-
Behavior:
The component will assign automatically IDs starting from _ID connected
    Args:
        _inx_grid: Inx Grid.
        _inx_facegroup: Inx Facegroup.
        _ID: An integer to identify terrain group [integer].
        _name_: Optional name to give to terrain group [string].
    
    Returns:
        read_me: Message for users.
        inx_terrain: Inx Terrain to use as input of 'Envimet INX Model' component.
"""

ghenv.Component.Name = "Morpho Terrain"
ghenv.Component.NickName = "morpho_terrain"
ghenv.Component.Category = "Morpho"
ghenv.Component.SubCategory = "2 || Entity"
try: ghenv.Component.AdditionalHelpFromDocStrings = "1"
except: pass

import scriptcontext as sc
import os
import sys
import clr
##################Envimet INX####################
try:
    user_path = os.getenv("APPDATA")
    sys.path.append(os.path.join(user_path, "Morpho"))
    clr.AddReferenceToFile("Morpho25.dll")
    from Morpho25.Geometry import Terrain
    
except ImportError as e:
    raise ImportError("\nFailed to import Morpho: {0}\n\nCheck your 'Morpho' folder in {1}".format(e, os.getenv("APPDATA")))
################################################
ghenv.Component.Message = "1.0.1 2.5D"

def main():
    
    if _inx_grid and _inx_facegroup and _ID:
        
        IDs = [i+_ID for i in xrange(len(_inx_facegroup))]
        
        terrain = [Terrain(_inx_grid, mesh, index, _name_) for mesh, index in zip(_inx_facegroup, IDs)]
        
        return terrain
    
    else:
        return

inx_terrain = main()
if not inx_terrain: print("Please, connect _inx_grid, _inx_facegroup, _ID.")
# ---------- end morpho_terrain ----------

# ---- group: Soil
morpho_soil = MorphoSoil(inx_grid=morpho_grid.inx_grid, inx_facegroup=flatten(morpho_facegroup_3.inx_facegroup), ID="1", code=item_3)  # -> read_me, inx_soil; inputs inx_facegroup: list, ID: Int32
# ---------- morpho_soil: Python ----------
# Morpho: A plugin to write Envimet 2.5D models.
# This file is part of Morpho project.
#
# Copyright (c) 2020, Antonello Di Nunzio <antonellodinunzio@gmail.com>.
# You should have received a copy of the GNU General Public License
# along with Morpho project; If not, see <http://www.gnu.org/licenses/>.
# 
# @license GPL-3.0+ <http://spdx.org/licenses/GPL-3.0+>

"""
Construct an Inx Soil.
-
Behavior:
The component will assign automatically IDs starting from _ID connected
    Args:
        _inx_grid: Inx Grid.
        _inx_facegroup: Inx Facegroup.
        _ID: An integer to identify soil [integer].
        _name_: Optional name to give to soil [string].
        _code_: Code of material to apply to soil [string]. E.g. 0100LO.
        -
        Type of material to connect: profile
    
    Returns:
        read_me: Message for users.
        inx_soil: Inx Soil to use as input of 'Morpho Model' component.
"""

ghenv.Component.Name = "Morpho Soil"
ghenv.Component.NickName = "morpho_soil"
ghenv.Component.Category = "Morpho"
ghenv.Component.SubCategory = "2 || Entity"
try: ghenv.Component.AdditionalHelpFromDocStrings = "1"
except: pass

import scriptcontext as sc
import os
import sys
import clr
##################Envimet INX####################
try:
    user_path = os.getenv("APPDATA")
    sys.path.append(os.path.join(user_path, "Morpho"))
    clr.AddReferenceToFile("Morpho25.dll")
    from Morpho25.Geometry import Soil
    
except ImportError as e:
    raise ImportError("\nFailed to import Morpho: {0}\n\nCheck your 'Morpho' folder in {1}".format(e, os.getenv("APPDATA")))
################################################
ghenv.Component.Message = "1.0.1 2.5D"

def main():
    
    if _inx_grid and _inx_facegroup and _ID:
        
        IDs = [i+_ID for i in xrange(len(_inx_facegroup))]
        
        soil = [Soil(_inx_grid, mesh, index, _code_, _name_) for mesh, index in zip(_inx_facegroup, IDs)]
        
        return soil
    
    else:
        return

inx_soil = main()
if not inx_soil: print("Please, connect _inx_grid, _inx_facegroup, _ID.")
# ---------- end morpho_soil ----------

# ---- group: Plant3D
morpho_plant3d = MorphoPlant3d(inx_grid=morpho_grid.inx_grid, inx_point=flatten(morpho_point.inx_point), code=item_2)  # -> read_me, inx_plant3d; inputs inx_point: list
# ---------- morpho_plant3d: Python ----------
# Morpho: A plugin to write Envimet 2.5D models.
# This file is part of Morpho project.
#
# Copyright (c) 2020, Antonello Di Nunzio <antonellodinunzio@gmail.com>.
# You should have received a copy of the GNU General Public License
# along with Morpho project; If not, see <http://www.gnu.org/licenses/>.
# 
# @license GPL-3.0+ <http://spdx.org/licenses/GPL-3.0+>

"""
Construct an Inx Plant3d.
    Args:
        _inx_grid: Inx Grid.
        _inx_point: Inx Point.
        _name_: Optional name to give to plant3d group [string].
        _code_: Code of material to apply to plant3d [string]. E.g. 0000C2.
        -
        Type of material to connect: plant3d
    
    Returns:
        read_me: Message for users.
        inx_plant3d: Inx Plant3d to use as input of 'Morpho Model' component.
"""

ghenv.Component.Name = "Morpho Plant3d"
ghenv.Component.NickName = "morpho_plant3d"
ghenv.Component.Category = "Morpho"
ghenv.Component.SubCategory = "2 || Entity"
try: ghenv.Component.AdditionalHelpFromDocStrings = "1"
except: pass

import scriptcontext as sc
import os
import sys
import clr
##################Envimet INX####################
try:
    user_path = os.getenv("APPDATA")
    sys.path.append(os.path.join(user_path, "Morpho"))
    clr.AddReferenceToFile("Morpho25.dll")
    from Morpho25.Geometry import Plant3d
    
except ImportError as e:
    raise ImportError("\nFailed to import Morpho: {0}\n\nCheck your 'Morpho' folder in {1}".format(e, os.getenv("APPDATA")))
################################################
ghenv.Component.Message = "1.0.1 2.5D"

def main():
    trees = []
    if _inx_grid and _inx_point:
        
        trees = [Plant3d(_inx_grid, vec, _code_, _name_) for vec in _inx_point]
        
        return trees
    else:
        return

inx_plant3d = main()
if not inx_plant3d: print("Please, connect _inx_grid, _inx_point.")
# ---------- end morpho_plant3d ----------

# ---- group: Write it / 3
toggle_2 = BooleanToggle(False)

# ---- group: Model / 2
toggle_3 = BooleanToggle(True)

# ---- group: Model
morpho_model = MorphoModel(
    inx_workspace=morpho_workspace.inx_workspace,
    inx_grid=morpho_grid.inx_grid,
    inx_location=morpho_location.inx_location,
    inx_objects=flatten([morpho_building.inx_building, morpho_building_2.inx_building, morpho_plant3d.inx_plant3d, morpho_soil.inx_soil, morpho_terrain.inx_terrain]),
    run_it=toggle_3)  # -> read_me, inx_model; inputs inx_objects: list, is_detailed: Boolean, follow_terrain: Boolean, run_it: Boolean
# ---------- morpho_model: Python ----------
# Morpho: A plugin to write Envimet models.
# This file is part of Morpho project.
#
# Copyright (c) 2022, Antonello Di Nunzio <antonellodinunzio@gmail.com>.
# You should have received a copy of the GNU General Public License
# along with Morpho project; If not, see <http://www.gnu.org/licenses/>.
# 
# @license AGPL-3.0-or-later <https://spdx.org/licenses/AGPL-3.0-or-later>

"""
Construct an Inx 2.5D Model or 3D Model
-
You can connect many envimet objects to it.
-
Icon by Envimet INX for Sketchup.
    Args:
        _inx_workspace: Workspace of your current project.
        _inx_grid: Inx Grid.
        _inx_location: Inx Location.
        _inx_objects_: Connect envimet objects [list]
        . inx_building;
        . inx_plant3d;
        . inx_plant2d;
        . inx_receptor;
        . inx_soil;
        . inx_source;
        . inx_terrain.
        _is_detailed_: Set it to 'True' to convert to detailed model.
        follow_terrain_: Set it to 'True' if you want buildings to follow terrain shape.
        'False' if you want to move buildings up by min height of the projected footprint on the terrain.
        _run_it: Set it to 'True' to create INX Model.
    
    Returns:
        read_me: Message for users.
        inx_model: INX Model.
        -
        Connect it to 'Morpho Write Model' to save *.inx file on your machine.
"""

ghenv.Component.Name = "Morpho Model"
ghenv.Component.NickName = "morpho_model"
ghenv.Component.Category = "Morpho"
ghenv.Component.SubCategory = "1 || IO"
try: ghenv.Component.AdditionalHelpFromDocStrings = "1"
except: pass

import scriptcontext as sc
import os
import sys
import clr
##################Envimet INX####################
from System.Collections.Generic import *
try:
    user_path = os.getenv("APPDATA")
    sys.path.append(os.path.join(user_path, "Morpho"))
    clr.AddReferenceToFile("Morpho25.dll")
    from Morpho25.Settings import Model
    from Morpho25.Utility import EnvimetUtility
    from Morpho25.Geometry import *
    
except ImportError as e:
    raise ImportError("\nFailed to import Morpho: {0}\n\nCheck your 'Morpho' folder in {1}".format(e, os.getenv("APPDATA")))
################################################
ghenv.Component.Message = "1.1.0"

def main():
    
    if _inx_grid and _inx_location and _inx_workspace and _run_it:
        
        model = Model(_inx_grid, _inx_location, _inx_workspace)
        
        building = []
        plant3d = []
        plant2d = []
        receptor = []
        soil = []
        source = []
        terrain = []
        
        if _inx_objects_:
            for obj in _inx_objects_:
                if (type(obj) == Building):
                    building.append(obj)
                if (type(obj) == Plant3d):
                    plant3d.append(obj)
                if (type(obj) == Plant2d):
                    plant2d.append(obj)
                if (type(obj) == Receptor):
                    receptor.append(obj)
                if (type(obj) == Soil):
                    soil.append(obj)
                if (type(obj) == Source):
                    source.append(obj)
                if (type(obj) == Terrain):
                    terrain.append(obj)
        
        if building: model.BuildingObjects = List[Building](building)
        if plant3d: model.Plant3dObjects = List[Plant3d](plant3d)
        if plant2d: model.Plant2dObjects = List[Plant2d](plant2d)
        if receptor: model.ReceptorObjects = List[Receptor](receptor)
        if soil: model.SoilObjects = List[Soil](soil)
        if source: model.SourceObjects = List[Source](source)
        if terrain: model.TerrainObjects = List[Terrain](terrain)
        
        model.Calculation()
        
        if _is_detailed_:
            model.IsDetailed = _is_detailed_
            if follow_terrain_:
                model.ShiftEachVoxel = follow_terrain_
        
        return model
    else:
        return

inx_model = main()
if not inx_model: print("Please, connect _inx_workspace, _inx_grid, _inx_location and set _run_it to 'True'.")
# ---------- end morpho_model ----------

# ----
panel_3 = Panel(morpho_model.inx_model)

# ---- group: Write it
morpho_write_model = MorphoWriteModel(inx_model=morpho_model.inx_model, write_it=toggle_2)  # -> read_me, file_path; inputs write_it: Boolean
# ---------- morpho_write_model: Python ----------
# Morpho: A plugin to write Envimet 2.5D models.
# This file is part of Morpho project.
#
# Copyright (c) 2020, Antonello Di Nunzio <antonellodinunzio@gmail.com>.
# You should have received a copy of the GNU General Public License
# along with Morpho project; If not, see <http://www.gnu.org/licenses/>.
# 
# @license GPL-3.0+ <http://spdx.org/licenses/GPL-3.0+>

"""
Write an Inx Model. You must use it before running simulation.
-
Use this component to save INX file on your machine.
-
Icon made by Freepik <https://www.flaticon.com/authors/freepik>.
See license for more details.
    Args:
        _inx_model: Inx Model.
        _write_it: Set it to 'True' to write model on your machine.
    
    Returns:
        read_me: Message for users.
        file_path: Path where inx file is on your machine.
"""

ghenv.Component.Name = "Morpho Write Model"
ghenv.Component.NickName = "morpho_write_model"
ghenv.Component.Category = "Morpho"
ghenv.Component.SubCategory = "3 || IO"
try: ghenv.Component.AdditionalHelpFromDocStrings = "1"
except: pass

import scriptcontext as sc
import os
import sys
import clr
##################Envimet INX####################
try:
    user_path = os.getenv("APPDATA")
    sys.path.append(os.path.join(user_path, "Morpho"))
    clr.AddReferenceToFile("Morpho25.dll")
    from Morpho25.IO import Inx
    
except ImportError as e:
    raise ImportError("\nFailed to import Morpho: {0}\n\nCheck your 'Morpho' folder in {1}".format(e, os.getenv("APPDATA")))
################################################
ghenv.Component.Message = "1.0.1 2.5D"

def main():
    
    if _inx_model and _write_it:
        
        inx = Inx(_inx_model)
        inx.WriteInx()
        
        return inx.Model.Workspace.ModelPath
    else:
        return

file_path = main()
if not file_path: print("Please, connect _inx_model and set _write_it to 'True'.")
# ---------- end morpho_write_model ----------

# ---- group: Check it / 4
toggle_4 = BooleanToggle(False)

# ----
panel_4 = Panel(morpho_write_model.file_path)

# ---- group: Check it
morpho_run_inx = MorphoRunINX(file_path=morpho_write_model.file_path, run_it=toggle_4)  # inputs run_it: Boolean
# ---------- morpho_run_inx: Python ----------
# Morpho: A plugin to write Envimet 2.5D models.
# This file is part of Morpho project.
#
# Copyright (c) 2020, Antonello Di Nunzio <antonellodinunzio@gmail.com>.
# You should have received a copy of the GNU General Public License
# along with Morpho project; If not, see <http://www.gnu.org/licenses/>.
# 
# @license GPL-3.0+ <http://spdx.org/licenses/GPL-3.0+>

"""
This component open ENVI_MET Spaces to check the model.
    Args:
        _file_path: Full path of the Model (INX).
        _run_it: Set it to 'True' to run simulation.
        
    Returns:
        read_me: Message for users.
"""

ghenv.Component.Name = "Morpho Run INX"
ghenv.Component.NickName = "morpho_run_inx"
ghenv.Component.Category = "Morpho"
ghenv.Component.SubCategory = "5 || Util"
try: ghenv.Component.AdditionalHelpFromDocStrings = "1"
except: pass

import scriptcontext as sc
import os
import sys
import clr
##################Envimet INX####################
try:
    user_path = os.getenv("APPDATA")
    sys.path.append(os.path.join(user_path, "Morpho"))
    clr.AddReferenceToFile("Morpho25.dll")
    from Morpho25.IO import SimulationBatch
    
except ImportError as e:
    raise ImportError("\nFailed to import Morpho: {0}\n\nCheck your 'Morpho' folder in {1}".format(e, os.getenv("APPDATA")))
################################################
ghenv.Component.Message = "1.0.1 2.5D"


def main():
    
    if _file_path and _run_it:
        
        os.startfile(_file_path)
        
        return "OK"
    else:
        return

result = main()
if not result: print("Please, connect INX file address and _run_it to 'True'.")
# ---------- end morpho_run_inx ----------

# ---- group: Simulation settings
panel_5 = Panel("""75
73
72
71
70
66
61
57
50
44
39
38
38
38
42
45
50
52
55
58
63
68
74
77""")
panel_6 = Panel("""22.2
21.7
21.1
20.6
20
21.3
22.6
23.9
25.7
27.6
29.4
30.3
31.3
32.2
31.8
31.5
31.1
30
28.9
27.8
26.3
24.8
23.3
22.9""")
morpho_atmosphere_specific_humidity = MorphoAtmosphereSpecificHumidity(air_temperature=panel_6, relative_humidity=panel_5)  # -> read_me, specific_humidity; inputs air_temperature: list, relative_humidity: list
# ---------- morpho_atmosphere_specific_humidity: Python ----------
# Morpho: A plugin to write Envimet 2.5D models.
# This file is part of Morpho project.
#
# Copyright (c) 2020, Antonello Di Nunzio <antonellodinunzio@gmail.com>.
# You should have received a copy of the GNU General Public License
# along with Morpho project; If not, see <http://www.gnu.org/licenses/>.
# 
# @license GPL-3.0+ <http://spdx.org/licenses/GPL-3.0+>

"""
This component calculate specific humidity of the atmosphere. Specific humidity at 2500 is lower if temperature is lower and higher when temperature is higher.
Old ENVI-Met versions used 7 g/kg as value because is a mean common value compatible with almost all climates.
-
NOTE: It is an important parameter, use it to have accurate results.
-
Thanks to ENVI-Met team for the algorithm.
-
Icons made by <a href="https://icon54.com/" title="Pixel perfect">Pixel perfect</a> from <a href="https://www.flaticon.com/" title="Flaticon"> www.flaticon.com</a>
    Args:
        _air_temperature: List of temperature values to use as boundary condition (°C) [float].
        _relative_humidity: List of relative humidity values to use as boundary condition (°C) [float].
        
    Returns:
        read_me: Message for users.
        specific_humidity: Specific humidity (g Water/kg air) at 2500m that envimet uses during the simulation. Connect it to "Morpho Main Settings".
"""

ghenv.Component.Name = "Morpho Atmosphere Specific Humidity"
ghenv.Component.NickName = "morpho_atmosphere_specific_humidity"
ghenv.Component.Category = "Morpho"
ghenv.Component.SubCategory = "4 || Simulation"
try: ghenv.Component.AdditionalHelpFromDocStrings = "1"
except: pass

import scriptcontext as sc
import os
import sys
import clr
##################Envimet INX####################
from System.Collections.Generic import *
try:
    user_path = os.getenv("APPDATA")
    sys.path.append(os.path.join(user_path, "Morpho"))
    clr.AddReferenceToFile("Morpho25.dll")
    from Morpho25.Utility import EnvimetUtility, Util
    
except ImportError as e:
    raise ImportError("\nFailed to import Morpho: {0}\n\nCheck your 'Morpho' folder in {1}".format(e, os.getenv("APPDATA")))
################################################
ghenv.Component.Message = "1.0.1 2.5D"

def main():
    
    if _air_temperature and _relative_humidity:
        
        air_temperature = List[float](_air_temperature)
        relative_humidity = List[float](_relative_humidity)
        
        specific_humidity = EnvimetUtility.GetAtmosphereSpecificHumidity(air_temperature, relative_humidity)
        
        return specific_humidity
    else:
        return

specific_humidity = main()
if not specific_humidity: print("Please, connect _air_temperature and _relative_humidity.")
# ---------- end morpho_atmosphere_specific_humidity ----------
morpho_building_settings = MorphoBuildingSettings(indoor_temperature="21", constant_temperature=Toggle(False))  # -> read_me, building_settings; inputs constant_temperature: Boolean
# ---------- morpho_building_settings: Python ----------
# Morpho: A plugin to write Envimet 2.5D models.
# This file is part of Morpho project.
#
# Copyright (c) 2020, Antonello Di Nunzio <antonellodinunzio@gmail.com>.
# You should have received a copy of the GNU General Public License
# along with Morpho project; If not, see <http://www.gnu.org/licenses/>.
# 
# @license GPL-3.0+ <http://spdx.org/licenses/GPL-3.0+>

"""
Set indoor building temperature to use for simulation. Unit is °C.
    Args:
        _indoor_temperature: Indoor temperature to apply to buildings (°C) [float].
        _constant_temperature: Set it to 'True' to use constant temperature or 'False' to keep it variable.
        
    Returns:
        read_me: Message for users.
        building_settings: Building settings of *.simx file.
"""

ghenv.Component.Name = "Morpho Building Settings"
ghenv.Component.NickName = "morpho_building_settings"
ghenv.Component.Category = "Morpho"
ghenv.Component.SubCategory = "4 || Simulation"
try: ghenv.Component.AdditionalHelpFromDocStrings = "2"
except: pass

import scriptcontext as sc
import os
import sys
import clr
##################Envimet INX####################
try:
    user_path = os.getenv("APPDATA")
    sys.path.append(os.path.join(user_path, "Morpho"))
    clr.AddReferenceToFile("Morpho25.dll")
    from Morpho25.Settings import BuildingSettings, Active
    
except ImportError as e:
    raise ImportError("\nFailed to import Morpho: {0}\n\nCheck your 'Morpho' folder in {1}".format(e, os.getenv("APPDATA")))
################################################
ghenv.Component.Message = "1.0.1 2.5D"

def main():
    
    if _indoor_temperature:
        
        constant = Active.YES if _constant_temperature else Active.NO
        
        building_settings = BuildingSettings(_indoor_temperature, constant)
        
        return building_settings
    else:
        return

building_settings = main()
if not building_settings: print("Please, connect _indoor_temperature.")
# ---------- end morpho_building_settings ----------
morpho_main_settings = MorphoMainSettings(
    inx_model=morpho_model.inx_model,
    sim_name="Boston_sim",
    start_date="23.06.2018",
    start_time="07:00:00",
    duration="24",
    initial_temperature="22.6",
    specific_humidity=morpho_atmosphere_specific_humidity.specific_humidity,
    relative_humidity="61")  # -> read_me, main_settings; inputs duration: Int32
# ---------- morpho_main_settings: Python ----------
# Morpho: A plugin to write Envimet 2.5D models.
# This file is part of Morpho project.
#
# Copyright (c) 2020, Antonello Di Nunzio <antonellodinunzio@gmail.com>.
# You should have received a copy of the GNU General Public License
# along with Morpho project; If not, see <http://www.gnu.org/licenses/>.
# 
# @license GPL-3.0+ <http://spdx.org/licenses/GPL-3.0+>

"""
Set main part of simulation file.
-
Use this component to set basic properties of the simulation file.
    Args:
        _inx_model: Inx Model.
        _sim_name: Name of simulation file (*.simx).
        _start_date_: It sets when your simulation starts [string]. Format DD.MM.YYYY.
        -
        Default value is 23.06.2018
        _start_time_: It sets at what time your simulation starts [string]. Format HH:MM:SS
        -
        Default value is 06:00:00
        _duration_: Duration of simulation in hours [integer]. Default value is 24.
        wind_speed_: Initial wind speed (m/s) [float]. Default value is 2.5.
        wind_direction_: Initial wind direction (°dec) [float]. Default value is 0.
        roughness_: Roughness [float]. Default value is 0.01.
        initial_temperature_: Initial temperature of the air (°C) [float]. Default value is 19.
        specific_humidity_: Initial specific humidity of the air in 2500 m (g Water/kg air). Default value is 7.0.
        relative_humidity_: Initial relative humidity of the air in 2m (%) [float]. Default value is 50%.
        
    Returns:
        read_me: Message for users.
        main_settings: Basic settings of *.simx file.
"""

ghenv.Component.Name = "Morpho Main Settings"
ghenv.Component.NickName = "morpho_main_settings"
ghenv.Component.Category = "Morpho"
ghenv.Component.SubCategory = "4 || Simulation"
try: ghenv.Component.AdditionalHelpFromDocStrings = "1"
except: pass

import scriptcontext as sc
import os
import sys
import clr
##################Envimet INX####################
try:
    user_path = os.getenv("APPDATA")
    sys.path.append(os.path.join(user_path, "Morpho"))
    clr.AddReferenceToFile("Morpho25.dll")
    from Morpho25.Settings import MainSettings
    
except ImportError as e:
    raise ImportError("\nFailed to import Morpho: {0}\n\nCheck your 'Morpho' folder in {1}".format(e, os.getenv("APPDATA")))
################################################
ghenv.Component.Message = "1.0.1 2.5D"

def main():
    
    if _inx_model and _sim_name:
        
        main_settings = MainSettings(_sim_name, _inx_model)
        if _start_date_: main_settings.StartDate = _start_date_
        if _start_time_: main_settings.StartTime = _start_time_
        if _duration_: main_settings.SimDuration = _duration_
        if wind_speed_: main_settings.WindSpeed = wind_speed_
        if wind_direction_: main_settings.WindDir = wind_direction_
        if roughness_: main_settings.Roughness = roughness_
        if initial_temperature_: main_settings.InitialTemperature = initial_temperature_
        if specific_humidity_: main_settings.SpecificHumidity = specific_humidity_
        if relative_humidity_: main_settings.RelativeHumidity = relative_humidity_
        
        return main_settings
    else:
        return

main_settings = main()
if not main_settings: print("Please, connect _inx_workspace and _sim_name.")
# ---------- end morpho_main_settings ----------
morpho_simple_forcing = MorphoSimpleForcing(air_temperature=panel_6, relative_humidity=panel_5)  # -> read_me, simple_forcing; inputs air_temperature: list, relative_humidity: list
# ---------- morpho_simple_forcing: Python ----------
# Morpho: A plugin to write Envimet 2.5D models.
# This file is part of Morpho project.
#
# Copyright (c) 2020, Antonello Di Nunzio <antonellodinunzio@gmail.com>.
# You should have received a copy of the GNU General Public License
# along with Morpho project; If not, see <http://www.gnu.org/licenses/>.
# 
# @license GPL-3.0+ <http://spdx.org/licenses/GPL-3.0+>

"""
Force boundary condition of air temperature and relative humidity.
-
You need to provide list of value to fit all simulation duration.
    Args:
        _air_temperature: List of temperature values to use as boundary condition (°C) [float].
        _relative_humidity: List of relative humidity values to use as boundary condition (°C) [float].
        
    Returns:
        read_me: Message for users.
        simple_forcing: Simple Forcing settings of *.simx file.
"""

ghenv.Component.Name = "Morpho Simple Forcing"
ghenv.Component.NickName = "morpho_simple_forcing"
ghenv.Component.Category = "Morpho"
ghenv.Component.SubCategory = "4 || Simulation"
try: ghenv.Component.AdditionalHelpFromDocStrings = "1"
except: pass

import scriptcontext as sc
import os
import sys
import clr
##################Envimet INX####################
from System.Collections.Generic import *
try:
    user_path = os.getenv("APPDATA")
    sys.path.append(os.path.join(user_path, "Morpho"))
    clr.AddReferenceToFile("Morpho25.dll")
    from Morpho25.Settings import SimpleForcing
    
except ImportError as e:
    raise ImportError("\nFailed to import Morpho: {0}\n\nCheck your 'Morpho' folder in {1}".format(e, os.getenv("APPDATA")))
################################################
ghenv.Component.Message = "1.0.1 2.5D"

def main():
    
    if _air_temperature and _relative_humidity:
        
        air_temperature = List[float](_air_temperature)
        relative_humidity = List[float](_relative_humidity)
        
        simple_forcing = SimpleForcing(air_temperature, relative_humidity)
        
        return simple_forcing
    else:
        return

simple_forcing = main()
if not simple_forcing: print("Please, connect _air_temperature and _relative_humidity.")
# ---------- end morpho_simple_forcing ----------

# ----
toggle_5 = BooleanToggle(True)
toggle_6 = BooleanToggle(False)
morpho_output_settings = MorphoOutputSettings()  # -> read_me, output_settings; inputs netCDF: Boolean, netCDF_in_one_file: Boolean
# ---------- morpho_output_settings: Python ----------
# Morpho: A plugin to write Envimet models.
# This file is part of Morpho project.
#
# Copyright (c) 2022, Antonello Di Nunzio <antonellodinunzio@gmail.com>.
# You should have received a copy of the GNU General Public License
# along with Morpho project; If not, see <http://www.gnu.org/licenses/>.
# 
# @license AGPL-3.0-or-later <https://spdx.org/licenses/AGPL-3.0-or-later>

"""
Set output interval.
There is also a new functionality, BPS (Building Performance Simulation): integration with EnergyPlus and TRNSYS.
-
EXPERT SETTINGS.
-
REMINDER: BPS is not supported in BASIC and STUDENT version.
    Args:
        _interval_main_file_: Decide in which output interval save output files (e.g. atmoshere) [float]. Default is 60 minutes.
        _interval_receptor_building_: Decide in which output interval save output of receptor and building [float]. Default is 60 minutes.
        _netCDF_: Set it to 'True' if you want to write output in NetCDF format [bool].
        -
        If you have issue with it check you have Microsoft Visual C++ 2010 SP1 Redistributable Package on your machine.
        You can download it for free.
        _netCDF_in_one_file_: Set it to 'True' if you want store output interval in a single NetCDF file [bool]. Default value is for every output inteval (e.g. every virtual hour).
        
    Returns:
        read_me: Message for users.
        output_settings: Output settings of *.simx file.
"""

ghenv.Component.Name = "Morpho Output Settings"
ghenv.Component.NickName = "morpho_output_settings"
ghenv.Component.Category = "Morpho"
ghenv.Component.SubCategory = "4 || Simulation"
try: ghenv.Component.AdditionalHelpFromDocStrings = "2"
except: pass

import Grasshopper.Kernel as gh
import scriptcontext as sc
import os
import sys
import clr
##################Envimet INX####################
from System.Collections.Generic import *
try:
    user_path = os.getenv("APPDATA")
    sys.path.append(os.path.join(user_path, "Morpho"))
    clr.AddReferenceToFile("Morpho25.dll")
    from Morpho25.Settings import OutputSettings, Active
    from Morpho25.Geometry import Building
    
except ImportError as e:
    raise ImportError("\nFailed to import Morpho: {0}\n\nCheck your 'Morpho' folder in {1}".format(e, os.getenv("APPDATA")))
################################################
ghenv.Component.Message = "1.1.1"

def main():
    
    ouput_setting = OutputSettings()
    
    if _netCDF_: ouput_setting.NetCDF = int(Active.YES)
    if _netCDF_in_one_file_: ouput_setting.NetCDFAllDataInOneFile = int(Active.YES)
    if _interval_main_file_: ouput_setting.MainFiles = _interval_main_file_
    if _interval_receptor_building_: ouput_setting.TextFiles = _interval_receptor_building_
    
    return ouput_setting

output_settings = main()
# ---------- end morpho_output_settings ----------
morpho_soilsettings = MorphoSoilSettings()  # -> read_me, soil_settings
# ---------- morpho_soilsettings: Python ----------
# Morpho: A plugin to write Envimet models.
# This file is part of Morpho project.
#
# Copyright (c) 2022, Antonello Di Nunzio <antonellodinunzio@gmail.com>.
# You should have received a copy of the GNU General Public License
# along with Morpho project; If not, see <http://www.gnu.org/licenses/>.
# 
# @license AGPL-3.0-or-later <https://spdx.org/licenses/AGPL-3.0-or-later>

"""
Set boundary condition of soil at different layers.
    Args:
        _temperature_upper_layer_: Initial Temperature Upper Layer (0-20 cm) [°C]. Defualt vale is 19.85 °C.
        _temperature_middle_layer_: Initial Temperature Middle Layer (20-50 cm) [°C]. Defualt vale is 19.85 °C.
        _temperature_deep_layer_: Initial Temperature Deep Layer (below 50-200 cm) [°C]. Defualt vale is 19.85 °C.
        _temperature_bedrock_layer_: Initial Temperature Bedrock Layer (200 cm) [°C]. Defualt vale is 19.85 °C.
        _rh_upper_layer_: Relative Humidity Upper Layer (0-20 cm). Default value is 50.00%.
        _rh_middle_layer_: Relative Humidity Middle Layer (20-50 cm). Default value is 60.00%.
        _rh_deep_layer: Relative Humidity Deep Layer (50-200 cm). Default value is 60.00%.
        _rh_bedrock_layer_: Relative Humidity Bedrock (below 200 cm). Default value is 60.00%.
        
    Returns:
        read_me: Message for users.
        soil_settings: Soil boundary condition of *.simx file.
"""

ghenv.Component.Name = "Morpho SoilSettings"
ghenv.Component.NickName = "morpho_soilsettings"
ghenv.Component.Category = "Morpho"
ghenv.Component.SubCategory = "4 || Simulation"
try: ghenv.Component.AdditionalHelpFromDocStrings = "2"
except: pass

import scriptcontext as sc
import os
import sys
import clr
##################Envimet INX####################
try:
    user_path = os.getenv("APPDATA")
    sys.path.append(os.path.join(user_path, "Morpho"))
    clr.AddReferenceToFile("Morpho25.dll")
    from Morpho25.Settings import SoilSettings
    
except ImportError as e:
    raise ImportError("\nFailed to import Morpho: {0}\n\nCheck your 'Morpho' folder in {1}".format(e, os.getenv("APPDATA")))
################################################
ghenv.Component.Message = "1.1.0"

def main():
    
    soil = SoilSettings()
    
    if _temperature_upper_layer_: soil.TempUpperlayer = _temperature_upper_layer_
    if _temperature_middle_layer_: soil.TempMiddlelayer = _temperature_middle_layer_
    if _temperature_deep_layer_: soil.TempDeeplayer = _temperature_deep_layer_
    if _temperature_bedrock_layer_: soil.TempBedrockLayer = _temperature_bedrock_layer_
    if _rh_upper_layer_: soil.WaterUpperlayer = _rh_upper_layer_
    if _rh_middle_layer_: soil.WaterMiddlelayer = _rh_middle_layer_
    if _rh_deep_layer: soil.WaterDeeplayer = _rh_deep_layer
    if _rh_bedrock_layer_: soil.WaterBedrockLayer = _rh_bedrock_layer_
    
    return soil

soil_settings = main()
# ---------- end morpho_soilsettings ----------
morpho_tree_settings = MorphoTreeSettings(CO2="200", leaf_transmittance=toggle_6, tree_calendar=toggle_6)  # -> read_me, plant_settings; inputs leaf_transmittance: Boolean, tree_calendar: Boolean
# ---------- morpho_tree_settings: Python ----------
# Morpho: A plugin to write Envimet models.
# This file is part of Morpho project.
#
# Copyright (c) 2022, Antonello Di Nunzio <antonellodinunzio@gmail.com>.
# You should have received a copy of the GNU General Public License
# along with Morpho project; If not, see <http://www.gnu.org/licenses/>.
# 
# @license AGPL-3.0-or-later <https://spdx.org/licenses/AGPL-3.0-or-later>

"""
Set plant settings such as tree calendar and CO2.
-
EXPERT SETTINGS.
    Args:
        _CO2: CO2 background level (ppm).
        -
        The default value of the CO2 background concentration is set to 400 ppm without this settings.
        _leaf_transmittance: Set it to 'True' to use old calculation model. 'False' to use user defined value.
        _tree_calendar: Set it to 'True' to use tree calendar, 'False' to disable tree calendar.
        -
        Tree calendar = foliage of your tree will be calculated depending on the month your simulation is set and the hemisphere where location is.
        
    Returns:
        read_me: Message for users.
        plant_settings: Plant calculation model to use in *.simx file.
"""

ghenv.Component.Name = "Morpho Tree Settings"
ghenv.Component.NickName = "morpho_tree_settings"
ghenv.Component.Category = "Morpho"
ghenv.Component.SubCategory = "4 || Simulation"
try: ghenv.Component.AdditionalHelpFromDocStrings = "2"
except: pass


import scriptcontext as sc
import os
import sys
import clr
##################Envimet INX####################
try:
    user_path = os.getenv("APPDATA")
    sys.path.append(os.path.join(user_path, "Morpho"))
    clr.AddReferenceToFile("Morpho25.dll")
    from Morpho25.Settings import Active, PlantSetting
    
except ImportError as e:
    raise ImportError("\nFailed to import Morpho: {0}\n\nCheck your 'Morpho' folder in {1}".format(e, os.getenv("APPDATA")))
################################################
ghenv.Component.Message = "1.1.0"

def main():
    
    if _CO2 > 0 and _leaf_transmittance != None and _tree_calendar != None:
        
        transmittance = Active.YES if _leaf_transmittance else Active.NO
        calendar = Active.YES if _tree_calendar else Active.NO
        
        plant_settings = PlantSetting(transmittance, calendar, _CO2)
        
        return plant_settings
    else:
        return

plant_settings = main()
if not plant_settings: print("Please, connect _CO2, _leaf_transmittance, _tree_calendar.")
# ---------- end morpho_tree_settings ----------
morpho_pollutant_concentration = MorphoPollutantConcentration()  # -> read_me, pollutant_concentration
# ---------- morpho_pollutant_concentration: Python ----------
# Morpho: A plugin to write Envimet models.
# This file is part of Morpho project.
#
# Copyright (c) 2022, Antonello Di Nunzio <antonellodinunzio@gmail.com>.
# You should have received a copy of the GNU General Public License
# along with Morpho project; If not, see <http://www.gnu.org/licenses/>.
# 
# @license AGPL-3.0-or-later <https://spdx.org/licenses/AGPL-3.0-or-later>

"""
Set the pollutant concentration. 
Similar to the CO2 background concentration in the atmosphere (400 ppm), there might be a specific pollutant background concentration for your simulated area.
-
EXPERT SETTINGS.
    Args:
        _NO_: NO concentration in ppm [float].
        _NO2_: NO2 concentration in ppm [float].
        _ozone_: Ozone concentration in ppm [float].
        _PM10_: PM 10 concentration in ppm [float].
        _PM25_: PM 2.5 concentration in ppm [float].
        _user_pollutant_: User defined pollutant concentration in ppm [float].
        
    Returns:
        read_me: Message for users.
        pollutant_concentration: Pollutant concentration settings of *.simx file.
"""

ghenv.Component.Name = "Morpho Pollutant Concentration"
ghenv.Component.NickName = "morpho_pollutant_concentration"
ghenv.Component.Category = "Morpho"
ghenv.Component.SubCategory = "4 || Simulation"
try: ghenv.Component.AdditionalHelpFromDocStrings = "2"
except: pass

import scriptcontext as sc
import os
import sys
import clr
##################Envimet INX####################
try:
    user_path = os.getenv("APPDATA")
    sys.path.append(os.path.join(user_path, "Morpho"))
    clr.AddReferenceToFile("Morpho25.dll")
    from Morpho25.Settings import Background
    
except ImportError as e:
    raise ImportError("\nFailed to import Morpho: {0}\n\nCheck your 'Morpho' folder in {1}".format(e, os.getenv("APPDATA")))
################################################
ghenv.Component.Message = "1.1.0"

def main():
    
    pollutant_concentration = Background()
    
    if _user_pollutant_: pollutant_concentration.UserSpec = _user_pollutant_
    if _NO_: pollutant_concentration.No = _NO_
    if _NO2_: pollutant_concentration.No2 = _NO2_
    if _ozone_: pollutant_concentration.O3 = _ozone_
    if _PM10_: pollutant_concentration.Pm10 = _PM10_
    if _PM25_: pollutant_concentration.Pm25 = _PM25_
    
    return pollutant_concentration

pollutant_concentration = main()
# ---------- end morpho_pollutant_concentration ----------
morpho_timing = MorphoTiming()  # -> read_me, model_timing
# ---------- morpho_timing: Python ----------
# Morpho: A plugin to write Envimet models.
# This file is part of Morpho project.
#
# Copyright (c) 2022, Antonello Di Nunzio <antonellodinunzio@gmail.com>.
# You should have received a copy of the GNU General Public License
# along with Morpho project; If not, see <http://www.gnu.org/licenses/>.
# 
# @license AGPL-3.0-or-later <https://spdx.org/licenses/AGPL-3.0-or-later>

"""
Force timing conditions of envimet objects.
-
EXPERT SETTINGS.
    Args:
        _surface_step_: Update Surface Data each ? sec. [float] Default value is 30.00 seconds.
        _flow_step_: Update Wind field each ? sec. [float] Default value is 900.00 seconds.
        _radiation_step_: Update Radiation and Shadows each ? sec. [float] Default value is 600.00 seconds.
        _plant_step_: Update Plant Data each ? sec. [float] Default value is 600.00 seconds.
        _source_step_: Update Emmission Data each ? sec. [float] Default value is 600.00 seconds.
        
    Returns:
        read_me: Message for users.
        model_timing: Update timing settings of *.simx file.
"""

ghenv.Component.Name = "Morpho Timing"
ghenv.Component.NickName = "morpho_timing"
ghenv.Component.Category = "Morpho"
ghenv.Component.SubCategory = "4 || Simulation"
try: ghenv.Component.AdditionalHelpFromDocStrings = "2"
except: pass

import scriptcontext as sc
import os
import sys
import clr
##################Envimet INX####################
try:
    user_path = os.getenv("APPDATA")
    sys.path.append(os.path.join(user_path, "Morpho"))
    clr.AddReferenceToFile("Morpho25.dll")
    from Morpho25.Settings import ModelTiming
    
except ImportError as e:
    raise ImportError("\nFailed to import Morpho: {0}\n\nCheck your 'Morpho' folder in {1}".format(e, os.getenv("APPDATA")))
################################################
ghenv.Component.Message = "1.1.0"

def main():
    
    model_timing = ModelTiming()
    
    if _surface_step_: model_timing.SurfaceSteps = _surface_step_
    if _flow_step_: model_timing.FlowSteps = _flow_step_
    if _radiation_step_: model_timing.RadiationSteps = _radiation_step_
    if _plant_step_: model_timing.PlantSteps = _plant_step_
    if _source_step_: model_timing.SourcesSteps = _source_step_
    
    return model_timing

model_timing = main()
# ---------- end morpho_timing ----------
morpho_pollutant = MorphoPollutant(pollutant_name="pippo", pollutant_type="0")  # -> read_me, source_settings; inputs pollutant_type: Int32, multiple_sources: Boolean, active_chemistry: Boolean
# ---------- morpho_pollutant: Python ----------
# Morpho: A plugin to write Envimet models.
# This file is part of Morpho project.
#
# Copyright (c) 2022, Antonello Di Nunzio <antonellodinunzio@gmail.com>.
# You should have received a copy of the GNU General Public License
# along with Morpho project; If not, see <http://www.gnu.org/licenses/>.
# 
# @license AGPL-3.0-or-later <https://spdx.org/licenses/AGPL-3.0-or-later>

"""
Set pollutant.
-
EXPERT SETTINGS.
    Args:
        _pollutant_name: Name of pollutant source [string].
        _pollutant_type: Connect an integer to set pollutant type
        0 = PM
        1 = CO
        2 = CO2
        3 = NO
        4 = NO2
        5 = SO2
        6 = NH3
        7 = H2O2
        8 = SPRAY
        _multiple_sources_: Set it to 'True' to set multi pollutant. [bool] Default value is single pollutant.
        -
        The pollutant emission rates are taken from the emission profiles defined in the Database Manager.
        In Single pollutant mode, only the user-defined pollutant is used.
        _active_chemistry_:  Set it to 'True' to set dispersion and active chemistry. [bool] Default value is dispersion only.
        _diameter_: Particle diameter (μm) [float]. Default is 10.00.
        -
        Define it if you select SPRAY or PM.
        _density_:  Particle density (g/cm3) [float]. Default is 1.00.
        -
        Define it if you select SPRAY or PM.
        
    Returns:
        read_me: Message for users.
        source_settings: Source settings of *.simx file.
"""

ghenv.Component.Name = "Morpho Pollutant"
ghenv.Component.NickName = "morpho_pollutant"
ghenv.Component.Category = "Morpho"
ghenv.Component.SubCategory = "4 || Simulation"
try: ghenv.Component.AdditionalHelpFromDocStrings = "2"
except: pass

import scriptcontext as sc
import os
import sys
import clr
##################Envimet INX####################
try:
    user_path = os.getenv("APPDATA")
    sys.path.append(os.path.join(user_path, "Morpho"))
    clr.AddReferenceToFile("Morpho25.dll")
    from Morpho25.Settings import Pollutant, Sources, Active
    
except ImportError as e:
    raise ImportError("\nFailed to import Morpho: {0}\n\nCheck your 'Morpho' folder in {1}".format(e, os.getenv("APPDATA")))
################################################
ghenv.Component.Message = "1.1.0"

def main():
    
    pollutant = {
        0:Pollutant.PM,
        1:Pollutant.CO,
        2:Pollutant.CO2,
        3:Pollutant.NO,
        4:Pollutant.NO2,
        5:Pollutant.SO2,
        6:Pollutant.NH3,
        7:Pollutant.H2O2,
        8:Pollutant.SPRAY
    }
    
    if _pollutant_name and _pollutant_type >= 0:
        
        multiple = Active.YES if _multiple_sources_ else Active.NO
        chemistry = Active.YES if _active_chemistry_ else Active.NO
        
        source = Sources(_pollutant_name, pollutant[_pollutant_type], multiple, chemistry)
        
        if _diameter_: source.UserPartDiameter = _diameter_
        if _density_: source.UserPartDensity = _density_
        
        return source
    else:
        return

source_settings = main()
if not source_settings: print("Please, connect _pollutant_name and _pollutant_type.")
# ---------- end morpho_pollutant ----------
morpho_wind_resistance = MorphoWindResistance(model_type="0")  # -> read_me, wind_resistance; inputs model_type: Int32
# ---------- morpho_wind_resistance: Python ----------
# Morpho: A plugin to write Envimet models.
# This file is part of Morpho project.
#
# Copyright (c) 2022, Antonello Di Nunzio <antonellodinunzio@gmail.com>.
# You should have received a copy of the GNU General Public License
# along with Morpho project; If not, see <http://www.gnu.org/licenses/>.
# 
# @license AGPL-3.0-or-later <https://spdx.org/licenses/AGPL-3.0-or-later>

"""
Set wind resistance model at facede.
DIN 6946 includes a higher Z0 value.
-
EXPERT SETTINGS.
    Args:
        _model_type: Connect an integer to select wind resistance model.
        0 = MO
        1 = DIN6946
        
    Returns:
        read_me: Message for users.
        wind_resistance: Wind resistance model to use in *.simx file.
"""

ghenv.Component.Name = "Morpho Wind Resistance"
ghenv.Component.NickName = "morpho_wind_resistance"
ghenv.Component.Category = "Morpho"
ghenv.Component.SubCategory = "4 || Simulation"
try: ghenv.Component.AdditionalHelpFromDocStrings = "2"
except: pass


import scriptcontext as sc
import os
import sys
import clr
##################Envimet INX####################
try:
    user_path = os.getenv("APPDATA")
    sys.path.append(os.path.join(user_path, "Morpho"))
    clr.AddReferenceToFile("Morpho25.dll")
    from Morpho25.Settings import FacadeMod, Facades
    
except ImportError as e:
    raise ImportError("\nFailed to import Morpho: {0}\n\nCheck your 'Morpho' folder in {1}".format(e, os.getenv("APPDATA")))
################################################
ghenv.Component.Message = "1.1.0"

def main():
    
    model = {
        0:FacadeMod.MO,
        1:FacadeMod.DIN6946
    }
    
    if _model_type >= 0:
        
        turbolence = Facades(model[_model_type])
        
        return turbolence
    else:
        return

wind_resistance = main()
if not wind_resistance: print("Please, connect _model_type.")
# ---------- end morpho_wind_resistance ----------
morpho_turbolence = MorphoTurbolence(model_type="0")  # -> read_me, turbolence; inputs model_type: Int32
# ---------- morpho_turbolence: Python ----------
# Morpho: A plugin to write Envimet models.
# This file is part of Morpho project.
#
# Copyright (c) 2022, Antonello Di Nunzio <antonellodinunzio@gmail.com>.
# You should have received a copy of the GNU General Public License
# along with Morpho project; If not, see <http://www.gnu.org/licenses/>.
# 
# @license AGPL-3.0-or-later <https://spdx.org/licenses/AGPL-3.0-or-later>

"""
Set Turbolence model.
-
EXPERT SETTINGS.
-
Icon made by Freepik <https://www.flaticon.com/authors/freepik>.
See license for more details.
    Args:
        _model_type: Connect an integer to select turbolence model.
        0 = MellorAndYamada
        1 = KatoAndLaunder
        2 = Lopez
        3 = Bruse ENVI_MET
        
    Returns:
        read_me: Message for users.
        turbolence: Turbolence model to use in *.simx file.
"""

ghenv.Component.Name = "Morpho Turbolence"
ghenv.Component.NickName = "morpho_turbolence"
ghenv.Component.Category = "Morpho"
ghenv.Component.SubCategory = "4 || Simulation"
try: ghenv.Component.AdditionalHelpFromDocStrings = "2"
except: pass


import scriptcontext as sc
import os
import sys
import clr
##################Envimet INX####################
try:
    user_path = os.getenv("APPDATA")
    sys.path.append(os.path.join(user_path, "Morpho"))
    clr.AddReferenceToFile("Morpho25.dll")
    from Morpho25.Settings import Turbulence, TurbolenceType
    
except ImportError as e:
    raise ImportError("\nFailed to import Morpho: {0}\n\nCheck your 'Morpho' folder in {1}".format(e, os.getenv("APPDATA")))
################################################
ghenv.Component.Message = "1.1.0"

def main():
    
    model = {
        0:TurbolenceType.MellorAndYamada,
        1:TurbolenceType.KatoAndLaunder,
        2:TurbolenceType.Lopez,
        3:TurbolenceType.Bruse
    }
    
    if _model_type >= 0:
        
        turbolence = Turbulence(model[_model_type])
        
        return turbolence
    else:
        return

turbolence = main()
if not turbolence: print("Please, connect _model_type.")
# ---------- end morpho_turbolence ----------
morpho_lbc = MorphoLBC(LBC_temperature_humidity="0", LBC_turbolence="0")  # -> read_me, LBC; inputs LBC_temperature_humidity: Int32, LBC_turbolence: Int32
# ---------- morpho_lbc: Python ----------
# Morpho: A plugin to write Envimet models.
# This file is part of Morpho project.
#
# Copyright (c) 2022, Antonello Di Nunzio <antonellodinunzio@gmail.com>.
# You should have received a copy of the GNU General Public License
# along with Morpho project; If not, see <http://www.gnu.org/licenses/>.
# 
# @license AGPL-3.0-or-later <https://spdx.org/licenses/AGPL-3.0-or-later>

"""
Set lateral boundary condition.
-
'Forced' is used when simpleforcing is activate.
'Open' copy the values of the next grid point close to the border back to the border each timestep which mean overstimate the influence of environment near border.
'Cyclic' describes the process of copying values of the downstream boarder to the upstream boarder.
-
EXPERT SETTINGS.
    Args:
        _LBC_temperature_humidity: Connect an integer to select LBC model.
        0 = Open
        1 = Forced
        2 = Cyclic
        _LBC_turbolence: Connect an integer to select LBC model.
        0 = Open
        1 = Forced
        2 = Cyclic
        
    Returns:
        read_me: Message for users.
        LBC: Lateral boundary condition to use in *.simx file.
"""

ghenv.Component.Name = "Morpho LBC"
ghenv.Component.NickName = "morpho_LBC"
ghenv.Component.Category = "Morpho"
ghenv.Component.SubCategory = "4 || Simulation"
try: ghenv.Component.AdditionalHelpFromDocStrings = "2"
except: pass


import scriptcontext as sc
import os
import sys
import clr
##################Envimet INX####################
try:
    user_path = os.getenv("APPDATA")
    sys.path.append(os.path.join(user_path, "Morpho"))
    clr.AddReferenceToFile("Morpho25.dll")
    from Morpho25.Settings import LBC, BoundaryCondition
    
except ImportError as e:
    raise ImportError("\nFailed to import Morpho: {0}\n\nCheck your 'Morpho' folder in {1}".format(e, os.getenv("APPDATA")))
################################################
ghenv.Component.Message = "1.1.0"

def main():
    
    model = {
        0:BoundaryCondition.Open,
        1:BoundaryCondition.Forced,
        2:BoundaryCondition.Cyclic
    }
    
    if _LBC_temperature_humidity >= 0 and _LBC_turbolence >= 0:
        
        lbc = LBC(model[_LBC_temperature_humidity], model[_LBC_turbolence])
        
        return lbc
    else:
        return

LBC = main()
if not LBC: print("Please, connect _LBC_temperature_humidity and _LBC_turbolence.")
# ---------- end morpho_lbc ----------
morpho_timestep = MorphoTimestep()  # -> read_me, timestep
# ---------- morpho_timestep: Python ----------
# Morpho: A plugin to write Envimet models.
# This file is part of Morpho project.
#
# Copyright (c) 2022, Antonello Di Nunzio <antonellodinunzio@gmail.com>.
# You should have received a copy of the GNU General Public License
# along with Morpho project; If not, see <http://www.gnu.org/licenses/>.
# 
# @license AGPL-3.0-or-later <https://spdx.org/licenses/AGPL-3.0-or-later>

"""
Force timestep conditions.
-
EXPERT SETTINGS. If you exceed with it results could be inaccurate.
    Args:
        _sun_height_step01: Sun height for switching dt(0) [float]. Defualt vale is 40.00 deg.
        -
        meaning = From 0 deg to 40.00 deg the time step of sun will be _timeStepInterval1_.
        _sun_height_step02: Sun height for switching dt(1) [float]. Defualt vale is 50.00 deg.
        -
        meaning = From 40.00 deg to 50.00 deg the time step of sun will be _timeStepInterval2_.
        _dt_step00: Time step (s) for interval 1 dt(0) [float]. Default value is 2 seconds.
        _dt_step01: Time step (s) for interval 1 dt(0) [float]. Default value is 2 seconds.
        _dt_step02: Time step (s) for interval 1 dt(0) [float]. Default value is 1 seconds.
        -
        You have much more radiation when the sun is high in the sky, for this reason ENVI_MET apply timestep 1 s when elevation degree is greater than 50.00 deg.
        
    Returns:
        read_me: Message for users.
        timestep: Timestep settings of *.simx file.
"""

ghenv.Component.Name = "Morpho Timestep"
ghenv.Component.NickName = "morpho_timestep"
ghenv.Component.Category = "Morpho"
ghenv.Component.SubCategory = "4 || Simulation"
try: ghenv.Component.AdditionalHelpFromDocStrings = "2"
except: pass

import scriptcontext as sc
import os
import sys
import clr
##################Envimet INX####################
from System.Collections.Generic import *
try:
    user_path = os.getenv("APPDATA")
    sys.path.append(os.path.join(user_path, "Morpho"))
    clr.AddReferenceToFile("Morpho25.dll")
    from Morpho25.Settings import TimeSteps
    
except ImportError as e:
    raise ImportError("\nFailed to import Morpho: {0}\n\nCheck your 'Morpho' folder in {1}".format(e, os.getenv("APPDATA")))
################################################
ghenv.Component.Message = "1.1.0"

def main():
    
    timestep = TimeSteps()
    
    if _sun_height_step01_: timestep.SunheightStep01 = _sun_height_step01_
    if _sun_height_step02_: timestep.SunheightStep02 = _sun_height_step02_
    if _dt_step00_: timestep.DtStep00 = _dt_step00_
    if _dt_step01_: timestep.DtStep01 = _dt_step01_
    if _dt_step02_: timestep.DtStep02 = _dt_step02_
    
    return timestep

timestep = main()
# ---------- end morpho_timestep ----------
morpho_clouds = MorphoClouds()  # -> read_me, clouds
# ---------- morpho_clouds: Python ----------
# Morpho: A plugin to write Envimet models.
# This file is part of Morpho project.
#
# Copyright (c) 2022, Antonello Di Nunzio <antonellodinunzio@gmail.com>.
# You should have received a copy of the GNU General Public License
# along with Morpho project; If not, see <http://www.gnu.org/licenses/>.
# 
# @license AGPL-3.0-or-later <https://spdx.org/licenses/AGPL-3.0-or-later>

"""
Add cloud to your model. The default setting is with no clouds.
-
EXPERT SETTINGS.
-
Icon made by Good Ware <https://www.flaticon.com/free-icon/sun_861076?term=cloud&page=1&position=48>.
See license for more details.
    Args:
        _low_clouds_: Fraction of LOW clouds (x/8). Default value is 0 (no clouds).
        _middle_clouds_: Fraction of MIDDLE clouds (x/8). Default value is 0 (no clouds).
        _high_clouds_: Fraction of HIGH clouds (x/8). Default value is 0 (no clouds).
        
    Returns:
        read_me: Message for users.
        clouds: Cloud settings of *.simx file.
"""

ghenv.Component.Name = "Morpho Clouds"
ghenv.Component.NickName = "morpho_clouds"
ghenv.Component.Category = "Morpho"
ghenv.Component.SubCategory = "4 || Simulation"
try: ghenv.Component.AdditionalHelpFromDocStrings = "2"
except: pass

import scriptcontext as sc
import os
import sys
import clr
##################Envimet INX####################
try:
    user_path = os.getenv("APPDATA")
    sys.path.append(os.path.join(user_path, "Morpho"))
    clr.AddReferenceToFile("Morpho25.dll")
    from Morpho25.Settings import Cloud
    
except ImportError as e:
    raise ImportError("\nFailed to import Morpho: {0}\n\nCheck your 'Morpho' folder in {1}".format(e, os.getenv("APPDATA")))
################################################
ghenv.Component.Message = "1.1.0"

def main():
    
    clouds = Cloud()
    
    if _low_clouds_: clouds.LowClouds = _low_clouds_
    if _middle_clouds_: clouds.MiddleClouds = _middle_clouds_
    if _high_clouds_: clouds.HighClouds = _high_clouds_
    
    return clouds

clouds = main()
# ---------- end morpho_clouds ----------
morpho_ivs = MorphoIVS(IVS_on=toggle_5, IVS_memory=toggle_5)  # -> read_me, IVS; inputs IVS_on: Boolean, IVS_memory: Boolean
# ---------- morpho_ivs: Python ----------
# Morpho: A plugin to write Envimet models.
# This file is part of Morpho project.
#
# Copyright (c) 2022, Antonello Di Nunzio <antonellodinunzio@gmail.com>.
# You should have received a copy of the GNU General Public License
# along with Morpho project; If not, see <http://www.gnu.org/licenses/>.
# 
# @license AGPL-3.0-or-later <https://spdx.org/licenses/AGPL-3.0-or-later>

"""
Advance radiation transfer schema to use.
IVS allows a detailed analysis and calculation of shortwave and longwave radiation fluxes with taking into account multiple interactions between surfaces.
-
EXPERT SETTINGS.
-
REMINDER: It is not supported in BASIC version.
-
Icon made by Freepik <https://www.flaticon.com/authors/freepik>.
See license for more details.
    Args:
        _IVS_on: Use Index View Sphere (IVS) for radiation transfer [bool].
        _IVS_memory: Do you want to store the values in the memory? [bool]
        -
        Storing the IVS values of every grid cell in your computer memory makes the simulation faster, but it require higher RAM demand.
    Returns:
        read_me: Message for users.
        IVS: IVS settings of *.simx file.
"""

ghenv.Component.Name = "Morpho IVS"
ghenv.Component.NickName = "morpho_ivs"
ghenv.Component.Category = "Morpho"
ghenv.Component.SubCategory = "4 || Simulation"
try: ghenv.Component.AdditionalHelpFromDocStrings = "2"
except: pass

import scriptcontext as sc
import os
import sys
import clr
##################Envimet INX####################
try:
    user_path = os.getenv("APPDATA")
    sys.path.append(os.path.join(user_path, "Morpho"))
    clr.AddReferenceToFile("Morpho25.dll")
    from Morpho25.Settings import IVS, Active
    
except ImportError as e:
    raise ImportError("\nFailed to import Morpho: {0}\n\nCheck your 'Morpho' folder in {1}".format(e, os.getenv("APPDATA")))
################################################
ghenv.Component.Message = "1.1.0"

def main():
    
    if _IVS_on:
        
        ivs = Active.YES if _IVS_on else Active.NO
        ivs_memory = Active.YES if _IVS_memory else Active.NO
        
        ivs_setting = IVS(ivs, ivs_memory)
        
        return ivs_setting
    else:
        return

IVS = main()
if not IVS: print("Please, connect _IVS_on.")
# ---------- end morpho_ivs ----------
morpho_solaradjust = MorphoSolarAdjust(sw_factor="0.5")  # -> read_me, solar_adjust
# ---------- morpho_solaradjust: Python ----------
# Morpho: A plugin to write Envimet models.
# This file is part of Morpho project.
#
# Copyright (c) 2022, Antonello Di Nunzio <antonellodinunzio@gmail.com>.
# You should have received a copy of the GNU General Public License
# along with Morpho project; If not, see <http://www.gnu.org/licenses/>.
# 
# @license AGPL-3.0-or-later <https://spdx.org/licenses/AGPL-3.0-or-later>

"""
Set sw factor.
Modify the irradiation of mode area (W) by increasing or decreasing the solar adjustment factor.
If you use FullForcing do not use this settings.
-
EXPERT SETTINGS.
-
Icon made by Freepik <https://www.flaticon.com/authors/freepik>.
See license for more details.
    Args:
        _sw_factor: Solar adjustment factor to apply. Connect a float in range (0.5, 1.50) [float].
        
    Returns:
        read_me: Message for users.
        solar_adjust: Solar adjust settings of *.simx file.
"""

ghenv.Component.Name = "Morpho SolarAdjust"
ghenv.Component.NickName = "morpho_solarAdjust"
ghenv.Component.Category = "Morpho"
ghenv.Component.SubCategory = "4 || Simulation"
try: ghenv.Component.AdditionalHelpFromDocStrings = "2"
except: pass

import scriptcontext as sc
import os
import sys
import clr
##################Envimet INX####################
try:
    user_path = os.getenv("APPDATA")
    sys.path.append(os.path.join(user_path, "Morpho"))
    clr.AddReferenceToFile("Morpho25.dll")
    from Morpho25.Settings import SolarAdjust
    
except ImportError as e:
    raise ImportError("\nFailed to import Morpho: {0}\n\nCheck your 'Morpho' folder in {1}".format(e, os.getenv("APPDATA")))
################################################
ghenv.Component.Message = "1.1.0"

def main():
    
    if _sw_factor:
        
        solar_adjust = SolarAdjust(_sw_factor)
        
        return solar_adjust
    else:
        return

solar_adjust = main()
if not solar_adjust: print("Please, connect _sw_factor.")
# ---------- end morpho_solaradjust ----------
morpho_parallel_calculation = MorphoParallelCalculation(active=toggle_5)  # -> read_me, parallel_cpu; inputs active: Boolean
# ---------- morpho_parallel_calculation: Python ----------
# Morpho: A plugin to write Envimet models.
# This file is part of Morpho project.
#
# Copyright (c) 2022, Antonello Di Nunzio <antonellodinunzio@gmail.com>.
# You should have received a copy of the GNU General Public License
# along with Morpho project; If not, see <http://www.gnu.org/licenses/>.
# 
# @license AGPL-3.0-or-later <https://spdx.org/licenses/AGPL-3.0-or-later>

"""
Set parallel calculation with your CPU.
-
EXPERT SETTINGS.
-
Icon made by Freepik <https://www.flaticon.com/authors/freepik>.
See license for more details.
    Args:
        _active: Run parallel calculation [bool].
        
    Returns:
        read_me: Message for users.
        parallel_cpu: Parallel calculation settings of *.simx file.
"""

ghenv.Component.Name = "Morpho Parallel Calculation"
ghenv.Component.NickName = "morpho_parallel_calculation"
ghenv.Component.Category = "Morpho"
ghenv.Component.SubCategory = "4 || Simulation"
try: ghenv.Component.AdditionalHelpFromDocStrings = "2"
except: pass

import scriptcontext as sc
import os
import sys
import clr
##################Envimet INX####################
try:
    user_path = os.getenv("APPDATA")
    sys.path.append(os.path.join(user_path, "Morpho"))
    clr.AddReferenceToFile("Morpho25.dll")
    from Morpho25.Settings import ParallelCPU
    
except ImportError as e:
    raise ImportError("\nFailed to import Morpho: {0}\n\nCheck your 'Morpho' folder in {1}".format(e, os.getenv("APPDATA")))
################################################
ghenv.Component.Message = "1.1.0"

def main():
    
    if _active:
        
        parallel = ParallelCPU()
        
        return parallel
    else:
        return

parallel_cpu = main()
if not parallel_cpu: print("Please, connect _active.")
# ---------- end morpho_parallel_calculation ----------
morpho_avg_inflow = MorphoAveragedInflow(active=toggle_5)  # -> read_me, avg_inflow; inputs active: Boolean
#   port avg_inflow: Parallel calculation settings of *.simx file.
# ---------- morpho_avg_inflow: Python ----------
# Morpho: A plugin to write Envimet models.
# This file is part of Morpho project.
#
# Copyright (c) 2022, Antonello Di Nunzio <antonellodinunzio@gmail.com>.
# You should have received a copy of the GNU General Public License
# along with Morpho project; If not, see <http://www.gnu.org/licenses/>.
# 
# @license AGPL-3.0-or-later <https://spdx.org/licenses/AGPL-3.0-or-later>

"""
Active averaged inflow, the air temperature change will be calculated with the average inflow values instead of avg values of each grid cell.
-
EXPERT SETTINGS.
-
Icon made by Freepik <https://www.flaticon.com/authors/freepik>.
See license for more details.
    Args:
        _active: Set active to 'True' for avg inflow [bool].
        
    Returns:
        read_me: Message for users.
        parallel_cpu: Avg inflow calculation settings of *.simx file.
"""

ghenv.Component.Name = "Morpho Averaged Inflow"
ghenv.Component.NickName = "morpho_avg_inflow"
ghenv.Component.Category = "Morpho"
ghenv.Component.SubCategory = "4 || Simulation"
try: ghenv.Component.AdditionalHelpFromDocStrings = "2"
except: pass

import scriptcontext as sc
import os
import sys
import clr
##################Envimet INX####################
try:
    user_path = os.getenv("APPDATA")
    sys.path.append(os.path.join(user_path, "Morpho"))
    clr.AddReferenceToFile("Morpho25.dll")
    from Morpho25.Settings import InflowAvg, Active
    
except ImportError as e:
    raise ImportError("\nFailed to import Morpho: {0}\n\nCheck your 'Morpho' folder in {1}".format(e, os.getenv("APPDATA")))
################################################
ghenv.Component.Message = "1.1.0"

def main():
    
    if _active:
        
        avg_inflow = InflowAvg(Active.YES)
        
        return avg_inflow
    else:
        return

avg_inflow = main()
if not avg_inflow: print("Please, connect _active.")
# ---------- end morpho_avg_inflow ----------
morpho_thread = MorphoThread(active=toggle_5)  # -> read_me, t_thread; inputs active: Boolean
# ---------- morpho_thread: Python ----------
# Morpho: A plugin to write Envimet models.
# This file is part of Morpho project.
#
# Copyright (c) 2022, Antonello Di Nunzio <antonellodinunzio@gmail.com>.
# You should have received a copy of the GNU General Public License
# along with Morpho project; If not, see <http://www.gnu.org/licenses/>.
# 
# @license AGPL-3.0-or-later <https://spdx.org/licenses/AGPL-3.0-or-later>

"""
Force threading.
-
EXPERT SETTINGS. It can cause instabilities.
-
Icon made by Freepik <https://www.flaticon.com/authors/freepik>.
See license for more details.
    Args:
        _active: Run Threaded. If it is 'True' simulation will stay responsive [bool].
        -
        Warning.
        It can cause instabilities in case of many simulations.
        
    Returns:
        read_me: Message for users.
        t_thread: Threading settings of *.simx file.
"""

ghenv.Component.Name = "Morpho Thread"
ghenv.Component.NickName = "morpho_thread"
ghenv.Component.Category = "Morpho"
ghenv.Component.SubCategory = "4 || Simulation"
try: ghenv.Component.AdditionalHelpFromDocStrings = "2"
except: pass

import scriptcontext as sc
import os
import sys
import clr
##################Envimet INX####################
try:
    user_path = os.getenv("APPDATA")
    sys.path.append(os.path.join(user_path, "Morpho"))
    clr.AddReferenceToFile("Morpho25.dll")
    from Morpho25.Settings import TThread, Active
    
except ImportError as e:
    raise ImportError("\nFailed to import Morpho: {0}\n\nCheck your 'Morpho' folder in {1}".format(e, os.getenv("APPDATA")))
################################################
ghenv.Component.Message = "1.1.0"

def main():
    
    if _active:
        
        t_thread = TThread(Active.YES)
        
        return t_thread
    else:
        return

t_thread = main()
if not t_thread: print("Please, connect _active.")
# ---------- end morpho_thread ----------
morpho_sor = MorphoSOR(active=toggle_5)  # -> read_me, SOR; inputs active: Boolean
# ---------- morpho_sor: Python ----------
# Morpho: A plugin to write Envimet models.
# This file is part of Morpho project.
#
# Copyright (c) 2022, Antonello Di Nunzio <antonellodinunzio@gmail.com>.
# You should have received a copy of the GNU General Public License
# along with Morpho project; If not, see <http://www.gnu.org/licenses/>.
# 
# @license AGPL-3.0-or-later <https://spdx.org/licenses/AGPL-3.0-or-later>

"""
Active SOR mode. If you active it pressure field is calculated via red-black-tree algorithm which allows parallel computation of pressure field.
-
EXPERT SETTINGS.
-
Icon made by Freepik <https://www.flaticon.com/authors/freepik>.
See license for more details.
    Args:
        _active: Set it to True [bool].
        
    Returns:
        read_me: Message for users.
        SOR: SOR settings of *.simx file.
"""

ghenv.Component.Name = "Morpho SOR"
ghenv.Component.NickName = "morpho_sor"
ghenv.Component.Category = "Morpho"
ghenv.Component.SubCategory = "4 || Simulation"
try: ghenv.Component.AdditionalHelpFromDocStrings = "2"
except: pass

import scriptcontext as sc
import os
import sys
import clr
##################Envimet INX####################
try:
    user_path = os.getenv("APPDATA")
    sys.path.append(os.path.join(user_path, "Morpho"))
    clr.AddReferenceToFile("Morpho25.dll")
    from Morpho25.Settings import SOR, Active
    
except ImportError as e:
    raise ImportError("\nFailed to import Morpho: {0}\n\nCheck your 'Morpho' folder in {1}".format(e, os.getenv("APPDATA")))
################################################
ghenv.Component.Message = "1.1.0"

def main():
    
    if _active:
        
        sor = SOR(Active.YES)
        
        return sor
    else:
        return

SOR = main()
if not SOR: print("Please, connect _active.")
# ---------- end morpho_sor ----------

# ---- group: Simx / 5
toggle_7 = BooleanToggle(True)

# ---- group: Simx
morpho_simx = MorphoSimx(
    main_settings=morpho_main_settings.main_settings,
    other_settings=flatten([morpho_avg_inflow.avg_inflow, morpho_building_settings.building_settings, morpho_simple_forcing.simple_forcing, morpho_clouds.clouds, morpho_ivs.IVS, morpho_lbc.LBC, morpho_output_settings.output_settings, morpho_parallel_calculation.parallel_cpu, morpho_pollutant_concentration.pollutant_concentration, morpho_pollutant.source_settings, morpho_soilsettings.soil_settings, morpho_solaradjust.solar_adjust, morpho_sor.SOR, morpho_thread.t_thread, morpho_timestep.timestep, morpho_timing.model_timing, morpho_tree_settings.plant_settings, morpho_turbolence.turbolence, morpho_wind_resistance.wind_resistance]),
    run_it=toggle_7)  # -> read_me, simx; inputs other_settings: list, run_it: Boolean
# ---------- morpho_simx: Python ----------
# Morpho: A plugin to write Envimet 2.5D models.
# This file is part of Morpho project.
#
# Copyright (c) 2020, Antonello Di Nunzio <antonellodinunzio@gmail.com>.
# You should have received a copy of the GNU General Public License
# along with Morpho project; If not, see <http://www.gnu.org/licenses/>.
# 
# @license GPL-3.0+ <http://spdx.org/licenses/GPL-3.0+>

"""
This component write simx object to run simulation. Connect it to 'Morpho Run Simulation'.
-
You cannot use SimpleForcing and FullForcing at same time.
    Args:
        _main_settings: Inx Model.
        other_settings_: Connect other simulation output among:
        . "Morpho Simple Forcing"
        . "Morpho Full Forcing"
        . "Morpho Thread"
        . "Morpho Timestep"
        . "Morpho Timing"
        . "Morpho SoilSettings"
        . "Morpho Pollutant"
        . "Morpho Turbolence"
        . "Morpho Output Settings"
        . "Morpho Clouds"
        . "Morpho Pollutant Concentration"
        . "Morpho SolarAdjust"
        . "Morpho Building Settings"
        . "Morpho IVS"
        . "Morpho Parallel Calculation"
        . "Morpho SOR"
        . "Morpho Averaged Inflow"
        . "Morpho Wind Resistance"
        . "Morpho Tree Settings"
        -
        Please note, you cannot use SimpleForcing and FullForcing at same time.
        _run_it: Set it to 'True' to create SIMX Model.
        
        
    Returns:
        read_me: Message for users.
        simx: SIMX object to use for simulation.
"""

ghenv.Component.Name = "Morpho Simx"
ghenv.Component.NickName = "morpho_simx"
ghenv.Component.Category = "Morpho"
ghenv.Component.SubCategory = "3 || IO"
try: ghenv.Component.AdditionalHelpFromDocStrings = "1"
except: pass

import scriptcontext as sc
import os
import sys
import clr
##################Envimet INX####################
try:
    user_path = os.getenv("APPDATA")
    sys.path.append(os.path.join(user_path, "Morpho"))
    clr.AddReferenceToFile("Morpho25.dll")
    from Morpho25.IO import *
    from Morpho25.Settings import *
    
except ImportError as e:
    raise ImportError("\nFailed to import Morpho: {0}\n\nCheck your 'Morpho' folder in {1}".format(e, os.getenv("APPDATA")))
################################################
ghenv.Component.Message = "1.0.1 2.5D"

def main():
    
    if _main_settings and _run_it:
        
        simx = Simx(_main_settings)
        
        if other_settings_:
            for obj in other_settings_:
                if (type(obj) == SimpleForcing):
                    simx.SimpleForcing = obj
                if (type(obj) == FullForcing):
                    simx.FullForcing = obj
                if (type(obj) == TThread):
                    simx.TThread = obj
                if (type(obj) == TimeSteps):
                    simx.TimeSteps = obj
                if (type(obj) == ModelTiming):
                    simx.ModelTiming = obj
                if (type(obj) == SoilSettings):
                    simx.SoilSettings = obj
                if (type(obj) == Sources):
                    simx.Sources = obj
                if (type(obj) == Turbulence):
                    simx.Turbulence = obj
                if (type(obj) == OutputSettings):
                    simx.OutputSettings = obj
                if (type(obj) == Cloud):
                    simx.Cloud = obj
                if (type(obj) == Background):
                    simx.Background = obj
                if (type(obj) == SolarAdjust):
                    simx.SolarAdjust = obj
                if (type(obj) == BuildingSettings):
                    simx.BuildingSettings = obj
                if (type(obj) == IVS):
                    simx.IVS = obj
                if (type(obj) == ParallelCPU):
                    simx.ParallelCPU = obj
                if (type(obj) == SOR):
                    simx.SOR = obj
                if (type(obj) == InflowAvg):
                    simx.InflowAvg = obj
                if (type(obj) == Facades):
                    simx.Facades = obj
                if (type(obj) == PlantSetting):
                    simx.PlantSetting = obj
                if (type(obj) == LBC):
                    simx.LBC = obj
        
        simx.WriteSimx()
        print("{0} written!".format(simx.MainSettings.Name))
        
        return simx
    else:
        return

simx = main()
if not simx: print("Please, connect _main_settings and _run_it")
# ---------- end morpho_simx ----------

# ---- group: Run It / 5
toggle_8 = BooleanToggle(False)

# ---- group: Run It
morpho_run_simulation = MorphoRunSimulation(simx=morpho_simx.simx, run_it=toggle_8)  # -> read_me; inputs run_it: Boolean
# ---------- morpho_run_simulation: Python ----------
# Morpho: A plugin to write Envimet 2.5D models.
# This file is part of Morpho project.
#
# Copyright (c) 2020, Antonello Di Nunzio <antonellodinunzio@gmail.com>.
# You should have received a copy of the GNU General Public License
# along with Morpho project; If not, see <http://www.gnu.org/licenses/>.
# 
# @license GPL-3.0+ <http://spdx.org/licenses/GPL-3.0+>

"""
This component write a batch and run simulation using envimet_console.exe.
    Args:
        _simx: Simulation (SIMX) to run.
        _run_it: Set it to 'True' to run simulation.
        
    Returns:
        read_me: Message for users.
"""

ghenv.Component.Name = "Morpho Run Simulation"
ghenv.Component.NickName = "morpho_run_simulation"
ghenv.Component.Category = "Morpho"
ghenv.Component.SubCategory = "5 || Util"
try: ghenv.Component.AdditionalHelpFromDocStrings = "1"
except: pass

import scriptcontext as sc
import os
import sys
import clr
##################Envimet INX####################
try:
    user_path = os.getenv("APPDATA")
    sys.path.append(os.path.join(user_path, "Morpho"))
    clr.AddReferenceToFile("Morpho25.dll")
    from Morpho25.IO import SimulationBatch
    
except ImportError as e:
    raise ImportError("\nFailed to import Morpho: {0}\n\nCheck your 'Morpho' folder in {1}".format(e, os.getenv("APPDATA")))
################################################
ghenv.Component.Message = "1.0.1 2.5D"

def main():
    
    if _simx and _run_it:
        
        SimulationBatch.RunSimulation(_simx)
        
        return "OK"
    else:
        return

result = main()
if not result: print("Please, connect _main_settings and set _run_it to 'True'.")
# ---------- end morpho_run_simulation ----------

# ---- group: Connect the output folder
python = GhPythonScript()  # -> main_folder
# ---------- python: Python ----------
"""Get current path - for examples only"""

__author__ = "antonellodinunzio"

import os

file_name = ghenv.Component.OnPingDocument().FilePath

main_folder = os.path.join(os.path.dirname(file_name), "output")
# ---------- end python ----------
morpho_output_folder = MorphoOutputFolder(output_folder=python)  # -> read_me, atmosphere, buildings, radiation, soil, solaraccess, surface, vegetation
# ---------- morpho_output_folder: Python ----------
# Morpho: A plugin to write Envimet 2.5D models.
# This file is part of Morpho project.
#
# Copyright (c) 2020, Antonello Di Nunzio <antonellodinunzio@gmail.com>.
# You should have received a copy of the GNU General Public License
# along with Morpho project; If not, see <http://www.gnu.org/licenses/>.
# 
# @license GPL-3.0+ <http://spdx.org/licenses/GPL-3.0+>

"""
Read and sort all binaries of an output folder of envimet
    Args:
        _output_folder: File path of the output folder of envimet [string].
    
    Returns:
        read_me: Message for users.
        atmosphere: Atmosphere binaries (edt).
        buildings: Building binaries (edt).
        radiation: Radiation binaries (edt).
        soil: Soil binaries (edt).
        solaraccess: Solaraccess binaries (safac).
        surface: Surface binaries (edt).
        vegetation: Vegetation binaries (edt).
"""

ghenv.Component.Name = "Morpho Output Folder"
ghenv.Component.NickName = "morpho_output_folder"
ghenv.Component.Category = "Morpho"
ghenv.Component.SubCategory = "3 || IO"
try: ghenv.Component.AdditionalHelpFromDocStrings = "1"
except: pass
ghenv.Component.Message = "1.0.1 2.5D/3D"

import os

if _output_folder:
    directory = os.listdir(_output_folder)
    
    folder_to_search = ['atmosphere', 'buildings', 'radiation', 'soil', 'solaraccess', 'surface', 'vegetation']
    
    path = [os.path.join(_output_folder, f) for f in directory 
            if str.lower(f) in folder_to_search]
    
    result = {}
    for p in path:
        
        if os.path.basename(p) == 'buildings':
            p += '\\dynamic'
        
        result[os.path.basename(p)] = sorted([os.path.join(p, f) for f in os.listdir(p) 
                                             if f.endswith(".EDT") 
                                             and 'First Flow Field'not in f
                                             and 'initialisation' not in f])
    
    atmosphere = result['atmosphere']
    buildings = result['dynamic']
    radiation = result['radiation']
    soil = result['soil']
    solaraccess = result['solaraccess']
    surface = result['surface']
    vegetation = result['vegetation']
else:
    print 'Please connect the full path of an envimet output folder'
# ---------- end morpho_output_folder ----------

# ----
number_slider_2 = Slider(1, range=0..1)
item_4 = ListItem(List=morpho_output_folder.buildings, Index=number_slider_2, Wrap=True)
item_5 = ListItem(List=morpho_output_folder.vegetation, Index=number_slider_2, Wrap=True)
item_6 = ListItem(List=morpho_output_folder.solaraccess, Index=Slider(6, range=0..6), Wrap=True)
item_7 = ListItem(List=morpho_output_folder.atmosphere, Index=number_slider_2, Wrap=True)

# ---- group: Get mask from terrain Z
# 6
toggle_9 = BooleanToggle(False)
data = Data(pt)
morpho_read_grid_slice = MorphoReadGridSlice(edt=item_6, variable="3", dir="2", base_point=data, run_it=toggle_9)  # -> read_me, variables, project_name, date, time, selected_variable, face, values; inputs variable: Int32, dir: Int32, index: Int32, base_point: Point3d, run_it: Boolean
# ---------- morpho_read_grid_slice: Python ----------
# Morpho: A plugin to write Envimet models.
# This file is part of Morpho project.
#
# Copyright (c) 2023, Antonello Di Nunzio <antonellodinunzio@gmail.com>.
# You should have received a copy of the GNU General Public License
# along with Morpho project; If not, see <http://www.gnu.org/licenses/>.
# 
# @license AGPL-3.0-or-later <https://spdx.org/licenses/AGPL-3.0-or-later>

"""
Read EDT grid slice in X, Y or Z direction.
-
Compatible edt files come from
. Atmosphere -> slice dir X, Y, Z
. Surface -> slice dir Z only z0
. Soil -> slice dir Z
. Pollutants -> slice dir X, Y, Z
. Radiation -> slice dir X, Y, Z
. SolarAccess SA -> slice dir Z only z0
. Comfort (UTCI, PET, SET, PMV) -> slice dir X, Y, Z
-
You can use native component of Grasshopper to set the color of the pixels 
OR you can use 'recolor mesh' component of Ladybug[+] or Ladybug Legacy to use lots of additional features for visualization.
    Args:
        _edt: File path of EDT binary file [string].
        _variable_: Index of the variable to read [integer].
        -
        Connect a panel to 'variables' output to see all available variables
        AND a panel to 'selected_variable' to see the current one.
        _dir_: Connect an integer to set the direction of the section plane [integer]. Default is 0.
        0 = X
        1 = Y
        2 = Z
        _index_: Index of the slice to read in X or Y or Z [integer].
        -
        Connect a panel to read_me to check how many cells there are.
        min_: A number representing the lower boundary to filter data [float]. 
        max_: A number representing the upper boundary to filter data [float]. 
        base_point_: Lower left corner of the grid. Default value is point at 0,0,0. Connect a Rhino point to change it [Point3d].
        _run_it: Set it to 'True' to get face and values.
    
    Returns:
        read_me: Message for users.
        variables: All available variable you can read. Check the index to use with _variable_ input.
        project_name: Name of the current envimet project.
        date: Simulation date.
        time: Simulation time.
        selected_variable: Name of the current variable.
        face: List of face object to parse. It contains geometry information.
        values: Values for each face.
"""

ghenv.Component.Name = "Morpho Read Grid Slice"
ghenv.Component.NickName = "morpho_read_grid_slice"
ghenv.Component.Category = "Morpho"
ghenv.Component.SubCategory = "1 || IO"
try: ghenv.Component.AdditionalHelpFromDocStrings = "3"
except: pass

import scriptcontext as sc
import os
import sys
import clr
##################Envimet INX####################
from System.Collections.Generic import *
try:
    user_path = os.getenv("APPDATA")
    sys.path.append(os.path.join(user_path, "Morpho"))
    clr.AddReferenceToFile("MorphoReader.dll")
    clr.AddReferenceToFile("MorphoRhino.dll")
    from MorphoReader import GridOutput, Direction, Voxel
    from MorphoRhino.RhinoAdapter import RhinoConvert
    
except ImportError as e:
    raise ImportError("\nFailed to import Morpho: {0}\n\nCheck your 'Morpho' folder in {1}".format(e, os.getenv("APPDATA")))
################################################
ghenv.Component.Message = "1.1.2"

def get_file_path(path):
    
    file, extension = os.path.splitext(path)
    
    return path, file + ".EDX"


def main():
    
    if _edt:
        
        edt, edx = get_file_path(_edt)
        
        variable = 1 if _variable_ == None else _variable_
        index = 0 if _index_ == None else _index_
        
        if _dir_ == 1:
            dir = Direction.Y
        elif _dir_ == 2:
            dir = Direction.Z
        else:
            dir = Direction.X
        
        if base_point_:
            origin = RhinoConvert.FromRhPointToVector(base_point_)
            output = GridOutput(edx, origin)
        else:
            output = GridOutput(edx)
        
        project_name = output.ProjectName
        date = output.SimulationDate
        time = output.SimulationTime
        variables = output.VariableName
        selected_variable = output.VariableName[variable]
        
        print("Grid: {0}, {1}, {2}".format(output.NumX, output.NumY, output.NumZ))
        
        if output.DataContent not in [1, 2, 3, 4, 5, 8, 11]:
            print("Please, connect an edt file.\nYou can read Atmosphere, Surface, Soil, Pollutants, Radiation, SolarAccess, Comfort")
            return [None] * 7
        
        if _run_it:
            
            # Surface
            if output.DataContent in [2, 8]:
                index = 0
                dir = Direction.Z
            elif output.DataContent == 3:
                dir = Direction.Z
            
            voxels = output.GetVoxels(dir)
            output.SetValuesFromBinary(edt, voxels, variable)
            
            # filter
            voxels = Voxel.GetSliceByPixelCoordinate(voxels, index, dir)
            if min_ != None and max_ != None:
                voxels = Voxel.GetVoxelsByThreshold(voxels, min_, max_)
            
            # get values from voxels
            values = Voxel.GetValueZFromVoxels(voxels)
            
            # get geometry
            face = Voxel.GetFacesFromVoxels(voxels)
            
            return variables, project_name, date, time, selected_variable, face, values
            
        return variables, project_name, date, time, selected_variable, None, None
    else:
        return [None] * 7


if not _edt:
    print("Please, connect a compatible _edt and check available outputs using panels.")
else:
    variables, project_name, date, time, selected_variable, face, values = main()
# ---------- end morpho_read_grid_slice ----------

# ----
get_a_solaraccess_sa_file_to_create_a_ma = Panel(item_6)  # "Get a SolarAccess SA file to create a mask byTerrain"

panel_7 = Panel(morpho_read_grid_slice.read_me)
panel_8 = Panel(morpho_read_grid_slice.variables)
panel_9 = Panel(morpho_read_grid_slice.date)
panel_10 = Panel(morpho_read_grid_slice.time)
panel_11 = Panel(morpho_read_grid_slice.selected_variable)

# ---- group: Shift by 2
addition = Addition(A=morpho_read_grid_slice.values, B="2")

# ---- group: Air flow
panel_12 = Panel("""1
2
3""")
data_2 = Data(pt)
morpho_read_grid_by_mask = MorphoReadGridByMask(edt=item_7, variable=panel_12, z_mask=addition, base_point=data_2, run_it=Toggle(False))  # -> read_me, variables, project_name, date, time, selected_variable, face, values; inputs variable: Int32, z_mask: list of Int32, base_point: Point3d, run_it: Boolean
# ---------- morpho_read_grid_by_mask: Python ----------
# Morpho: A plugin to write Envimet models.
# This file is part of Morpho project.
#
# Copyright (c) 2023, Antonello Di Nunzio <antonellodinunzio@gmail.com>.
# You should have received a copy of the GNU General Public License
# along with Morpho project; If not, see <http://www.gnu.org/licenses/>.
# 
# @license AGPL-3.0-or-later <https://spdx.org/licenses/AGPL-3.0-or-later>

"""
Read EDT grid by mask. It can be used to have the 'follow terrain' visualization.
-
USE IT ONLY IF YOU HAVE DEM or you want to create particular visualization. Otherwise use "Morpho Read Grid Slice"
-
Compatible edt files come from
. Atmosphere -> dir Z
. Radiation -> dir Z
. Pollutants -> dir Z
. Comfort (UTCI, PET, SET, PMV) -> dir Z
-
Thanks to Graziano Marchesani for the 'follow terrain' visualization idea.
-
You can use native component of Grasshopper to set the color of the pixels 
OR you can use 'recolor mesh' component of Ladybug[+] or Ladybug Legacy to use lots of additional features for visualization.
    Args:
        _edt: File path of EDT binary file [string].
        _variable_: Index of the variable to read [integer].
        -
        Connect a panel to 'variables' output to see all available variables
        AND a panel to 'selected_variable' to see the current one.
        _dir_: Connect an integer to set the direction of the section plane [integer]. Default is 0.
        0 = X
        1 = Y
        2 = Z
        _z_mask:  Connect a list of z indexes of the XY plane of section. If your grid is 100 X, 100 Y you need to provide 10000 values.
        -
        You can connect list of 'values' that comes from SolarAccess SA and 'Index z node terrain' variable to generate 'follow terrain' sections.
        min_: A number representing the lower boundary to filter data [float]. 
        max_: A number representing the upper boundary to filter data [float]. 
        base_point_: Lower left corner of the grid. Default value is point at 0,0,0. Connect a Rhino point to change it [Point3d].
        _run_it: Set it to 'True' to get face and values.
    
    Returns:
        read_me: Message for users.
        variables: All available variable you can read. Check the index to use with _variable_ input.
        project_name: Name of the current envimet project.
        date: Simulation date.
        time: Simulation time.
        selected_variable: Name of the current variable.
        face: List of face object to parse. It contains geometry information.
        values: Values for each face.
"""

ghenv.Component.Name = "Morpho Read Grid by Mask"
ghenv.Component.NickName = "morpho_read_grid_by_mask"
ghenv.Component.Category = "Morpho"
ghenv.Component.SubCategory = "1 || IO"
try: ghenv.Component.AdditionalHelpFromDocStrings = "3"
except: pass

import scriptcontext as sc
import os
import sys
import clr
##################Envimet INX####################
from System.Collections.Generic import *
try:
    user_path = os.getenv("APPDATA")
    sys.path.append(os.path.join(user_path, "Morpho"))
    clr.AddReferenceToFile("MorphoReader.dll")
    clr.AddReferenceToFile("MorphoRhino.dll")
    from MorphoReader import GridOutput, Direction, Voxel
    from MorphoRhino.RhinoAdapter import RhinoConvert
    
except ImportError as e:
    raise ImportError("\nFailed to import Morpho: {0}\n\nCheck your 'Morpho' folder in {1}".format(e, os.getenv("APPDATA")))
################################################
ghenv.Component.Message = "1.1.2"

def get_file_path(path):
    
    file, extension = os.path.splitext(path)
    
    return path, file + ".EDX"


def main():
    
    if _edt:
        
        edt, edx = get_file_path(_edt)
        
        variable = 1 if _variable_ == None else _variable_
        
        if base_point_:
            origin = RhinoConvert.FromRhPointToVector(base_point_)
            output = GridOutput(edx, origin)
        else:
            output = GridOutput(edx)
        
        project_name = output.ProjectName
        date = output.SimulationDate
        time = output.SimulationTime
        variables = output.VariableName
        selected_variable = output.VariableName[variable]
        
        print("Grid: {0}, {1}, {2}".format(output.NumX, output.NumY, output.NumZ))
        
        if output.DataContent not in [1, 4, 5, 11]:
            print("Please, connect an edt file.\nYou can read Atmosphere, Radiation, Comfort, Pollutants.")
            return [None] * 7
        
        if _run_it and _z_mask:
            
            values = List[int](_z_mask)
            
            voxels = output.GetVoxels(Direction.Z)
            output.SetValuesFromBinary(edt, voxels, variable)
            
            # filter
            voxels = Voxel.GetVoxelsFilterByZmask(voxels, values, output.NumZ)
            if min_ != None and max_ != None:
                voxels = Voxel.GetVoxelsByThreshold(voxels, min_, max_)
            
            # get values
            values = Voxel.GetValueZFromVoxels(voxels)
            
            # get geometry
            face = Voxel.GetFacesFromVoxels(voxels)
            
            return variables, project_name, date, time, selected_variable, face, values
            
        return variables, project_name, date, time, selected_variable, None, None
    else:
        return [None] * 7


if not _edt or _z_mask == []:
    print("Please, connect a compatible _edt and _z_mask. Check also available outputs using panels.")
else:
    variables, project_name, date, time, selected_variable, face, values = main()
# ---------- end morpho_read_grid_by_mask ----------

# ---- group: Facades
panel_13 = Panel("""0
1
2""")
# 7
panel_14 = Panel("10")
data_3 = Data(pt)
morpho_read_building_facades = MorphoReadBuildingFacades(edt=item_4, variable=panel_14, dir=panel_13, base_point=data_3, run_it=Toggle(False))  # -> read_me, variables, project_name, date, time, selected_variable, face, values; inputs variable: Int32, dir: Int32, base_point: Point3d, run_it: Boolean
# ---------- morpho_read_building_facades: Python ----------
# Morpho: A plugin to write Envimet models.
# This file is part of Morpho project.
#
# Copyright (c) 2023, Antonello Di Nunzio <antonellodinunzio@gmail.com>.
# You should have received a copy of the GNU General Public License
# along with Morpho project; If not, see <http://www.gnu.org/licenses/>.
# 
# @license AGPL-3.0-or-later <https://spdx.org/licenses/AGPL-3.0-or-later>

"""
Read EDT files of dynamic output of buildings
-
Compatible edt files come from
. Building\dynamic -> facade dir X, Y, Z
. SolarAccess SAFAC -> facade dir X, Y, Z
-
You can use native component of Grasshopper to set the color of the pixels 
OR you can use 'recolor mesh' component of Ladybug[+] or Ladybug Legacy to use lots of additional features for visualization.
    Args:
        _edt: File path of EDT binary file [string].
        _variable_: Index of the variable to read [integer].
        -
        Connect a panel to 'variables' output to see all available variables
        AND a panel to 'selected_variable' to see the current one.
        _dir_: Connect an integer to set the direction of the facades to read [integer]. Default is 0.
        0 = X
        1 = Y
        2 = Z
        base_point_: Lower left corner of the grid. Default value is point at 0,0,0. Connect a Rhino point to change it [Point3d].
        min_: A number representing the lower boundary to filter data [float]. 
        max_: A number representing the upper boundary to filter data [float]. 
        _run_it: Set it to 'True' to get face and values.
    
    Returns:
        read_me: Message for users.
        variables: All available variable you can read. Check the index to use with _variable_ input.
        project_name: Name of the current envimet project.
        date: Simulation date.
        time: Simulation time.
        selected_variable: Name of the current variable.
        face: List of face object to parse. It contains geometry information.
        values: Values for each face.
"""

ghenv.Component.Name = "Morpho Read Building Facades"
ghenv.Component.NickName = "morpho_read_building_facades"
ghenv.Component.Category = "Morpho"
ghenv.Component.SubCategory = "1 || IO"
try: ghenv.Component.AdditionalHelpFromDocStrings = "3"
except: pass

import scriptcontext as sc
import os
import sys
import clr
##################Envimet INX####################
from System.Collections.Generic import *
try:
    user_path = os.getenv("APPDATA")
    sys.path.append(os.path.join(user_path, "Morpho"))
    clr.AddReferenceToFile("MorphoReader.dll")
    clr.AddReferenceToFile("MorphoRhino.dll")
    from MorphoReader import GridOutput, BuildingOutput, Direction, Voxel
    from MorphoRhino.RhinoAdapter import RhinoConvert
    
except ImportError as e:
    raise ImportError("\nFailed to import Morpho: {0}\n\nCheck your 'Morpho' folder in {1}".format(e, os.getenv("APPDATA")))
################################################
ghenv.Component.Message = "1.1.2"

def get_file_path(path):
    
    file, extension = os.path.splitext(path)
    
    return path, file + ".EDX"


def main():
    
    if _edt:
        
        edt, edx = get_file_path(_edt)
        
        variable = 1 if _variable_ == None else _variable_
        
        if _dir_ == 1:
            dir = Direction.Y
        elif _dir_ == 2:
            dir = Direction.Z
        else:
            dir = Direction.X
        
        if base_point_:
            origin = RhinoConvert.FromRhPointToVector(base_point_)
            output = BuildingOutput(edx, origin)
        else:
            output = BuildingOutput(edx)
        
        project_name = output.ProjectName
        date = output.SimulationDate
        time = output.SimulationTime
        variables = output.VariableName
        selected_variable = output.VariableName[variable]
        
        print("Grid: {0}, {1}, {2}".format(output.NumX, output.NumY, output.NumZ))
        
        if output.DataContent not in [7, 10]:
            print("Please, connect a file of dynamic output of buildings or solaraccess SAFAC.")
            return [None] * 7
        
        if _run_it:
            
            voxels = output.GetVoxels(dir)
            output.SetValuesFromBinary(edt, voxels, variable)
            
            # filter
            voxels = Voxel.GetVoxelsByDirection(voxels, dir)
            if min_ != None and max_ != None:
                voxels = Voxel.GetVoxelsByThreshold(voxels, min_, max_, dir)
            
            # get values from facades
            if _dir_ == 1:
                values = Voxel.GetValueYFromVoxels(voxels)
            elif _dir_ == 2:
                values = Voxel.GetValueZFromVoxels(voxels)
            else:
                values = Voxel.GetValueXFromVoxels(voxels)
            # get geometry
            face = Voxel.GetFacesFromVoxels(voxels)
            
            return variables, project_name, date, time, selected_variable, face, values
            
        return variables, project_name, date, time, selected_variable, None, None
    else:
        return [None] * 7


if not _edt:
    print("Please, connect _edt and check available outputs using panels.")
else:
    variables, project_name, date, time, selected_variable, face, values = main()
# ---------- end morpho_read_building_facades ----------

# ---- group: Tree
data_4 = Data(pt)
morpho_read_vegetation = MorphoReadVegetation(edt=item_5, variable="6", base_point=data_4, run_it=Toggle(False))  # -> read_me, variables, project_name, date, time, selected_variable, face, values; inputs variable: Int32, base_point: Point3d, run_it: Boolean
# ---------- morpho_read_vegetation: Python ----------
# Morpho: A plugin to write Envimet models.
# This file is part of Morpho project.
#
# Copyright (c) 2023, Antonello Di Nunzio <antonellodinunzio@gmail.com>.
# You should have received a copy of the GNU General Public License
# along with Morpho project; If not, see <http://www.gnu.org/licenses/>.
# 
# @license AGPL-3.0-or-later <https://spdx.org/licenses/AGPL-3.0-or-later>

"""
Read EDT files of dynamic output of vegetation
-
You can use native component of Grasshopper to set the color of the pixels 
OR you can use 'recolor mesh' component of Ladybug[+] or Ladybug Legacy to use lots of additional features for visualization.
    Args:
        _edt: File path of EDT binary file [string].
        _variable_: Index of the variable to read [integer].
        -
        Connect a panel to 'variables' output to see all available variables
        AND a panel to 'selected_variable' to see the current one.
        min_: A number representing the lower boundary to filter data [float]. 
        max_: A number representing the upper boundary to filter data [float]. 
        base_point_: Lower left corner of the grid. Default value is point at 0,0,0. Connect a Rhino point to change it [Point3d].
        _run_it: Set it to 'True' to get face and values.
    
    Returns:
        read_me: Message for users.
        variables: All available variable you can read. Check the index to use with _variable_ input.
        project_name: Name of the current envimet project.
        date: Simulation date.
        time: Simulation time.
        selected_variable: Name of the current variable.
        face: List of face object to parse. It contains geometry information.
        values: Values for each face.
"""

ghenv.Component.Name = "Morpho Read Vegetation"
ghenv.Component.NickName = "morpho_read_vegetation"
ghenv.Component.Category = "Morpho"
ghenv.Component.SubCategory = "1 || IO"
try: ghenv.Component.AdditionalHelpFromDocStrings = "3"
except: pass

import scriptcontext as sc
import os
import sys
import clr
##################Envimet INX####################
from System.Collections.Generic import *
try:
    user_path = os.getenv("APPDATA")
    sys.path.append(os.path.join(user_path, "Morpho"))
    clr.AddReferenceToFile("MorphoReader.dll")
    clr.AddReferenceToFile("MorphoRhino.dll")
    from MorphoReader import GridOutput, BuildingOutput, Direction, Voxel
    from MorphoRhino.RhinoAdapter import RhinoConvert
    
except ImportError as e:
    raise ImportError("\nFailed to import Morpho: {0}\n\nCheck your 'Morpho' folder in {1}".format(e, os.getenv("APPDATA")))
################################################
ghenv.Component.Message = "1.1.2"

def get_file_path(path):
    
    file, extension = os.path.splitext(path)
    
    return path, file + ".EDX"


def main():
    
    if _edt:
        
        edt, edx = get_file_path(_edt)
        
        variable = 1 if _variable_ == None else _variable_
        
        if base_point_:
            origin = RhinoConvert.FromRhPointToVector(base_point_)
            output = GridOutput(edx, origin)
        else:
            output = GridOutput(edx)
        
        project_name = output.ProjectName
        date = output.SimulationDate
        time = output.SimulationTime
        variables = output.VariableName
        selected_variable = output.VariableName[variable]
        
        print("Grid: {0}, {1}, {2}".format(output.NumX, output.NumY, output.NumZ))
        
        if output.DataContent != 6:
            print("Please, connect a file of dynamic output of vegetation.")
            return [None] * 7
        
        if _run_it and output.DataContent == 6:
            
            dir = Direction.Z
            
            voxels = output.GetVoxels(dir)
            output.SetValuesFromBinary(edt, voxels, variable)
            
            # filter
            voxels = Voxel.GetVoxelsByDirection(voxels, dir)
            if min_ != None and max_ != None:
                voxels = Voxel.GetVoxelsByThreshold(voxels, min_, max_)
            
            # get values
            values = Voxel.GetValueZFromVoxels(voxels)
            
            # get geometry
            face = Voxel.GetFacesFromVoxels(voxels)
            
            return variables, project_name, date, time, selected_variable, face, values
            
        return variables, project_name, date, time, selected_variable, None, None
    else:
        return [None] * 7


if not _edt:
    print("Please, connect _edt and check available outputs using panels.")
else:
    variables, project_name, date, time, selected_variable, face, values = main()
# ---------- end morpho_read_vegetation ----------

# ---- group: Grid by mask
data_5 = Data(pt)
morpho_read_grid_by_mask_2 = MorphoReadGridByMask(edt=item_7, variable="4", z_mask=morpho_read_grid_slice.values, base_point=data_5, run_it=Toggle(False))  # -> read_me, variables, project_name, date, time, selected_variable, face, values; inputs variable: Int32, z_mask: list of Int32, base_point: Point3d, run_it: Boolean; same code as morpho_read_grid_by_mask

# ----
morpho_from_face_to_rhinobrep = MorphoFromFaceToRhinoBrep(face=morpho_read_grid_by_mask.face)  # -> read_me, rh_brep; inputs face: list
# ---------- morpho_from_face_to_rhinobrep: Python ----------
# Morpho: A plugin to write Envimet 2.5D models.
# This file is part of Morpho project.
#
# Copyright (c) 2020, Antonello Di Nunzio <antonellodinunzio@gmail.com>.
# You should have received a copy of the GNU General Public License
# along with Morpho project; If not, see <http://www.gnu.org/licenses/>.
# 
# @license GPL-3.0+ <http://spdx.org/licenses/GPL-3.0+>

"""
From Morpho Face to Rhino brep.
-
Icon made by Freepik <https://www.flaticon.com/authors/freepik>.
See license for more details.
    Args:
        _face: Morpho Face [list Face]
    
    Returns:
        read_me: Message for users.
        rh_brep: Rhino brep.
"""

ghenv.Component.Name = "Morpho From Face To RhinoBrep"
ghenv.Component.NickName = "morpho_from_face_to_rhinobrep"
ghenv.Component.Category = "Morpho"
ghenv.Component.SubCategory = "0 || Geometry"
try: ghenv.Component.AdditionalHelpFromDocStrings = "1"
except: pass

import scriptcontext as sc
import os
import sys
import clr
################### Morpho #####################
try:
    user_path = os.getenv("APPDATA")
    sys.path.append(os.path.join(user_path, "Morpho"))
    clr.AddReferenceToFile("MorphoGeometry.dll")
    clr.AddReferenceToFile("MorphoRhino.dll")
    from MorphoRhino.RhinoAdapter import RhinoConvert
    from MorphoGeometry import Face
    
except ImportError as e:
    raise ImportError("\nFailed to import Morpho: {0}\n\nCheck your 'Morpho' folder in {1}".format(e, os.getenv("APPDATA")))
################################################
ghenv.Component.Message = "1.0.1 2.5D"

import Rhino as rc

def main():
    
    surface = []
    
    pt1 = [RhinoConvert.FromVectorToRhPoint(face.A) for face in _face]
    pt2 = [RhinoConvert.FromVectorToRhPoint(face.B) for face in _face]
    pt3 = [RhinoConvert.FromVectorToRhPoint(face.C) for face in _face]
    pt4 = [RhinoConvert.FromVectorToRhPoint(face.D) for face in _face]
    
    
    for p1, p2, p3, p4 in zip(pt1, pt2, pt3, pt4):
        surface.append(rc.Geometry.Brep.CreateFromCornerPoints(p1, p2, p3, p4, 0.01))
    
    return surface

if _face == [None] or _face == []: 
    print("Please, connect _face.")
else:
    rh_brep = main()
# ---------- end morpho_from_face_to_rhinobrep ----------
bang = ExplodeTree(Data=morpho_read_grid_by_mask.values)  # -> Branch0, Branch1, Branch2
branch = TreeBranch(Tree=simplify(morpho_from_face_to_rhinobrep.rh_brep), Path="0", MaintainPaths=True)
vec = VectorXYZ(XComponent=bang.Branch0, YComponent=bang.Branch1, ZComponent=bang.Branch2)  # -> Vector, Length

morpho_from_face_to_rhinomesh = MorphoFromFaceToRhinoMesh(face=morpho_read_grid_by_mask_2.face)  # -> read_me, rh_mesh; inputs face: list
# ---------- morpho_from_face_to_rhinomesh: Python ----------
# Morpho: A plugin to write Envimet 2.5D models.
# This file is part of Morpho project.
#
# Copyright (c) 2020, Antonello Di Nunzio <antonellodinunzio@gmail.com>.
# You should have received a copy of the GNU General Public License
# along with Morpho project; If not, see <http://www.gnu.org/licenses/>.
# 
# @license GPL-3.0+ <http://spdx.org/licenses/GPL-3.0+>

"""
From Morpho Face to Rhino mesh.
-
Icon made by Freepik <https://www.flaticon.com/authors/freepik>.
See license for more details.
    Args:
        _face: Morpho Face [list Face]
    
    Returns:
        read_me: Message for users.
        rh_mesh: Rhino mesh.
"""

ghenv.Component.Name = "Morpho From Face To RhinoMesh"
ghenv.Component.NickName = "morpho_from_face_to_rhinomesh"
ghenv.Component.Category = "Morpho"
ghenv.Component.SubCategory = "0 || Geometry"
try: ghenv.Component.AdditionalHelpFromDocStrings = "1"
except: pass

import scriptcontext as sc
import os
import sys
import clr
################### Morpho #####################
try:
    user_path = os.getenv("APPDATA")
    sys.path.append(os.path.join(user_path, "Morpho"))
    clr.AddReferenceToFile("MorphoGeometry.dll")
    clr.AddReferenceToFile("MorphoRhino.dll")
    from MorphoRhino.RhinoAdapter import RhinoConvert
    from MorphoGeometry import Face
    
except ImportError as e:
    raise ImportError("\nFailed to import Morpho: {0}\n\nCheck your 'Morpho' folder in {1}".format(e, os.getenv("APPDATA")))
################################################
ghenv.Component.Message = "1.0.1 2.5D"

from System.Collections.Generic import *

def main():
    return RhinoConvert.FromFacesToMesh(List[Face](_face))

if _face == [None] or _face == []: 
    print("Please, connect _face.")
else:
    rh_mesh = main()
# ---------- end morpho_from_face_to_rhinomesh ----------

panel_15 = Panel(morpho_read_vegetation.read_me)
panel_16 = Panel(morpho_read_vegetation.variables)
panel_17 = Panel(morpho_read_vegetation.date)
panel_18 = Panel(morpho_read_vegetation.selected_variable)
panel_19 = Panel(morpho_read_vegetation.time)

panel_20 = Panel(morpho_read_building_facades.read_me)
panel_21 = Panel(morpho_read_building_facades.variables)
panel_22 = Panel(morpho_read_building_facades.date)
panel_23 = Panel(morpho_read_building_facades.time)
panel_24 = Panel(morpho_read_building_facades.selected_variable)

panel_25 = Panel(morpho_read_grid_by_mask_2.read_me)
panel_26 = Panel(morpho_read_grid_by_mask_2.variables)
panel_27 = Panel(morpho_read_grid_by_mask_2.date)
panel_28 = Panel(morpho_read_grid_by_mask_2.time)
panel_29 = Panel(morpho_read_grid_by_mask_2.selected_variable)

morpho_from_face_to_rhinomesh_2 = MorphoFromFaceToRhinoMesh(face=morpho_read_vegetation.face)  # -> read_me, rh_mesh; inputs face: list; same code as morpho_from_face_to_rhinomesh
morpho_from_face_to_rhinomesh_3 = MorphoFromFaceToRhinoMesh(face=morpho_read_building_facades.face)  # -> read_me, rh_mesh; inputs face: list; same code as morpho_from_face_to_rhinomesh

area = Area(Geometry=branch)  # -> Area, Centroid
amp = Amplitude(Vector=vec.Vector, Amplitude=Slider(3.43, range=1..4))
vdisex = VectorDisplayEx(Point=area.Centroid, Vector=amp, Colour=RGB(0, 0, 0), Width=2)

merge = Merge(
    Data1=flatten(morpho_from_face_to_rhinomesh_3.rh_mesh),
    Data2=flatten(morpho_from_face_to_rhinomesh_2.rh_mesh),
    Data3=flatten(morpho_from_face_to_rhinomesh.rh_mesh))
merge_2 = Merge(
    Data1=flatten(morpho_read_building_facades.values),
    Data2=flatten(morpho_read_vegetation.values),
    Data3=flatten(morpho_read_grid_by_mask_2.values))

colrange = LBColorRange(index="15")  # -> colors; plug-in component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
legendpar = LBLegendParameters(min="0", max="4", colors=colrange)  # -> leg_par; plug-in component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

mjoin = MeshJoin(Meshes=flatten(merge))
heatmap = LBSpatialHeatmap(values=merge_2, mesh=mjoin, legend_par=legendpar)  # -> mesh, legend, title, colors, legend_par; plug-in component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
