# Grasshopper definition reading_facade_results_with_mask.gh (Grasshopper 1.0.7)
# Copyright: Coprat

# ---- group: Set the output foder path
# Read binary results
python = GhPythonScript()  # -> main_folder
# ---------- python: Python ----------
"""Get current path - for examples only"""

__author__ = "antonellodinunzio"

import os

file_name = ghenv.Component.OnPingDocument().FilePath

main_folder = os.path.join(os.path.dirname(file_name), "output")
# ---------- end python ----------
morpho_output_folder = MorphoOutputFolder(output_folder=python)  # -> read_me, atmosphere, buildings, radiation, soil, solaraccess, surface, vegetation
# ---------- morpho_output_folder: Python ----------
# Morpho: A plugin to write Envimet 2.5D models.
# This file is part of Morpho project.
#
# Copyright (c) 2020, Antonello Di Nunzio <antonellodinunzio@gmail.com>.
# You should have received a copy of the GNU General Public License
# along with Morpho project; If not, see <http://www.gnu.org/licenses/>.
# 
# @license GPL-3.0+ <http://spdx.org/licenses/GPL-3.0+>

"""
Read and sort all binaries of an output folder of envimet
    Args:
        _output_folder: File path of the output folder of envimet [string].
    
    Returns:
        read_me: Message for users.
        atmosphere: Atmosphere binaries (edt).
        buildings: Building binaries (edt).
        radiation: Radiation binaries (edt).
        soil: Soil binaries (edt).
        solaraccess: Solaraccess binaries (safac).
        surface: Surface binaries (edt).
        vegetation: Vegetation binaries (edt).
"""

ghenv.Component.Name = "Morpho Output Folder"
ghenv.Component.NickName = "morpho_output_folder"
ghenv.Component.Category = "Morpho"
ghenv.Component.SubCategory = "3 || IO"
try: ghenv.Component.AdditionalHelpFromDocStrings = "1"
except: pass
ghenv.Component.Message = "1.0.1 2.5D/3D"

import os

if _output_folder:
    directory = os.listdir(_output_folder)
    
    folder_to_search = ['atmosphere', 'buildings', 'radiation', 'soil', 'solaraccess', 'surface', 'vegetation']
    
    path = [os.path.join(_output_folder, f) for f in directory 
            if str.lower(f) in folder_to_search]
    
    result = {}
    for p in path:
        
        if os.path.basename(p) == 'buildings':
            subdir = os.listdir(p)
            if 'dynamic' in subdir:
                p += '\\dynamic'
        
        result[os.path.basename(p)] = sorted([os.path.join(p, f) for f in os.listdir(p) 
                                             if f.endswith(".EDT") 
                                             and 'First Flow Field'not in f
                                             and 'initialisation' not in f])
    
    if 'atmosphere' in result:
        atmosphere = result['atmosphere']
    if 'dynamic' in result:
        buildings = result['dynamic']
    if 'radiation' in result:
        radiation = result['radiation']
    if 'soil' in result:
        soil = result['soil']
    if 'solaraccess' in result:
        solaraccess = result['solaraccess']
    if 'surface' in result:
        surface = result['surface']
    if 'vegetation' in result:
        vegetation = result['vegetation']
else:
    print 'Please connect the full path of an envimet output folder'
# ---------- end morpho_output_folder ----------

# ----
item = ListItem(List=morpho_output_folder.buildings, Index=Slider(1, range=0..9), Wrap=True)
panel = Panel("""0
1
2""")

# ---- group: Set it to true / Facades
morpho_read_building_facades = MorphoReadBuildingFacades(edt=item, variable="11", dir=panel, run_it=Toggle(True))  # -> read_me, variables, project_name, date, time, selected_variable, face, values; inputs variable: Int32, dir: Int32, base_point: Point3d, run_it: Boolean
# ---------- morpho_read_building_facades: Python ----------
# Morpho: A plugin to write Envimet 2.5D models.
# This file is part of Morpho project.
#
# Copyright (c) 2020, Antonello Di Nunzio <antonellodinunzio@gmail.com>.
# You should have received a copy of the GNU General Public License
# along with Morpho project; If not, see <http://www.gnu.org/licenses/>.
# 
# @license GPL-3.0+ <http://spdx.org/licenses/GPL-3.0+>

"""
Read EDT files of dynamic output of buildings
-
Compatible edt files come from
. Building\dynamic -> facade dir X, Y, Z
. SolarAccess SAFAC -> facade dir X, Y, Z
-
You can use native component of Grasshopper to set the color of the pixels 
OR you can use 'recolor mesh' component of Ladybug[+] or Ladybug Legacy to use lots of additional features for visualization.
    Args:
        _edt: File path of EDT binary file [string].
        _variable_: Index of the variable to read [integer].
        -
        Connect a panel to 'variables' output to see all available variables
        AND a panel to 'selected_variable' to see the current one.
        _dir_: Connect an integer to set the direction of the facades to read [integer]. Default is 0.
        0 = X
        1 = Y
        2 = Z
        base_point_: Lower left corner of the grid. Default value is point at 0,0,0. Connect a Rhino point to change it [Point3d].
        min_: A number representing the lower boundary to filter data [float]. 
        max_: A number representing the upper boundary to filter data [float]. 
        _run_it: Set it to 'True' to get face and values.
    
    Returns:
        read_me: Message for users.
        variables: All available variable you can read. Check the index to use with _variable_ input.
        project_name: Name of the current envimet project.
        date: Simulation date.
        time: Simulation time.
        selected_variable: Name of the current variable.
        face: List of face object to parse. It contains geometry information.
        values: Values for each face.
"""

ghenv.Component.Name = "Morpho Read Building Facades"
ghenv.Component.NickName = "morpho_read_building_facades"
ghenv.Component.Category = "Morpho"
ghenv.Component.SubCategory = "1 || IO"
try: ghenv.Component.AdditionalHelpFromDocStrings = "3"
except: pass

import scriptcontext as sc
import os
import sys
import clr
##################Envimet INX####################
from System.Collections.Generic import *
try:
    user_path = os.getenv("APPDATA")
    sys.path.append(os.path.join(user_path, "Morpho"))
    clr.AddReferenceToFile("MorphoReader.dll")
    clr.AddReferenceToFile("MorphoRhino.dll")
    from MorphoReader import GridOutput, BuildingOutput, Direction, Facade
    from MorphoRhino.RhinoAdapter import RhinoConvert
    
except ImportError as e:
    raise ImportError("\nFailed to import Morpho: {0}\n\nCheck your 'Morpho' folder in {1}".format(e, os.getenv("APPDATA")))
################################################
ghenv.Component.Message = "1.0.1 2.5D/3D"

def get_file_path(path):
    
    file, extension = os.path.splitext(path)
    
    return path, file + ".EDX"


def main():
    
    if _edt:
        
        edt, edx = get_file_path(_edt)
        
        variable = 1 if _variable_ == None else _variable_
        
        if _dir_ == 1:
            dir = Direction.Y
        elif _dir_ == 2:
            dir = Direction.Z
        else:
            dir = Direction.X
        
        if base_point_:
            origin = RhinoConvert.FromRhPointToVector(base_point_)
            output = BuildingOutput(edx, origin)
        else:
            output = BuildingOutput(edx)
        
        project_name = output.ProjectName
        date = output.SimulationDate
        time = output.SimulationTime
        variables = output.VariableName
        selected_variable = output.VariableName[variable]
        
        print("Grid: {0}, {1}, {2}".format(output.NumX, output.NumY, output.NumZ))
        
        if output.DataContent not in [7, 10]:
            print("Please, connect a file of dynamic output of buildings or solaraccess SAFAC.")
            return [None] * 7
        
        if _run_it:
            
            facades = output.GetFacades(dir)
            output.SetValuesFromBinary(edt, facades, variable)
            
            # filter
            facades = Facade.GetFacadesByDirection(facades, dir)
            if min_ != None and max_ != None:
                facades = Facade.GetFacadesByThreshold(facades, min_, max_, dir)
            
            # get values from facades
            if _dir_ == 1:
                values = Facade.GetValueYFromFacades(facades)
            elif _dir_ == 2:
                values = Facade.GetValueZFromFacades(facades)
            else:
                values = Facade.GetValueXFromFacades(facades)
            # get geometry
            face = Facade.GetFacesFromFacades(facades)
            
            return variables, project_name, date, time, selected_variable, face, values
            
        return variables, project_name, date, time, selected_variable, None, None
    else:
        return [None] * 7


if not _edt:
    print("Please, connect _edt and check available outputs using panels.")
else:
    variables, project_name, date, time, selected_variable, face, values = main()
# ---------- end morpho_read_building_facades ----------

# ----
crv_selector = Curve(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)
morpho_from_face_to_rhinomesh = MorphoFromFaceToRhinoMesh(face=morpho_read_building_facades.face)  # -> read_me, rh_mesh; inputs face: list
# ---------- morpho_from_face_to_rhinomesh: Python ----------
# Morpho: A plugin to write Envimet models.
# This file is part of Morpho project.
#
# Copyright (c) 2022, Antonello Di Nunzio <antonellodinunzio@gmail.com>.
# You should have received a copy of the GNU General Public License
# along with Morpho project; If not, see <http://www.gnu.org/licenses/>.
# 
# @license AGPL-3.0-or-later <https://spdx.org/licenses/AGPL-3.0-or-later>

"""
From Morpho Face to Rhino mesh.
-
Icon made by Freepik <https://www.flaticon.com/authors/freepik>.
See license for more details.
    Args:
        _face: Morpho Face [list Face]
    
    Returns:
        read_me: Message for users.
        rh_mesh: Rhino mesh.
"""

ghenv.Component.Name = "Morpho From Face To RhinoMesh"
ghenv.Component.NickName = "morpho_from_face_to_rhinomesh"
ghenv.Component.Category = "Morpho"
ghenv.Component.SubCategory = "0 || Geometry"
try: ghenv.Component.AdditionalHelpFromDocStrings = "1"
except: pass

import scriptcontext as sc
import os
import sys
import clr
################### Morpho #####################
try:
    user_path = os.getenv("APPDATA")
    sys.path.append(os.path.join(user_path, "Morpho"))
    clr.AddReferenceToFile("MorphoGeometry.dll")
    clr.AddReferenceToFile("MorphoRhino.dll")
    from MorphoRhino.RhinoAdapter import RhinoConvert
    from MorphoGeometry import Face
    
except ImportError as e:
    raise ImportError("\nFailed to import Morpho: {0}\n\nCheck your 'Morpho' folder in {1}".format(e, os.getenv("APPDATA")))
################################################
ghenv.Component.Message = "1.1.0"

from System.Collections.Generic import *

def main():
    return RhinoConvert.FromFacesToMesh(List[Face](_face))

if _face == [None] or _face == []: 
    print("Please, connect _face.")
else:
    rh_mesh = main()
# ---------- end morpho_from_face_to_rhinomesh ----------
morpho_from_face_to_rhinobrep = MorphoFromFaceToRhinoBrep(face=morpho_read_building_facades.face)  # -> read_me, rh_brep; inputs face: list
# ---------- morpho_from_face_to_rhinobrep: Python ----------
# Morpho: A plugin to write Envimet models.
# This file is part of Morpho project.
#
# Copyright (c) 2022, Antonello Di Nunzio <antonellodinunzio@gmail.com>.
# You should have received a copy of the GNU General Public License
# along with Morpho project; If not, see <http://www.gnu.org/licenses/>.
# 
# @license AGPL-3.0-or-later <https://spdx.org/licenses/AGPL-3.0-or-later>

"""
From Morpho Face to Rhino brep.
-
Icon made by Freepik <https://www.flaticon.com/authors/freepik>.
See license for more details.
    Args:
        _face: Morpho Face [list Face]
    
    Returns:
        read_me: Message for users.
        rh_brep: Rhino brep.
"""

ghenv.Component.Name = "Morpho From Face To RhinoBrep"
ghenv.Component.NickName = "morpho_from_face_to_rhinobrep"
ghenv.Component.Category = "Morpho"
ghenv.Component.SubCategory = "0 || Geometry"
try: ghenv.Component.AdditionalHelpFromDocStrings = "1"
except: pass

import scriptcontext as sc
import os
import sys
import clr
################### Morpho #####################
try:
    user_path = os.getenv("APPDATA")
    sys.path.append(os.path.join(user_path, "Morpho"))
    clr.AddReferenceToFile("MorphoGeometry.dll")
    clr.AddReferenceToFile("MorphoRhino.dll")
    from MorphoRhino.RhinoAdapter import RhinoConvert
    from MorphoGeometry import Face
    
except ImportError as e:
    raise ImportError("\nFailed to import Morpho: {0}\n\nCheck your 'Morpho' folder in {1}".format(e, os.getenv("APPDATA")))
################################################
ghenv.Component.Message = "1.1.0"

import Rhino as rc

def main():
    
    surface = []
    
    pt1 = [RhinoConvert.FromVectorToRhPoint(face.A) for face in _face]
    pt2 = [RhinoConvert.FromVectorToRhPoint(face.B) for face in _face]
    pt3 = [RhinoConvert.FromVectorToRhPoint(face.C) for face in _face]
    pt4 = [RhinoConvert.FromVectorToRhPoint(face.D) for face in _face]
    
    
    for p1, p2, p3, p4 in zip(pt1, pt2, pt3, pt4):
        surface.append(rc.Geometry.Brep.CreateFromCornerPoints(p1, p2, p3, p4, 0.01))
    
    return surface

if _face == [None] or _face == []: 
    print("Please, connect _face.")
else:
    rh_brep = main()
# ---------- end morpho_from_face_to_rhinobrep ----------

panel_2 = Panel(morpho_read_building_facades.read_me)
panel_3 = Panel(morpho_read_building_facades.time)
panel_4 = Panel(morpho_read_building_facades.date)
panel_5 = Panel(morpho_read_building_facades.variables)

faceb = FaceBoundaries(Mesh=morpho_from_face_to_rhinomesh.rh_mesh)

# ---- group: Selection
area = Area(Geometry=morpho_from_face_to_rhinobrep.rh_brep)  # -> Area, Centroid
incurve = PointInCurve(Point=area.Centroid, Curve=crv_selector)  # -> Relationship, Point
cull = CullPattern(List=morpho_read_building_facades.values, CullPattern=incurve.Relationship)
cull_2 = CullPattern(List=morpho_from_face_to_rhinobrep.rh_brep, CullPattern=incurve.Relationship)
mesh_uv = MeshSurface(Surface=cull_2, UCount="1", VCount="1", Overhang=True, Equalize=False)

# ----
merge = Merge(Data1=flatten(cull))
merge_2 = Merge(Data1=flatten(mesh_uv))
mjoin = MeshJoin(Meshes=flatten(merge_2))

flatten = FlattenTree(Tree=merge, Path="{0}")
pt = Point(Point(108.3539609, 15.50906764, 0))
bnd = Bounds(Numbers=flatten)
colrange = LBColorRange(index="15")  # -> colors; plug-in component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
dedomain = DeconstructDomain(Domain=bnd)  # -> Start, End
legendpar = LBLegendParameters(min=dedomain.Start, max=dedomain.End, colors=colrange, base_plane=pt)  # -> leg_par; plug-in component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

heatmap = LBSpatialHeatmap(values=merge, mesh=mjoin, legend_par=legendpar)  # -> mesh, legend, title, colors, legend_par; plug-in component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
