# Grasshopper definition morpho_utci.gh (Grasshopper 1.0.7)
# Copyright: Coprat

# ----
# Morpho 1.0.1
# 
# Morpho UTCI
# ++++++++++++++++++++++++++++
# Requirements:
# - Rhino6/Rhino7
# - Morpho
# - Ladybug Tools
# ++++++++++++++++++++++++++++
# Author: Antonello Di Nunzio
# www.antonellodinunzio.online
# License: GPL V.3.0+
python = GhPythonScript()  # -> main_folder
# ---------- python: Python ----------
"""Get current path - for examples only"""

__author__ = "antonellodinunzio"

import os

file_name = ghenv.Component.OnPingDocument().FilePath

main_folder = os.path.join(os.path.dirname(file_name), "output")
# ---------- end python ----------
# Read binary results
# 1
morpho_output_comfort_folder = MorphoOutputComfortFolder(output_folder=python)  # -> read_me, atmosphere, PET, PMV, SET, UTCI
# ---------- morpho_output_comfort_folder: Python ----------
# Morpho: A plugin to write Envimet 2.5D models.
# This file is part of Morpho project.
#
# Copyright (c) 2022, Antonello Di Nunzio <antonellodinunzio@gmail.com>.
# You should have received a copy of the GNU General Public License
# along with Morpho project; If not, see <http://www.gnu.org/licenses/>.
# 
# @license GPL-3.0+ <http://spdx.org/licenses/GPL-3.0+>

"""
Read and sort all comfort metric binaries of an output folder of envimet.
-
You have to use Biomet to generate UTCI, PMV, SET and PET output.
    Args:
        _output_folder: File path of the output folder of envimet [string].
    
    Returns:
        read_me: Message for users.
        atmosphere: Atmosphere binaries (edt).
        UTCI: Universal Thermal Climate Index in degrees Celcius. 
        PET: Physiological Equivalent Temperature in degrees Celcius.
        SET: Standard Effective Temperature (SET) in degrees Celcius.
        PMV: Predicted Mean Vote.
"""

ghenv.Component.Name = "Morpho Output Comfort Folder"
ghenv.Component.NickName = "morpho_output_comfort_folder"
ghenv.Component.Category = "Morpho"
ghenv.Component.SubCategory = "3 || IO"
try: ghenv.Component.AdditionalHelpFromDocStrings = "1"
except: pass
ghenv.Component.Message = "1.0.1 2.5D/3D"

import os

if _output_folder:
    directory = os.listdir(_output_folder)
    
    folder_to_search = ['atmosphere', 'biomet']
    
    path = [os.path.join(_output_folder, f) for f in directory 
            if str.lower(f) in folder_to_search]
    
    result = {}
    for p in path:
        
        if os.path.basename(p) == 'biomet':
            subdir = os.listdir(p)
            if 'PMV' in subdir:
                path.append(p + '\\PMV')
            if 'PET' in subdir:
                path.append(p + '\\PET')
            if 'SET' in subdir:
                path.append(p + '\\SET')
            if 'UTCI' in subdir:
                path.append(p + '\\UTCI')
        
        result[os.path.basename(p)] = sorted([os.path.join(p, f) for f in os.listdir(p) 
                                             if f.endswith(".EDT") 
                                             and 'First Flow Field'not in f
                                             and 'initialisation' not in f])
    
    if 'atmosphere' in result:
        atmosphere = result['atmosphere']
    if 'PET' in result:
        PET = result['PET']
    if 'PMV' in result:
        PMV = result['PMV']
    if 'SET' in result:
        SET = result['SET']
    if 'UTCI' in result:
        UTCI = result['UTCI']
else:
    print 'Please connect the full path of an envimet output folder'
# ---------- end morpho_output_comfort_folder ----------

number_slider = Slider(0, range=0..2)

item = ListItem(List=morpho_output_comfort_folder.UTCI, Index=number_slider, Wrap=True)
item_2 = ListItem(List=morpho_output_comfort_folder.atmosphere, Index=number_slider, Wrap=True)

# ---- group: 2
toggle = BooleanToggle(False)

# ---- group: 1
toggle_2 = BooleanToggle(False)

# ---- group: 3
toggle_3 = BooleanToggle(True)

# ----
# Using Biomet
# I have calculated BIOMET UTCI only at slice 3 (z).
direction_z = Panel("2")
slice_index = Panel("3")
from = Panel("21")
to = Panel("999")
morpho_read_grid_slice = MorphoReadGridSlice(edt=item, dir=direction_z, index=slice_index, min=from, max=to, run_it=toggle_2)  # -> read_me, variables, project_name, date, time, selected_variable, face, values; inputs variable: Int32, dir: Int32, index: Int32, base_point: Point3d, run_it: Boolean
# ---------- morpho_read_grid_slice: Python ----------
# Morpho: A plugin to write Envimet models.
# This file is part of Morpho project.
#
# Copyright (c) 2023, Antonello Di Nunzio <antonellodinunzio@gmail.com>.
# You should have received a copy of the GNU General Public License
# along with Morpho project; If not, see <http://www.gnu.org/licenses/>.
# 
# @license AGPL-3.0-or-later <https://spdx.org/licenses/AGPL-3.0-or-later>

"""
Read EDT grid slice in X, Y or Z direction.
-
Compatible edt files come from
. Atmosphere -> slice dir X, Y, Z
. Surface -> slice dir Z only z0
. Soil -> slice dir Z
. Pollutants -> slice dir X, Y, Z
. Radiation -> slice dir X, Y, Z
. SolarAccess SA -> slice dir Z only z0
. Comfort (UTCI, PET, SET, PMV) -> slice dir X, Y, Z
-
You can use native component of Grasshopper to set the color of the pixels 
OR you can use 'recolor mesh' component of Ladybug[+] or Ladybug Legacy to use lots of additional features for visualization.
    Args:
        _edt: File path of EDT binary file [string].
        _variable_: Index of the variable to read [integer].
        -
        Connect a panel to 'variables' output to see all available variables
        AND a panel to 'selected_variable' to see the current one.
        _dir_: Connect an integer to set the direction of the section plane [integer]. Default is 0.
        0 = X
        1 = Y
        2 = Z
        _index_: Index of the slice to read in X or Y or Z [integer].
        -
        Connect a panel to read_me to check how many cells there are.
        min_: A number representing the lower boundary to filter data [float]. 
        max_: A number representing the upper boundary to filter data [float]. 
        base_point_: Lower left corner of the grid. Default value is point at 0,0,0. Connect a Rhino point to change it [Point3d].
        _run_it: Set it to 'True' to get face and values.
    
    Returns:
        read_me: Message for users.
        variables: All available variable you can read. Check the index to use with _variable_ input.
        project_name: Name of the current envimet project.
        date: Simulation date.
        time: Simulation time.
        selected_variable: Name of the current variable.
        face: List of face object to parse. It contains geometry information.
        values: Values for each face.
"""

ghenv.Component.Name = "Morpho Read Grid Slice"
ghenv.Component.NickName = "morpho_read_grid_slice"
ghenv.Component.Category = "Morpho"
ghenv.Component.SubCategory = "1 || IO"
try: ghenv.Component.AdditionalHelpFromDocStrings = "3"
except: pass

import scriptcontext as sc
import os
import sys
import clr
##################Envimet INX####################
from System.Collections.Generic import *
try:
    user_path = os.getenv("APPDATA")
    sys.path.append(os.path.join(user_path, "Morpho"))
    clr.AddReferenceToFile("MorphoReader.dll")
    clr.AddReferenceToFile("MorphoRhino.dll")
    from MorphoReader import GridOutput, Direction, Voxel
    from MorphoRhino.RhinoAdapter import RhinoConvert
    
except ImportError as e:
    raise ImportError("\nFailed to import Morpho: {0}\n\nCheck your 'Morpho' folder in {1}".format(e, os.getenv("APPDATA")))
################################################
ghenv.Component.Message = "1.1.2"

def get_file_path(path):
    
    file, extension = os.path.splitext(path)
    
    return path, file + ".EDX"


def main():
    
    if _edt:
        
        edt, edx = get_file_path(_edt)
        
        variable = 1 if _variable_ == None else _variable_
        index = 0 if _index_ == None else _index_
        
        if _dir_ == 1:
            dir = Direction.Y
        elif _dir_ == 2:
            dir = Direction.Z
        else:
            dir = Direction.X
        
        if base_point_:
            origin = RhinoConvert.FromRhPointToVector(base_point_)
            output = GridOutput(edx, origin)
        else:
            output = GridOutput(edx)
        
        project_name = output.ProjectName
        date = output.SimulationDate
        time = output.SimulationTime
        variables = output.VariableName
        selected_variable = output.VariableName[variable]
        
        print("Grid: {0}, {1}, {2}".format(output.NumX, output.NumY, output.NumZ))
        
        if output.DataContent not in [1, 2, 3, 4, 5, 8, 11]:
            print("Please, connect an edt file.\nYou can read Atmosphere, Surface, Soil, Pollutants, Radiation, SolarAccess, Comfort")
            return [None] * 7
        
        if _run_it:
            
            # Surface
            if output.DataContent in [2, 8]:
                index = 0
                dir = Direction.Z
            elif output.DataContent == 3:
                dir = Direction.Z
            
            voxels = output.GetVoxels(dir)
            output.SetValuesFromBinary(edt, voxels, variable)
            
            # filter
            voxels = Voxel.GetSliceByPixelCoordinate(voxels, index, dir)
            if min_ != None and max_ != None:
                voxels = Voxel.GetVoxelsByThreshold(voxels, min_, max_)
            
            # get values from voxels
            values = Voxel.GetValueZFromVoxels(voxels)
            
            # get geometry
            face = Voxel.GetFacesFromVoxels(voxels)
            
            return variables, project_name, date, time, selected_variable, face, values
            
        return variables, project_name, date, time, selected_variable, None, None
    else:
        return [None] * 7


if not _edt:
    print("Please, connect a compatible _edt and check available outputs using panels.")
else:
    variables, project_name, date, time, selected_variable, face, values = main()
# ---------- end morpho_read_grid_slice ----------
morpho_from_face_to_rhinomesh = MorphoFromFaceToRhinoMesh(face=morpho_read_grid_slice.face)  # -> read_me, rh_mesh; inputs face: list
# ---------- morpho_from_face_to_rhinomesh: Python ----------
# Morpho: A plugin to write Envimet 2.5D models.
# This file is part of Morpho project.
#
# Copyright (c) 2020, Antonello Di Nunzio <antonellodinunzio@gmail.com>.
# You should have received a copy of the GNU General Public License
# along with Morpho project; If not, see <http://www.gnu.org/licenses/>.
# 
# @license GPL-3.0+ <http://spdx.org/licenses/GPL-3.0+>

"""
From Morpho Face to Rhino mesh.
-
Icon made by Freepik <https://www.flaticon.com/authors/freepik>.
See license for more details.
    Args:
        _face: Morpho Face [list Face]
    
    Returns:
        read_me: Message for users.
        rh_mesh: Rhino mesh.
"""

ghenv.Component.Name = "Morpho From Face To RhinoMesh"
ghenv.Component.NickName = "morpho_from_face_to_rhinomesh"
ghenv.Component.Category = "Morpho"
ghenv.Component.SubCategory = "0 || Geometry"
try: ghenv.Component.AdditionalHelpFromDocStrings = "1"
except: pass

import scriptcontext as sc
import os
import sys
import clr
################### Morpho #####################
try:
    user_path = os.getenv("APPDATA")
    sys.path.append(os.path.join(user_path, "Morpho"))
    clr.AddReferenceToFile("MorphoGeometry.dll")
    clr.AddReferenceToFile("MorphoRhino.dll")
    from MorphoRhino.RhinoAdapter import RhinoConvert
    from MorphoGeometry import Face
    
except ImportError as e:
    raise ImportError("\nFailed to import Morpho: {0}\n\nCheck your 'Morpho' folder in {1}".format(e, os.getenv("APPDATA")))
################################################
ghenv.Component.Message = "1.0.1 2.5D"

from System.Collections.Generic import *

def main():
    return RhinoConvert.FromFacesToMesh(List[Face](_face))

if _face == [None] or _face == []: 
    print("Please, connect _face.")
else:
    rh_mesh = main()
# ---------- end morpho_from_face_to_rhinomesh ----------

panel = Panel(morpho_read_grid_slice.read_me)
panel_2 = Panel(morpho_read_grid_slice.variables)
panel_3 = Panel(morpho_read_grid_slice.date)
panel_4 = Panel(morpho_read_grid_slice.time)
panel_5 = Panel(morpho_read_grid_slice.selected_variable)

colrange = LBColorRange(index="15")  # -> colors; plug-in component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
legendpar = LBLegendParameters(min="32", max="38", colors=colrange)  # -> leg_par; plug-in component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

heatmap = LBSpatialHeatmap(
    values=morpho_read_grid_slice.values,
    mesh=morpho_from_face_to_rhinomesh.rh_mesh,
    legend_par=legendpar,
    legend_title=morpho_read_grid_slice.selected_variable,
    global_title=morpho_read_grid_slice.time)  # -> mesh, legend, title, colors, legend_par; plug-in component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

bang = ExplodeTree(Data=heatmap.legend)
data = Data([heatmap.mesh, heatmap.title])

# ----
# Using LBT
# You can use this trick: a panel with more than one variable
# OR
# you can use more than one component to read each useful variable of the UTCI calc.
variables = Panel("""4
8
12
26""")
slice_index_2 = Panel("3")
direction_z_2 = Panel("2")
pt = Point(Point(163.515927, -0.542582612, 0))
morpho_read_grid_slice_2 = MorphoReadGridSlice(edt=item_2, variable=variables, dir=direction_z_2, index=slice_index_2, base_point=pt, run_it=toggle)  # -> read_me, variables, project_name, date, time, selected_variable, face, values; inputs variable: Int32, dir: Int32, index: Int32, base_point: Point3d, run_it: Boolean; same code as morpho_read_grid_slice
morpho_from_face_to_rhinomesh_2 = MorphoFromFaceToRhinoMesh(face=morpho_read_grid_slice_2.face)  # -> read_me, rh_mesh; inputs face: list; same code as morpho_from_face_to_rhinomesh
bang_2 = ExplodeTree(Data=morpho_read_grid_slice_2.values)  # -> Branch0, Branch1, Branch2, Branch3
bang_3 = ExplodeTree(Data=morpho_from_face_to_rhinomesh_2.rh_mesh)

panel_6 = Panel(morpho_read_grid_slice_2.variables)
panel_7 = Panel(morpho_read_grid_slice_2.time)
# OR
panel_8 = Panel(morpho_read_grid_slice_2.read_me)
panel_9 = Panel(morpho_read_grid_slice_2.selected_variable)

# ---- group: wind speed at 10 m
eval = Evaluate(F="v * ln(10/z0) / ln(z/z0)", v=bang_2.Branch0, z0="0.01", z="1.20")

# ----
colrange_2 = LBColorRange(index="15")  # -> colors; plug-in component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
legendpar_2 = LBLegendParameters(min="32", max="38", colors=colrange_2)  # -> leg_par; plug-in component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

utci = LBUTCIComfort(air_temp=bang_2.Branch1, mrt=bang_2.Branch3, rel_humid=bang_2.Branch2, wind_vel=eval, run=toggle_3)  # -> report, utci, comfort, condition, category, comf_obj; plug-in component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
heatmap_2 = LBSpatialHeatmap(values=utci.utci, mesh=bang_3, legend_par=legendpar_2, legend_title="UTCI(°C)")  # -> mesh, legend, title, colors, legend_par; plug-in component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

bang_4 = ExplodeTree(Data=heatmap_2.legend)
data_2 = Data(heatmap_2.mesh)
