# Grasshopper definition 05-modeling-create_plant3D.gh (Grasshopper 1.0.7)
# Copyright: Coprat

# ---- group: Geometries
points = Point([Point(47, 24, 0), Point(82, 75, 0), Point(117, 33, 0), Point(175, 94, 0)])
morpho_point = MorphoPoint(point=points)  # -> out, inx_point; inputs point: list of Point3d
# ---------- morpho_point: Python ----------
# Morpho: A plugin to write Envimet 2.5D models.
# This file is part of Morpho project.
#
# Copyright (c) 2023, Antonello Di Nunzio <plugin@antonellodinunzio.online>.
# You should have received a copy of the GNU General Public License
# along with Morpho project; If not, see <http://www.gnu.org/licenses/>.
# 
# @license AGPL-3.0-or-later <https://spdx.org/licenses/AGPL-3.0-or-later>

"""
Construct a Inx Point to use with Envimet Entities.
-
Icon made by Freepik <https://www.flaticon.com/authors/freepik>.
See license for more details.
    Args:
        _point: Rhino point [list Point3d]
    
    Returns:
        read_me: Message for users.
        inx_point: Inx Point to use with Envimet Entities.
"""

ghenv.Component.Name = "Morpho Point"
ghenv.Component.NickName = "morpho_point"
ghenv.Component.Category = "Morpho"
ghenv.Component.SubCategory = "0 || Geometry"
try: ghenv.Component.AdditionalHelpFromDocStrings = "1"
except: pass

import scriptcontext as sc
import os
import sys
import clr
################### Morpho #####################
try:
    user_path = os.getenv("APPDATA")
    sys.path.append(os.path.join(user_path, "Morpho"))
    clr.AddReferenceToFile("MorphoRhino.dll")
    from MorphoRhino.RhinoAdapter import RhinoConvert
    
except ImportError as e:
    raise ImportError("\nFailed to import Morpho: {0}\n\nCheck your 'Morpho' folder in {1}".format(e, os.getenv("APPDATA")))
################################################
ghenv.Component.Message = "2.0.0"

def main():
    
    if _point != None:
        
        inx_point = [RhinoConvert.FromRhPointToVector(pt) for pt in _point]
        
        return inx_point
    else:
        return

inx_point = main()
if not _point: print("Please, connect _point.")
# ---------- end morpho_point ----------

# ---- group: Material - CONNECT INX_WORKSPACE
morpho_library = MorphoLibrary(type="plant3d", keyword="Maple")  # -> out, code, description, XML; inputs systemDB: Boolean
# ---------- morpho_library: Python ----------
# Morpho: A plugin to write Envimet models.
# This file is part of Morpho project.
#
# Copyright (c) 2023, Antonello Di Nunzio <plugin@antonellodinunzio.online>.
# You should have received a copy of the GNU General Public License
# along with Morpho project; If not, see <http://www.gnu.org/licenses/>.
# 
# @license AGPL-3.0-or-later <https://spdx.org/licenses/AGPL-3.0-or-later>

"""
Read Envimet materials.
-
You can connect 'code' to customize inx object materials.
    Args:
        _inx_workspace:  Workspace of your current project.
        _type_: Type of material to read. Write one of following string
        profile
        soil
        material
        wall
        source
        plant
        plant3d
        greening
        -
        Default value is 'profile'.
        _keyword_: Connect a string to filter library. E.g. asphalt [string].
        systemDB_: Set it 'True' to use system database.
        If you set 'False' user or profile library will be used. Default is 'True' [bool].
    
    Returns:
        read_me: Message for users.
        code: Material code to use with inx_objects.
        description: Material description.
        XML: XML detail of material.
"""

ghenv.Component.Name = "Morpho Library"
ghenv.Component.NickName = "morpho_library"
ghenv.Component.Category = "Morpho"
ghenv.Component.SubCategory = "1 || Settings"
try: ghenv.Component.AdditionalHelpFromDocStrings = "1"
except: pass

import scriptcontext as sc
import os
import sys
import clr
################### Morpho #####################
try:
    user_path = os.getenv("APPDATA")
    sys.path.append(os.path.join(user_path, "Morpho"))
    clr.AddReferenceToFile("Morpho25.dll")
    from Morpho25.Management import Workspace
    from Morpho25.IO import Library
    
except ImportError as e:
    raise ImportError("\nFailed to import Morpho: {0}\n\nCheck your 'Morpho' folder in {1}".format(e, os.getenv("APPDATA")))
################################################
ghenv.Component.Message = "2.0.0"

def main():
    
    if systemDB_ == None:
        systemDB = True
    else:
        systemDB = systemDB_
    
    type = _type_.upper() if _type_ else Library.PROFILE
    
    alternative_lib = _inx_workspace.UserDB if _inx_workspace.UserDB else _inx_workspace.ProjectDB
    lib = _inx_workspace.SystemDB if systemDB else alternative_lib
    
    library = Library(lib, type, _keyword_)
    
    return library.Code, library.Description, library.Detail

if not _inx_workspace:
    print("Please, connect _inx_workspace.")
else:
    code, description, XML = main()
# ---------- end morpho_library ----------
item = ListItem(List=morpho_library.code, Index=0, Wrap=True)

# ---- group: Plant3D
morpho_plant3d = MorphoPlant3d(inx_point=flatten(morpho_point.inx_point), name="MyPlant3D", code=item)  # -> out, inx_plant3d; inputs inx_point: list
# ---------- morpho_plant3d: Python ----------
# Morpho: A plugin to write Envimet models.
# This file is part of Morpho project.
#
# Copyright (c) 2023, Antonello Di Nunzio <plugin@antonellodinunzio.online>.
# You should have received a copy of the GNU General Public License
# along with Morpho project; If not, see <http://www.gnu.org/licenses/>.
# 
# @license AGPL-3.0-or-later <https://spdx.org/licenses/AGPL-3.0-or-later>

"""
Construct an Inx Plant3d.
    Args:
        _inx_point: Inx Point.
        _name_: Optional name to give to plant3d group [string].
        _code_: Code of material to apply to plant3d [string]. E.g. 0000C2.
        -
        Type of material to connect: plant3d
    
    Returns:
        read_me: Message for users.
        inx_plant3d: Inx Plant3d to use as input of 'Morpho Model' component.
"""

ghenv.Component.Name = "Morpho Plant3d"
ghenv.Component.NickName = "morpho_plant3d"
ghenv.Component.Category = "Morpho"
ghenv.Component.SubCategory = "2 || Entity"
try: ghenv.Component.AdditionalHelpFromDocStrings = "1"
except: pass

import scriptcontext as sc
import os
import sys
import clr
import Grasshopper.Kernel as gh
##################Envimet INX####################
try:
    user_path = os.getenv("APPDATA")
    sys.path.append(os.path.join(user_path, "Morpho"))
    clr.AddReferenceToFile("Morpho25.dll")
    from Morpho25.Geometry import Plant3d
    
except ImportError as e:
    raise ImportError("\nFailed to import Morpho: {0}\n\nCheck your 'Morpho' folder in {1}".format(e, os.getenv("APPDATA")))
################################################
ghenv.Component.Message = "2.0.0"

def main():
    trees = []
    if _inx_point:
        
        trees = [Plant3d(vec, _code_, _name_) for vec in _inx_point]
        
        return trees
    else:
        return

inx_plant3d = main()
if not inx_plant3d:
    w = gh.GH_RuntimeMessageLevel.Warning
    msg = "Please, connect _inx_point."
    ghenv.Component.AddRuntimeMessage(w, msg)
    print(msg)
# ---------- end morpho_plant3d ----------
