# Grasshopper definition modeling-create_2_building_group.gh (Grasshopper 1.0.7)
# Copyright: Coprat

# ---- group: Geometry
closed_mesh_or_brep = Brep([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])
morpho_facegroup = MorphoFacegroup(geometry=closed_mesh_or_brep)  # -> read_me, inx_facegroup; inputs geometry: list of Mesh
# ---------- morpho_facegroup: Python ----------
# Morpho: A plugin to write Envimet models.
# This file is part of Morpho project.
#
# Copyright (c) 2022, Antonello Di Nunzio <antonellodinunzio@gmail.com>.
# You should have received a copy of the GNU General Public License
# along with Morpho project; If not, see <http://www.gnu.org/licenses/>.
# 
# @license AGPL-3.0-or-later <https://spdx.org/licenses/AGPL-3.0-or-later>

"""
Construct a Inx Faces from rh mesh or brep to use with Envimet Entities.
-
Icon made by Freepik <https://www.flaticon.com/authors/freepik>.
See license for more details.
    Args:
        _geometry: Rhino mesh or brep [List or Item or Tree of Mesh]
    
    Returns:
        read_me: Message for users.
        inx_facegroup: Inx geometry (FaceGroup) to use with Envimet Entities.
        mesh: Rhino mesh for checking.
"""

ghenv.Component.Name = "Morpho Facegroup"
ghenv.Component.NickName = "morpho_facegroup"
ghenv.Component.Category = "Morpho"
ghenv.Component.SubCategory = "0 || Geometry"
try: ghenv.Component.AdditionalHelpFromDocStrings = "1"
except: pass

import scriptcontext as sc
import os
import sys
import clr
################### Morpho #####################
try:
    user_path = os.getenv("APPDATA")
    sys.path.append(os.path.join(user_path, "Morpho"))
    clr.AddReferenceToFile("MorphoRhino.dll")
    from MorphoRhino.RhinoAdapter import RhinoConvert
    
except ImportError as e:
    raise ImportError("\nFailed to import Morpho: {0}\n\nCheck your 'Morpho' folder in {1}".format(e, os.getenv("APPDATA")))
################################################
ghenv.Component.Message = "1.1.0"

def main():
    
    if _geometry != None:
        
        inx_facegroup = [RhinoConvert.FromRhMeshToFacegroup(geo) for geo in _geometry]
        
        return inx_facegroup
    else:
        return

inx_facegroup = main()
if not inx_facegroup: print("Please, connect _geometry.")
# ---------- end morpho_facegroup ----------
panel = Panel(morpho_facegroup.inx_facegroup)

closed_mesh_or_brep_2 = Brep([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])
morpho_facegroup_2 = MorphoFacegroup(geometry=closed_mesh_or_brep_2)  # -> read_me, inx_facegroup; inputs geometry: list of Mesh; same code as morpho_facegroup

# ---- group: Material
morpho_library = MorphoLibrary(type="wall", keyword="brick")  # -> read_me, code, description, XML; inputs systemDB: Boolean
# ---------- morpho_library: Python ----------
# Morpho: A plugin to write Envimet models.
# This file is part of Morpho project.
#
# Copyright (c) 2022, Antonello Di Nunzio <antonellodinunzio@gmail.com>.
# You should have received a copy of the GNU General Public License
# along with Morpho project; If not, see <http://www.gnu.org/licenses/>.
# 
# @license AGPL-3.0-or-later <https://spdx.org/licenses/AGPL-3.0-or-later>

"""
Read Envimet materials.
-
You can connect 'code' to customize inx object materials.
    Args:
        _inx_workspace:  Workspace of your current project.
        _type_: Type of material to read. Write one of following string
        profile
        soil
        material
        wall
        source
        plant
        plant3d
        greening
        -
        Default value is 'profile'.
        _keyword_: Connect a string to filter library. E.g. asphalt [string].
        systemDB_: Set it 'True' to use system database.
        If you set 'False' user or profile library will be used. Default is 'True' [bool].
    
    Returns:
        read_me: Message for users.
        code: Material code to use with inx_objects.
        description: Material description.
        XML: XML detail of material.
"""

ghenv.Component.Name = "Morpho Library"
ghenv.Component.NickName = "morpho_library"
ghenv.Component.Category = "Morpho"
ghenv.Component.SubCategory = "1 || Settings"
try: ghenv.Component.AdditionalHelpFromDocStrings = "1"
except: pass

import scriptcontext as sc
import os
import sys
import clr
################### Morpho #####################
try:
    user_path = os.getenv("APPDATA")
    sys.path.append(os.path.join(user_path, "Morpho"))
    clr.AddReferenceToFile("Morpho25.dll")
    from Morpho25.Management import Workspace
    from Morpho25.IO import Library
    
except ImportError as e:
    raise ImportError("\nFailed to import Morpho: {0}\n\nCheck your 'Morpho' folder in {1}".format(e, os.getenv("APPDATA")))
################################################
ghenv.Component.Message = "1.1.0"

def main():
    
    if systemDB_ == None:
        systemDB = True
    else:
        systemDB = systemDB_
    
    type = _type_.upper() if _type_ else Library.PROFILE
    
    alternative_lib = _inx_workspace.UserDB if _inx_workspace.UserDB else _inx_workspace.ProjectDB
    lib = _inx_workspace.SystemDB if systemDB else alternative_lib
    
    library = Library(lib, type, _keyword_)
    
    return library.Code, library.Description, library.Detail

if not _inx_workspace:
    print("Please, connect _inx_workspace.")
else:
    code, description, XML = main()
# ---------- end morpho_library ----------
item = ListItem(List=morpho_library.code, Index=0, Wrap=True)
morpho_building_mat = MorphoBuildingMaterial(wall_code=item)  # -> read_me, material
# ---------- morpho_building_mat: Python ----------
# Morpho: A plugin to write Envimet models.
# This file is part of Morpho project.
#
# Copyright (c) 2022, Antonello Di Nunzio <antonellodinunzio@gmail.com>.
# You should have received a copy of the GNU General Public License
# along with Morpho project; If not, see <http://www.gnu.org/licenses/>.
# 
# @license AGPL-3.0-or-later <https://spdx.org/licenses/AGPL-3.0-or-later>

"""
Construct material code to create a building material.
    Args:
        _wall_code_: Code of wall material [string]. E.g. 000000.
        -
        Type of material to connect: wall
        _roof_code_: Code of roof material [string]. E.g. 000000.
        -
        Type of material to connect: wall
        _green_wall_code_: Code of green wall material [string].
        -
        Type of material to connect: greening
        _green_roof_code_: Code of green roof material [string].
        -
        Type of material to connect: greening
    
    Returns:
        read_me: Message for users.
        material: Inx Building material.
"""

ghenv.Component.Name = "Morpho Building Material"
ghenv.Component.NickName = "morpho_building_mat"
ghenv.Component.Category = "Morpho"
ghenv.Component.SubCategory = "1 || Settings"
try: ghenv.Component.AdditionalHelpFromDocStrings = "2"
except: pass

import scriptcontext as sc
import os
import sys
import clr
##################Envimet INX####################
try:
    user_path = os.getenv("APPDATA")
    sys.path.append(os.path.join(user_path, "Morpho"))
    clr.AddReferenceToFile("Morpho25.dll")
    from Morpho25.Geometry import Building
    
except ImportError as e:
    raise ImportError("\nFailed to import Morpho: {0}\n\nCheck your 'Morpho' folder in {1}".format(e, os.getenv("APPDATA")))
################################################
ghenv.Component.Message = "1.1.0"

def main():
    
    material = Building.CreateMaterial(_wall_code_, _roof_code_, _green_wall_code_, _green_roof_code_)
    
    return material

material = main()
# ---------- end morpho_building_mat ----------

morpho_library_2 = MorphoLibrary(type="wall", keyword="glass")  # -> read_me, code, description, XML; inputs systemDB: Boolean; same code as morpho_library
item_2 = ListItem(List=morpho_library_2.code, Index=0, Wrap=True)
morpho_building_mat_2 = MorphoBuildingMaterial(wall_code=item_2)  # -> read_me, material; same code as morpho_building_mat

# ----
toggle = BooleanToggle(True)

# ---- group: Buildings
morpho_building = MorphoBuilding(
    inx_facegroup=flatten(morpho_facegroup.inx_facegroup),
    ID="1",
    name="MyBuildingGroup",
    material=morpho_building_mat_2.material,
    enable_BPS=Toggle(False),
    run=toggle)  # -> read_me, inx_building, id_count; inputs inx_facegroup: list, ID: Int32, enable_BPS: Boolean, run: Boolean
# ---------- morpho_building: Python ----------
# Morpho: A plugin to write Envimet models.
# This file is part of Morpho project.
#
# Copyright (c) 2022, Antonello Di Nunzio <antonellodinunzio@gmail.com>.
# You should have received a copy of the GNU General Public License
# along with Morpho project; If not, see <http://www.gnu.org/licenses/>.
# 
# @license AGPL-3.0-or-later <https://spdx.org/licenses/AGPL-3.0-or-later>

"""
Construct an Inx Building.
-
Behavior:
The component will assign automatically IDs starting from _ID connected
    Args:
        _inx_grid: Inx Grid.
        _inx_facegroup: Inx Facegroup that represents a building <Item or List>.
        -
        If you connect a list of inx_facegroup ID will be added automatically.
        _ID: An integer to identify a building [integer].
        _name_: Optional name to give to building [string].
        _material_: Material to apply to buildings [Material]. Default material is 000000.
        -
        Use output of 'Morpho Building Material' component to change it.
        enable_BPS_: It enables Building Performance Simulation output [bool]. For business version only.
        _run: Set it to True to run it.
    
    Returns:
        read_me: Message for users.
        inx_building: Inx Building to use as input of 'Morpho Model' component.
        id_count: Connect this number to the _ID of another 'morpho_building' component to keep the correct ID order
"""

ghenv.Component.Name = "Morpho Building"
ghenv.Component.NickName = "morpho_building"
ghenv.Component.Category = "Morpho"
ghenv.Component.SubCategory = "2 || Entity"
try: ghenv.Component.AdditionalHelpFromDocStrings = "1"
except: pass


import scriptcontext as sc
import os
import sys
import clr
import Grasshopper.Kernel as gh
##################Envimet INX####################
try:
    user_path = os.getenv("APPDATA")
    sys.path.append(os.path.join(user_path, "Morpho"))
    clr.AddReferenceToFile("Morpho25.dll")
    from Morpho25.Geometry import Building
    
except ImportError as e:
    raise ImportError("\nFailed to import Morpho: {0}\n\nCheck your 'Morpho' folder in {1}".format(e, os.getenv("APPDATA")))
################################################
ghenv.Component.Message = "1.1.1"

def main():
    
    if _run and _inx_grid and _inx_facegroup and _ID:
        IDs = [i+_ID for i in xrange(len(_inx_facegroup))]
        
        building = [Building(_inx_grid, mesh, index, 
            _material_, _name_, enable_BPS_) for mesh, index in zip(_inx_facegroup, IDs)]
        
        return building
    else:
        return

inx_building = main()
if not inx_building:
    w = gh.GH_RuntimeMessageLevel.Warning
    msg = "Please, connect _inx_grid, _inx_facegroup, _ID, _run."
    ghenv.Component.AddRuntimeMessage(w, msg)
    print(msg)
if inx_building:
    id_count = len(inx_building) + 1
# ---------- end morpho_building ----------

panel_2 = Panel("1")
morpho_building_2 = MorphoBuilding(
    inx_facegroup=flatten(morpho_facegroup_2.inx_facegroup),
    ID=morpho_building.id_count,
    name="MyBuildingGroup",
    material=morpho_building_mat.material,
    enable_BPS=Toggle(False),
    run=toggle)  # -> read_me, inx_building, id_count; inputs inx_facegroup: list, ID: Int32, enable_BPS: Boolean, run: Boolean; same code as morpho_building
