# Grasshopper definition reading_results.gh (Grasshopper 1.0.7)
# Copyright: Coprat

number_slider = Slider(1, range=0..9)

# ---- group: Get output edt from folders
# Morpho 1.0.1
# 
# Reading results
# ++++++++++++++++++++++++++++
# Requirements:
# - Rhino6/Rhino7
# - Morpho
# - Ladybug [+]
# ++++++++++++++++++++++++++++
# Author: Antonello Di Nunzio
# www.antonellodinunzio.online
# License: GPL V.3.0+
# Read binary results
# move all binary EDT/EDX in the output folder
# OR
# write a simple python script to get binary files
python = GhPythonScript()  # -> atmosphere, buildings, radiation, soil, solaraccess, surface, vegetation
# ---------- python: Python ----------
"""Get current path - for examples only"""

__author__ = "antonellodinunzio"

import os

file_name = ghenv.Component.OnPingDocument().FilePath

main_folder = os.path.join(os.path.dirname(file_name), "output") 
directory = os.listdir(main_folder)
path = [os.path.join(main_folder, f) for f in directory]

result = []
for p in path:
    result.append([os.path.join(p, f) for f in os.listdir(p) if f.endswith(".EDT")])

atmosphere, buildings, radiation, soil, solaraccess, surface, vegetation = result
# ---------- end python ----------

# ----
item = ListItem(List=python.surface, Index=number_slider, Wrap=True)
item_2 = ListItem(List=python.vegetation, Index=number_slider, Wrap=True)
item_3 = ListItem(List=python.buildings, Index=number_slider, Wrap=True)

# ---- group: Facades
morpho_read_building_facades = MorphoReadBuildingFacades(edt=item_3, variable="1", run_it=Toggle(False))  # -> read_me, variables, project_name, date, time, selected_variable, face, values; inputs variable: Int32, dir: Int32, base_point: Point3d, run_it: Boolean
# ---------- morpho_read_building_facades: Python ----------
# Morpho: A plugin to write Envimet 2.5D models.
# This file is part of Morpho project.
#
# Copyright (c) 2020, Antonello Di Nunzio <antonellodinunzio@gmail.com>.
# You should have received a copy of the GNU General Public License
# along with Morpho project; If not, see <http://www.gnu.org/licenses/>.
# 
# @license GPL-3.0+ <http://spdx.org/licenses/GPL-3.0+>

"""
Read EDT files of dynamic output of buildings
-
Compatible edt files come from
. Building\dynamic -> facade dir X, Y, Z
. SolarAccess SAFAC -> facade dir X, Y, Z
-
You can use native component of Grasshopper to set the color of the pixels 
OR you can use 'recolor mesh' component of Ladybug[+] or Ladybug Legacy to use lots of additional features for visualization.
    Args:
        _edt: File path of EDT binary file [string].
        _variable_: Index of the variable to read [integer].
        -
        Connect a panel to 'variables' output to see all available variables
        AND a panel to 'selected_variable' to see the current one.
        _dir_: Connect an integer to set the direction of the facades to read [integer]. Default is 0.
        0 = X
        1 = Y
        2 = Z
        base_point_: Lower left corner of the grid. Default value is point at 0,0,0. Connect a Rhino point to change it [Point3d].
        min_: A number representing the lower boundary to filter data [float]. 
        max_: A number representing the upper boundary to filter data [float]. 
        _run_it: Set it to 'True' to get face and values.
    
    Returns:
        read_me: Message for users.
        variables: All available variable you can read. Check the index to use with _variable_ input.
        project_name: Name of the current envimet project.
        date: Simulation date.
        time: Simulation time.
        selected_variable: Name of the current variable.
        face: List of face object to parse. It contains geometry information.
        values: Values for each face.
"""

ghenv.Component.Name = "Morpho Read Building Facades"
ghenv.Component.NickName = "morpho_read_building_facades"
ghenv.Component.Category = "Morpho"
ghenv.Component.SubCategory = "1 || IO"
try: ghenv.Component.AdditionalHelpFromDocStrings = "3"
except: pass

import scriptcontext as sc
import os
import sys
import clr
##################Envimet INX####################
from System.Collections.Generic import *
try:
    user_path = os.getenv("APPDATA")
    sys.path.append(os.path.join(user_path, "Morpho"))
    clr.AddReferenceToFile("MorphoReader.dll")
    clr.AddReferenceToFile("MorphoRhino.dll")
    from MorphoReader import GridOutput, BuildingOutput, Direction, Facade
    from MorphoRhino.RhinoAdapter import RhinoConvert
    
except ImportError as e:
    raise ImportError("\nFailed to import Morpho: {0}\n\nCheck your 'Morpho' folder in {1}".format(e, os.getenv("APPDATA")))
################################################
ghenv.Component.Message = "1.0.1 2.5D/3D"

def get_file_path(path):
    
    file, extension = os.path.splitext(path)
    
    return path, file + ".EDX"


def main():
    
    if _edt:
        
        edt, edx = get_file_path(_edt)
        
        variable = 1 if _variable_ == None else _variable_
        
        if _dir_ == 1:
            dir = Direction.Y
        elif _dir_ == 2:
            dir = Direction.Z
        else:
            dir = Direction.X
        
        if base_point_:
            origin = RhinoConvert.FromRhPointToVector(base_point_)
            output = BuildingOutput(edx, origin)
        else:
            output = BuildingOutput(edx)
        
        project_name = output.ProjectName
        date = output.SimulationDate
        time = output.SimulationTime
        variables = output.VariableName
        selected_variable = output.VariableName[variable]
        
        print("Grid: {0}, {1}, {2}".format(output.NumX, output.NumY, output.NumZ))
        
        if output.DataContent not in [7, 10]:
            print("Please, connect a file of dynamic output of buildings or solaraccess SAFAC.")
            return [None] * 7
        
        if _run_it:
            
            facades = output.GetFacades(dir)
            output.SetValuesFromBinary(edt, facades, variable)
            
            # filter
            facades = Facade.GetFacadesByDirection(facades, dir)
            if min_ != None and max_ != None:
                facades = Facade.GetFacadesByThreshold(facades, min_, max_, dir)
            
            # get values from facades
            if _dir_ == 1:
                values = Facade.GetValueYFromFacades(facades)
            elif _dir_ == 2:
                values = Facade.GetValueZFromFacades(facades)
            else:
                values = Facade.GetValueXFromFacades(facades)
            # get geometry
            face = Facade.GetFacesFromFacades(facades)
            
            return variables, project_name, date, time, selected_variable, face, values
            
        return variables, project_name, date, time, selected_variable, None, None
    else:
        return [None] * 7


if not _edt:
    print("Please, connect _edt and check available outputs using panels.")
else:
    variables, project_name, date, time, selected_variable, face, values = main()
# ---------- end morpho_read_building_facades ----------
morpho_read_building_facades_2 = MorphoReadBuildingFacades(edt=item_3, variable="1", dir="1", run_it=Toggle(False))  # -> read_me, variables, project_name, date, time, selected_variable, face, values; inputs variable: Int32, dir: Int32, base_point: Point3d, run_it: Boolean; same code as morpho_read_building_facades
morpho_read_building_facades_3 = MorphoReadBuildingFacades(edt=item_3, variable="1", dir="2", run_it=Toggle(False))  # -> read_me, variables, project_name, date, time, selected_variable, face, values; inputs variable: Int32, dir: Int32, base_point: Point3d, run_it: Boolean; same code as morpho_read_building_facades

# ---- group: Trees
morpho_read_vegetation = MorphoReadVegetation(edt=item_2, variable="2", run_it=Toggle(False))  # -> read_me, variables, project_name, date, time, selected_variable, face, values; inputs variable: Int32, base_point: Point3d, run_it: Boolean
# ---------- morpho_read_vegetation: Python ----------
# Morpho: A plugin to write Envimet 2.5D models.
# This file is part of Morpho project.
#
# Copyright (c) 2020, Antonello Di Nunzio <antonellodinunzio@gmail.com>.
# You should have received a copy of the GNU General Public License
# along with Morpho project; If not, see <http://www.gnu.org/licenses/>.
# 
# @license GPL-3.0+ <http://spdx.org/licenses/GPL-3.0+>

"""
Read EDT files of dynamic output of vegetation
-
You can use native component of Grasshopper to set the color of the pixels 
OR you can use 'recolor mesh' component of Ladybug[+] or Ladybug Legacy to use lots of additional features for visualization.
    Args:
        _edt: File path of EDT binary file [string].
        _variable_: Index of the variable to read [integer].
        -
        Connect a panel to 'variables' output to see all available variables
        AND a panel to 'selected_variable' to see the current one.
        min_: A number representing the lower boundary to filter data [float]. 
        max_: A number representing the upper boundary to filter data [float]. 
        base_point_: Lower left corner of the grid. Default value is point at 0,0,0. Connect a Rhino point to change it [Point3d].
        _run_it: Set it to 'True' to get face and values.
    
    Returns:
        read_me: Message for users.
        variables: All available variable you can read. Check the index to use with _variable_ input.
        project_name: Name of the current envimet project.
        date: Simulation date.
        time: Simulation time.
        selected_variable: Name of the current variable.
        face: List of face object to parse. It contains geometry information.
        values: Values for each face.
"""

ghenv.Component.Name = "Morpho Read Vegetation"
ghenv.Component.NickName = "morpho_read_vegetation"
ghenv.Component.Category = "Morpho"
ghenv.Component.SubCategory = "1 || IO"
try: ghenv.Component.AdditionalHelpFromDocStrings = "3"
except: pass

import scriptcontext as sc
import os
import sys
import clr
##################Envimet INX####################
from System.Collections.Generic import *
try:
    user_path = os.getenv("APPDATA")
    sys.path.append(os.path.join(user_path, "Morpho"))
    clr.AddReferenceToFile("MorphoReader.dll")
    clr.AddReferenceToFile("MorphoRhino.dll")
    from MorphoReader import GridOutput, BuildingOutput, Direction, Facade
    from MorphoRhino.RhinoAdapter import RhinoConvert
    
except ImportError as e:
    raise ImportError("\nFailed to import Morpho: {0}\n\nCheck your 'Morpho' folder in {1}".format(e, os.getenv("APPDATA")))
################################################
ghenv.Component.Message = "1.0.1 2.5D/3D"

def get_file_path(path):
    
    file, extension = os.path.splitext(path)
    
    return path, file + ".EDX"


def main():
    
    if _edt:
        
        edt, edx = get_file_path(_edt)
        
        variable = 1 if _variable_ == None else _variable_
        
        if base_point_:
            origin = RhinoConvert.FromRhPointToVector(base_point_)
            output = GridOutput(edx, origin)
        else:
            output = GridOutput(edx)
        
        project_name = output.ProjectName
        date = output.SimulationDate
        time = output.SimulationTime
        variables = output.VariableName
        selected_variable = output.VariableName[variable]
        
        print("Grid: {0}, {1}, {2}".format(output.NumX, output.NumY, output.NumZ))
        
        if output.DataContent != 6:
            print("Please, connect a file of dynamic output of vegetation.")
            return [None] * 7
        
        if _run_it and output.DataContent == 6:
            
            dir = Direction.Z
            
            facades = output.GetFacades(dir)
            output.SetValuesFromBinary(edt, facades, variable)
            
            # filter
            facades = Facade.GetFacadesByDirection(facades, dir)
            if min_ != None and max_ != None:
                facades = Facade.GetFacadesByThreshold(facades, min_, max_)
            
            # get values
            values = Facade.GetValueZFromFacades(facades)
            
            # get geometry
            face = Facade.GetFacesFromFacades(facades)
            
            return variables, project_name, date, time, selected_variable, face, values
            
        return variables, project_name, date, time, selected_variable, None, None
    else:
        return [None] * 7


if not _edt:
    print("Please, connect _edt and check available outputs using panels.")
else:
    variables, project_name, date, time, selected_variable, face, values = main()
# ---------- end morpho_read_vegetation ----------

# ---- group: Grid
morpho_read_grid_slice = MorphoReadGridSlice(edt=item, variable="6", dir="2", run_it=Toggle(False))  # -> read_me, variables, project_name, date, time, selected_variable, face, values; inputs variable: Int32, dir: Int32, index: Int32, base_point: Point3d, run_it: Boolean
# ---------- morpho_read_grid_slice: Python ----------
# Morpho: A plugin to write Envimet 2.5D models.
# This file is part of Morpho project.
#
# Copyright (c) 2020, Antonello Di Nunzio <antonellodinunzio@gmail.com>.
# You should have received a copy of the GNU General Public License
# along with Morpho project; If not, see <http://www.gnu.org/licenses/>.
# 
# @license GPL-3.0+ <http://spdx.org/licenses/GPL-3.0+>

"""
Read EDT grid slice in X, Y or Z direction.
-
Compatible edt files come from
. Atmosphere -> slice dir X, Y, Z
. Surface -> slice dir Z only z0
. Soil -> slice dir Z
. Radiation -> slice dir X, Y, Z
. SolarAccess SA -> slice dir Z only z0
. Comfort (UTCI, PET, SET, PMV) -> slice dir X, Y, Z
-
You can use native component of Grasshopper to set the color of the pixels 
OR you can use 'recolor mesh' component of Ladybug[+] or Ladybug Legacy to use lots of additional features for visualization.
    Args:
        _edt: File path of EDT binary file [string].
        _variable_: Index of the variable to read [integer].
        -
        Connect a panel to 'variables' output to see all available variables
        AND a panel to 'selected_variable' to see the current one.
        _dir_: Connect an integer to set the direction of the section plane [integer]. Default is 0.
        0 = X
        1 = Y
        2 = Z
        _index_: Index of the slice to read in X or Y or Z [integer].
        -
        Connect a panel to read_me to check how many cells there are.
        min_: A number representing the lower boundary to filter data [float]. 
        max_: A number representing the upper boundary to filter data [float]. 
        base_point_: Lower left corner of the grid. Default value is point at 0,0,0. Connect a Rhino point to change it [Point3d].
        _run_it: Set it to 'True' to get face and values.
    
    Returns:
        read_me: Message for users.
        variables: All available variable you can read. Check the index to use with _variable_ input.
        project_name: Name of the current envimet project.
        date: Simulation date.
        time: Simulation time.
        selected_variable: Name of the current variable.
        face: List of face object to parse. It contains geometry information.
        values: Values for each face.
"""

ghenv.Component.Name = "Morpho Read Grid Slice"
ghenv.Component.NickName = "morpho_read_grid_slice"
ghenv.Component.Category = "Morpho"
ghenv.Component.SubCategory = "1 || IO"
try: ghenv.Component.AdditionalHelpFromDocStrings = "3"
except: pass

import scriptcontext as sc
import os
import sys
import clr
##################Envimet INX####################
from System.Collections.Generic import *
try:
    user_path = os.getenv("APPDATA")
    sys.path.append(os.path.join(user_path, "Morpho"))
    clr.AddReferenceToFile("MorphoReader.dll")
    clr.AddReferenceToFile("MorphoRhino.dll")
    from MorphoReader import GridOutput, Direction, Facade
    from MorphoRhino.RhinoAdapter import RhinoConvert
    
except ImportError as e:
    raise ImportError("\nFailed to import Morpho: {0}\n\nCheck your 'Morpho' folder in {1}".format(e, os.getenv("APPDATA")))
################################################
ghenv.Component.Message = "1.0.1 2.5D/3D"

def get_file_path(path):
    
    file, extension = os.path.splitext(path)
    
    return path, file + ".EDX"


def main():
    
    if _edt:
        
        edt, edx = get_file_path(_edt)
        
        variable = 1 if _variable_ == None else _variable_
        index = 0 if _index_ == None else _index_
        
        if _dir_ == 1:
            dir = Direction.Y
        elif _dir_ == 2:
            dir = Direction.Z
        else:
            dir = Direction.X
        
        if base_point_:
            origin = RhinoConvert.FromRhPointToVector(base_point_)
            output = GridOutput(edx, origin)
        else:
            output = GridOutput(edx)
        
        project_name = output.ProjectName
        date = output.SimulationDate
        time = output.SimulationTime
        variables = output.VariableName
        selected_variable = output.VariableName[variable]
        
        print("Grid: {0}, {1}, {2}".format(output.NumX, output.NumY, output.NumZ))
        
        if output.DataContent not in [1, 2, 3, 5, 8, 11]:
            print("Please, connect an edt file.\nYou can read Atmosphere, Surface, Soil, Radiation, SolarAccess, Comfort")
            return [None] * 7
        
        if _run_it:
            
            # Surface
            if output.DataContent in [2, 8]:
                index = 0
                dir = Direction.Z
            elif output.DataContent == 3:
                dir = Direction.Z
            
            facades = output.GetFacades(dir)
            output.SetValuesFromBinary(edt, facades, variable)
            
            # filter
            facades = Facade.GetSliceByPixelCoordinate(facades, index, dir)
            if min_ != None and max_ != None:
                facades = Facade.GetFacadesByThreshold(facades, min_, max_)
            
            # get values from facades
            values = Facade.GetValueZFromFacades(facades)
            
            # get geometry
            face = Facade.GetFacesFromFacades(facades)
            
            return variables, project_name, date, time, selected_variable, face, values
            
        return variables, project_name, date, time, selected_variable, None, None
    else:
        return [None] * 7


if not _edt:
    print("Please, connect a compatible _edt and check available outputs using panels.")
else:
    variables, project_name, date, time, selected_variable, face, values = main()
# ---------- end morpho_read_grid_slice ----------

# ----
morpho_from_face_to_rhinobrep = MorphoFromFaceToRhinoBrep(face=morpho_read_vegetation.face)  # -> read_me, rh_brep; inputs face: list
# ---------- morpho_from_face_to_rhinobrep: Python ----------
# Morpho: A plugin to write Envimet 2.5D models.
# This file is part of Morpho project.
#
# Copyright (c) 2020, Antonello Di Nunzio <antonellodinunzio@gmail.com>.
# You should have received a copy of the GNU General Public License
# along with Morpho project; If not, see <http://www.gnu.org/licenses/>.
# 
# @license GPL-3.0+ <http://spdx.org/licenses/GPL-3.0+>

"""
From Morpho Face to Rhino brep.
-
Icon made by Freepik <https://www.flaticon.com/authors/freepik>.
See license for more details.
    Args:
        _face: Morpho Face [list Face]
    
    Returns:
        read_me: Message for users.
        rh_brep: Rhino brep.
"""

ghenv.Component.Name = "Morpho From Face To RhinoBrep"
ghenv.Component.NickName = "morpho_from_face_to_rhinobrep"
ghenv.Component.Category = "Morpho"
ghenv.Component.SubCategory = "0 || Geometry"
try: ghenv.Component.AdditionalHelpFromDocStrings = "1"
except: pass

import scriptcontext as sc
import os
import sys
import clr
################### Morpho #####################
try:
    user_path = os.getenv("APPDATA")
    sys.path.append(os.path.join(user_path, "Morpho"))
    clr.AddReferenceToFile("MorphoGeometry.dll")
    clr.AddReferenceToFile("MorphoRhino.dll")
    from MorphoRhino.RhinoAdapter import RhinoConvert
    from MorphoGeometry import Face
    
except ImportError as e:
    raise ImportError("\nFailed to import Morpho: {0}\n\nCheck your 'Morpho' folder in {1}".format(e, os.getenv("APPDATA")))
################################################
ghenv.Component.Message = "1.0.1 2.5D"

import Rhino as rc

def main():
    
    surface = []
    
    pt1 = [RhinoConvert.FromVectorToRhPoint(face.A) for face in _face]
    pt2 = [RhinoConvert.FromVectorToRhPoint(face.B) for face in _face]
    pt3 = [RhinoConvert.FromVectorToRhPoint(face.C) for face in _face]
    pt4 = [RhinoConvert.FromVectorToRhPoint(face.D) for face in _face]
    
    
    for p1, p2, p3, p4 in zip(pt1, pt2, pt3, pt4):
        surface.append(rc.Geometry.Brep.CreateFromCornerPoints(p1, p2, p3, p4, 0.01))
    
    return surface

if _face == [None] or _face == []: 
    print("Please, connect _face.")
else:
    rh_brep = main()
# ---------- end morpho_from_face_to_rhinobrep ----------

panel = Panel(morpho_read_building_facades_3.selected_variable)
panel_2 = Panel(morpho_read_building_facades.read_me)
panel_3 = Panel(morpho_read_building_facades.date)
panel_4 = Panel(morpho_read_building_facades.time)
panel_5 = Panel(morpho_read_building_facades.variables)

morpho_from_face_to_rhinomesh = MorphoFromFaceToRhinoMesh(face=morpho_read_grid_slice.face)  # -> read_me, rh_mesh; inputs face: list
# ---------- morpho_from_face_to_rhinomesh: Python ----------
# Morpho: A plugin to write Envimet 2.5D models.
# This file is part of Morpho project.
#
# Copyright (c) 2020, Antonello Di Nunzio <antonellodinunzio@gmail.com>.
# You should have received a copy of the GNU General Public License
# along with Morpho project; If not, see <http://www.gnu.org/licenses/>.
# 
# @license GPL-3.0+ <http://spdx.org/licenses/GPL-3.0+>

"""
From Morpho Face to Rhino mesh.
-
Icon made by Freepik <https://www.flaticon.com/authors/freepik>.
See license for more details.
    Args:
        _face: Morpho Face [list Face]
    
    Returns:
        read_me: Message for users.
        rh_mesh: Rhino mesh.
"""

ghenv.Component.Name = "Morpho From Face To RhinoMesh"
ghenv.Component.NickName = "morpho_from_face_to_rhinomesh"
ghenv.Component.Category = "Morpho"
ghenv.Component.SubCategory = "0 || Geometry"
try: ghenv.Component.AdditionalHelpFromDocStrings = "1"
except: pass

import scriptcontext as sc
import os
import sys
import clr
################### Morpho #####################
try:
    user_path = os.getenv("APPDATA")
    sys.path.append(os.path.join(user_path, "Morpho"))
    clr.AddReferenceToFile("MorphoGeometry.dll")
    clr.AddReferenceToFile("MorphoRhino.dll")
    from MorphoRhino.RhinoAdapter import RhinoConvert
    from MorphoGeometry import Face
    
except ImportError as e:
    raise ImportError("\nFailed to import Morpho: {0}\n\nCheck your 'Morpho' folder in {1}".format(e, os.getenv("APPDATA")))
################################################
ghenv.Component.Message = "1.0.1 2.5D"

from System.Collections.Generic import *

def main():
    return RhinoConvert.FromFacesToMesh(List[Face](_face))

if _face == [None] or _face == []: 
    print("Please, connect _face.")
else:
    rh_mesh = main()
# ---------- end morpho_from_face_to_rhinomesh ----------

panel_6 = Panel(morpho_read_vegetation.read_me)
panel_7 = Panel(morpho_read_vegetation.variables)
panel_8 = Panel(morpho_read_vegetation.date)
panel_9 = Panel(morpho_read_vegetation.time)
panel_10 = Panel(morpho_read_vegetation.selected_variable)

panel_11 = Panel(morpho_read_grid_slice.read_me)
panel_12 = Panel(morpho_read_grid_slice.variables)
panel_13 = Panel(morpho_read_grid_slice.date)
panel_14 = Panel(morpho_read_grid_slice.time)
panel_15 = Panel(morpho_read_grid_slice.selected_variable)

morpho_from_face_to_rhinomesh_2 = MorphoFromFaceToRhinoMesh(face=morpho_read_building_facades.face)  # -> read_me, rh_mesh; inputs face: list; same code as morpho_from_face_to_rhinomesh
morpho_from_face_to_rhinomesh_3 = MorphoFromFaceToRhinoMesh(face=morpho_read_building_facades_3.face)  # -> read_me, rh_mesh; inputs face: list; same code as morpho_from_face_to_rhinomesh
morpho_from_face_to_rhinomesh_4 = MorphoFromFaceToRhinoMesh(face=morpho_read_building_facades_2.face)  # -> read_me, rh_mesh; inputs face: list; same code as morpho_from_face_to_rhinomesh
area = Area(Geometry=morpho_from_face_to_rhinobrep.rh_brep)  # -> Area, Centroid
prox = Proximity3D(Points=area.Centroid, Group=5)  # -> Links, Topology
preview = CustomPreview(Geometry=prox.Links, Material=ColourSwatch(SwatchColor=RGB(0, 0, 0)))

# ---- group: Geometry
entwine = Entwine(
    Branch00=morpho_from_face_to_rhinomesh_2.rh_mesh,
    Branch01=morpho_from_face_to_rhinomesh_4.rh_mesh,
    Branch02=morpho_from_face_to_rhinomesh_3.rh_mesh,
    Branch03=morpho_from_face_to_rhinomesh.rh_mesh,
    FlattenInputs=True)

# ---- group: Values
entwine_2 = Entwine(
    Branch00=morpho_read_building_facades.values,
    Branch01=morpho_read_building_facades_2.values,
    Branch02=morpho_read_building_facades_3.values,
    Branch03=morpho_read_grid_slice.values,
    FlattenInputs=True)

# ----
flatten = FlattenTree(Tree=entwine_2, Path="{0}")

pt = Point(Point(108.3539609, 15.50906764, 0))
bnd = Bounds(Numbers=flatten)
colrange = LBColorRange(index="15")  # -> colors; plug-in component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
dedomain = DeconstructDomain(Domain=bnd)  # -> Start, End
legendpar = LBLegendParameters(min=dedomain.Start, max=dedomain.End, colors=colrange, base_plane=pt)  # -> leg_par; plug-in component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

heatmap = LBSpatialHeatmap(values=entwine_2, mesh=entwine, legend_par=legendpar)  # -> mesh, legend, title, colors, legend_par; plug-in component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

bang = ExplodeTree(Data=heatmap.legend)
data = Data(heatmap.mesh)
