# Grasshopper definition from_envimet_to_geojson.gh (Grasshopper 1.0.7)
# Copyright: Coprat

# ---- group: Get output edt from folders
# Export binary results to geojson
# move all binary EDT/EDX in the output folder
# OR
# write a simple python script to get binary files
python = GhPythonScript()  # -> atmosphere, surface
# ---------- python: Python ----------
"""Get current path - for examples only"""

__author__ = "antonellodinunzio"

import os

file_name = ghenv.Component.OnPingDocument().FilePath

main_folder = os.path.join(os.path.dirname(file_name), "output") 
directory = os.listdir(main_folder)
path = [os.path.join(main_folder, f) for f in directory]

result = []
for p in path:
    result.append([os.path.join(p, f) for f in os.listdir(p) if f.endswith(".EDT")])

atmosphere, surface = result
# ---------- end python ----------

# ---- group: Envimet Location
# Morpho 1.0.1
# 
# From envimet to geojson
# ++++++++++++++++++++++++++++
# Requirements:
# - Rhino6/Rhino7
# - Morpho
# - Ladybug [+]
# - ShrimpGIS
# ++++++++++++++++++++++++++++
# Author: Antonello Di Nunzio
# www.antonellodinunzio.online
# License: GPL V.3.0+
panel = Panel("Larino")
panel_2 = Panel("41.805625")
panel_3 = Panel("14.918826")
morpho_location = MorphoLocation(name=panel, latitude=panel_2, longitude=panel_3, time_zone="+1")  # -> read_me, inx_location; inputs time_zone: Int32
# ---------- morpho_location: Python ----------
# Morpho: A plugin to write Envimet 2.5D models.
# This file is part of Morpho project.
#
# Copyright (c) 2020, Antonello Di Nunzio <antonellodinunzio@gmail.com>.
# You should have received a copy of the GNU General Public License
# along with Morpho project; If not, see <http://www.gnu.org/licenses/>.
# 
# @license GPL-3.0+ <http://spdx.org/licenses/GPL-3.0+>

"""
Construct a Inx Location.
-
You can decompose location data from other plugin, such as Ladybug and Gismo!
    Args:
        _name_: Name of Location.
        _latitude: Latitude of Location WGS84 [float].
        _longitude_: Longitude of Location WGS84 [float].
        _time_zone_: UTC timezone of location [integer].
        _model_rotation_: Rotation angle of your model [float].
        utm_: UTM object from "Morpho UTM" [UTM].
        _longitude_reference_: Longitude reference of your Location. Default is 15.0. [float].
    
    Returns:
        read_me: Message for users.
        inx_location: Inx Location.
"""

ghenv.Component.Name = "Morpho Location"
ghenv.Component.NickName = "morpho_location"
ghenv.Component.Category = "Morpho"
ghenv.Component.SubCategory = "1 || Settings"
try: ghenv.Component.AdditionalHelpFromDocStrings = "1"
except: pass

import scriptcontext as sc
import os
import sys
import clr
################### Morpho #####################
try:
    user_path = os.getenv("APPDATA")
    sys.path.append(os.path.join(user_path, "Morpho"))
    clr.AddReference("Morpho25.dll")
    from Morpho25.Settings import Location
    
except ImportError as e:
    raise ImportError("\nFailed to import Morpho: {0}\n\nCheck your 'Morpho' folder in {1}".format(e, os.getenv("APPDATA")))
################################################
ghenv.Component.Message = "1.0.0 2.5D"

def main():
    
    if _latitude and _longitude:
        
        location = Location(_latitude, _longitude)
        
        if _name_:
            location = Location(_latitude, _longitude, _name_)
        if _name_ and _time_zone_:
            location = Location(_latitude, _longitude, _name_, str(_time_zone_))
        if _name_ and _time_zone_ and _model_rotation_:
            location = Location(_latitude, _longitude, _name_, str(_time_zone_), _model_rotation_)
        
        if _model_rotation_: location.ModelRotation = _model_rotation_ 
        if utm_: location.UTM = utm_ 
        if _longitude_reference_: location.TimezoneReference = _longitude_reference_ 
        
        return location
    else:
        return

inx_location = main()
if not inx_location: print("Please, connect latitude and longitude.")
# ---------- end morpho_location ----------

# ---- group: Left lower corner of the Envimet Grid
pt = Point(Point(-16, -17, 0))

# ---- group: READ ALL - Do not calculate "face" to speed up calculation
morpho_read_grid_slice = MorphoReadGridSlice(edt=python.surface, variable="6", dir="2", base_point=pt, do_not_calc_face=Toggle(True), run_it=Toggle(True))  # -> read_me, variables, project_name, date, time, selected_variable, face, values; inputs variable: Int32, dir: Int32, index: Int32, base_point: Point3d, do_not_calc_face: Boolean, run_it: Boolean
# ---------- morpho_read_grid_slice: Python ----------
# Morpho: A plugin to write Envimet 2.5D models.
# This file is part of Morpho project.
#
# Copyright (c) 2020, Antonello Di Nunzio <antonellodinunzio@gmail.com>.
# You should have received a copy of the GNU General Public License
# along with Morpho project; If not, see <http://www.gnu.org/licenses/>.
# 
# @license GPL-3.0+ <http://spdx.org/licenses/GPL-3.0+>

"""
Read EDT grid slice in X, Y or Z direction.
-
Compatible edt files come from
. Atmosphere -> slice dir X, Y, Z
. Surface -> slice dir Z only z0
. Soil -> slice dir Z
. Radiation -> slice dir X, Y, Z
. SolarAccess SA -> slice dir Z only z0
. Comfort (UTCI, PET, SET, PMV) -> slice dir X, Y, Z
-
You can use native component of Grasshopper to set the color of the pixels 
OR you can use 'recolor mesh' component of Ladybug[+] or Ladybug Legacy to use lots of additional features for visualization.
    Args:
        _edt: File path of EDT binary file [string].
        _variable_: Index of the variable to read [integer].
        -
        Connect a panel to 'variables' output to see all available variables
        AND a panel to 'selected_variable' to see the current one.
        _dir_: Connect an integer to set the direction of the section plane [integer]. Default is 0.
        0 = X
        1 = Y
        2 = Z
        _index_: Index of the slice to read in X or Y or Z [integer].
        -
        Connect a panel to read_me to check how many cells there are.
        min_: A number representing the lower boundary to filter data [float]. 
        max_: A number representing the upper boundary to filter data [float]. 
        base_point_: Lower left corner of the grid. Default value is point at 0,0,0. Connect a Rhino point to change it [Point3d].
        _run_it: Set it to 'True' to get face and values.
    
    Returns:
        read_me: Message for users.
        variables: All available variable you can read. Check the index to use with _variable_ input.
        project_name: Name of the current envimet project.
        date: Simulation date.
        time: Simulation time.
        selected_variable: Name of the current variable.
        face: List of face object to parse. It contains geometry information.
        values: Values for each face.
"""

ghenv.Component.Name = "Morpho Read Grid Slice"
ghenv.Component.NickName = "morpho_read_grid_slice"
ghenv.Component.Category = "Morpho"
ghenv.Component.SubCategory = "1 || IO"
try: ghenv.Component.AdditionalHelpFromDocStrings = "3"
except: pass

import scriptcontext as sc
import os
import sys
import clr
##################Envimet INX####################
from System.Collections.Generic import *
try:
    user_path = os.getenv("APPDATA")
    sys.path.append(os.path.join(user_path, "Morpho"))
    clr.AddReferenceToFile("MorphoReader.dll")
    clr.AddReferenceToFile("MorphoRhino.dll")
    from MorphoReader import GridOutput, Direction, Facade
    from MorphoRhino.RhinoAdapter import RhinoConvert
    
except ImportError as e:
    raise ImportError("\nFailed to import Morpho: {0}\n\nCheck your 'Morpho' folder in {1}".format(e, os.getenv("APPDATA")))
################################################
ghenv.Component.Message = "1.0.1 2.5D/3D"

def get_file_path(path):
    
    file, extension = os.path.splitext(path)
    
    return path, file + ".EDX"


def main():
    
    if _edt:
        
        edt, edx = get_file_path(_edt)
        
        variable = 1 if _variable_ == None else _variable_
        index = 0 if _index_ == None else _index_
        
        if _dir_ == 1:
            dir = Direction.Y
        elif _dir_ == 2:
            dir = Direction.Z
        else:
            dir = Direction.X
        
        if base_point_:
            origin = RhinoConvert.FromRhPointToVector(base_point_)
            output = GridOutput(edx, origin)
        else:
            output = GridOutput(edx)
        
        project_name = output.ProjectName
        date = output.SimulationDate
        time = output.SimulationTime
        variables = output.VariableName
        selected_variable = output.VariableName[variable]
        
        print("Grid: {0}, {1}, {2}".format(output.NumX, output.NumY, output.NumZ))
        
        if output.DataContent not in [1, 2, 3, 5, 8, 11]:
            print("Please, connect an edt file.\nYou can read Atmosphere, Surface, Soil, Radiation, SolarAccess, Comfort")
            return [None] * 7
        
        if _run_it:
            
            # Surface
            if output.DataContent in [2, 8]:
                index = 0
                dir = Direction.Z
            elif output.DataContent == 3:
                dir = Direction.Z
            
            facades = output.GetFacades(dir)
            output.SetValuesFromBinary(edt, facades, variable)
            
            # filter
            facades = Facade.GetSliceByPixelCoordinate(facades, index, dir)
            if min_ != None and max_ != None:
                facades = Facade.GetFacadesByThreshold(facades, min_, max_)
            
            # get values from facades
            values = Facade.GetValueZFromFacades(facades)
            
            # get geometry
            face = None
            if not _do_not_calc_face_:
                face = Facade.GetFacesFromFacades(facades)
            
            return variables, project_name, date, time, selected_variable, face, values
            
        return variables, project_name, date, time, selected_variable, None, None
    else:
        return [None] * 7


if not _edt:
    print("Please, connect a compatible _edt and check available outputs using panels.")
else:
    variables, project_name, date, time, selected_variable, face, values = main()
# ---------- end morpho_read_grid_slice ----------

# ---- group: take just one
item = ListItem(List=python.surface, Index=0, Wrap=True)
morpho_read_grid_slice_2 = MorphoReadGridSlice(edt=item, variable="6", dir="2", base_point=pt, do_not_calc_face=Toggle(False), run_it=Toggle(True))  # -> read_me, variables, project_name, date, time, selected_variable, face, values; inputs variable: Int32, dir: Int32, index: Int32, base_point: Point3d, do_not_calc_face: Boolean, run_it: Boolean; same code as morpho_read_grid_slice

# ----
available_variables = Panel(morpho_read_grid_slice.variables)
morpho_from_face_to_rhinomesh = MorphoFromFaceToRhinoMesh(face=morpho_read_grid_slice_2.face)  # -> read_me, rh_mesh; inputs face: list
# ---------- morpho_from_face_to_rhinomesh: Python ----------
# Morpho: A plugin to write Envimet 2.5D models.
# This file is part of Morpho project.
#
# Copyright (c) 2020, Antonello Di Nunzio <antonellodinunzio@gmail.com>.
# You should have received a copy of the GNU General Public License
# along with Morpho project; If not, see <http://www.gnu.org/licenses/>.
# 
# @license GPL-3.0+ <http://spdx.org/licenses/GPL-3.0+>

"""
From Morpho Face to Rhino mesh.
-
Icon made by Freepik <https://www.flaticon.com/authors/freepik>.
See license for more details.
    Args:
        _face: Morpho Face [list Face]
    
    Returns:
        read_me: Message for users.
        rh_mesh: Rhino mesh.
"""

ghenv.Component.Name = "Morpho From Face To RhinoMesh"
ghenv.Component.NickName = "morpho_from_face_to_rhinomesh"
ghenv.Component.Category = "Morpho"
ghenv.Component.SubCategory = "0 || Geometry"
try: ghenv.Component.AdditionalHelpFromDocStrings = "1"
except: pass

import scriptcontext as sc
import os
import sys
import clr
################### Morpho #####################
try:
    user_path = os.getenv("APPDATA")
    sys.path.append(os.path.join(user_path, "Morpho"))
    clr.AddReferenceToFile("MorphoGeometry.dll")
    clr.AddReferenceToFile("MorphoRhino.dll")
    from MorphoRhino.RhinoAdapter import RhinoConvert
    from MorphoGeometry import Face
    
except ImportError as e:
    raise ImportError("\nFailed to import Morpho: {0}\n\nCheck your 'Morpho' folder in {1}".format(e, os.getenv("APPDATA")))
################################################
ghenv.Component.Message = "1.0.1 2.5D"

from System.Collections.Generic import *

def main():
    return RhinoConvert.FromFacesToMesh(List[Face](_face))

if _face == [None] or _face == []: 
    print("Please, connect _face.")
else:
    rh_mesh = main()
# ---------- end morpho_from_face_to_rhinomesh ----------

# ---- group: Take a random sample
faceb = FaceBoundaries(Mesh=morpho_from_face_to_rhinomesh.rh_mesh)
area = Area(Geometry=faceb)  # -> Area, Centroid
reduce = RandomReduce(List=area.Centroid, Reduction="3070", Seed=Slider(4, range=0..8))
index = ItemIndex(List=area.Centroid, Item=reduce)

# ----
shrimp_location = ShrimpGISLocation(name=panel, latitude=panel_2, longitude=panel_3)  # -> location; inputs anchor_point: Point3d; plug-in component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
item_2 = ListItem(List=morpho_read_grid_slice.values, Index=index, Wrap=True)
flip = FlipMatrix(Data=item_2)  # -> reverse(Data)

# ---- group: TRY WITH 24 HOURS: Each hour of simulation is a triangle
lng = ListLength(List=simplify(flip))
branch = TreeBranch(Tree=lng, Path="0", MaintainPaths=True)
polygon = Polygon(Plane=reduce, Radius=Slider(10, range=1..100), Segments=branch, FilletRadius=0)  # -> Polygon, Length
explode = Explode(Curve=polygon.Polygon, Recursive=True)  # -> Segments, Vertices
area_2 = Area(Geometry=polygon.Polygon)  # -> Area, graft(Centroid)
extr = ExtrudePoint(Base=explode.Segments, Point=area_2.Centroid)

# ----
lng_2 = ListLength(List=simplify(flatten(flip)))
repeat = RepeatData(Data=reverse(morpho_read_grid_slice.time), Length=lng_2)
repeat_2 = RepeatData(Data=reverse(morpho_read_grid_slice.date), Length=lng_2)
data = Data(flip)

# ---- group: Export / 6
toggle = BooleanToggle(False)

# ---- group: Export
shrimp_polygon = ShrimpGISPolygon(surface=flatten(extr), location=shrimp_location)  # -> shp_polygon; inputs surface: list of Brep, num: Int32; plug-in component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
shrimp_field = ShrimpGISField(name="TEMP", values=flatten(data))  # -> read_me, field; inputs values: list, type: Int32, length: Int32, decimal: Int32; plug-in component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
shrimp_field_2 = ShrimpGISField(name="TIME", values=flatten(repeat))  # -> read_me, field; inputs values: list, type: Int32, length: Int32, decimal: Int32; plug-in component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
shrimp_field_3 = ShrimpGISField(name="DATE", values=flatten(repeat_2))  # -> read_me, field; inputs values: list, type: Int32, length: Int32, decimal: Int32; plug-in component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
python_2 = GhPythonScript()  # -> output
# ---------- python_2: Python ----------
"""Get current path - for examples only"""

__author__ = "antonellodinunzio"

import os

file_name = ghenv.Component.OnPingDocument().FilePath

output = os.path.join(os.path.dirname(file_name), "geojson")
# ---------- end python_2 ----------
shrimp_write_geojson = ShrimpGISWriteGeojson(
    field=flatten([shrimp_field.field, shrimp_field_2.field, shrimp_field_3.field]),
    shp_geometry=flatten(shrimp_polygon),
    folder=python_2,
    run_it=toggle)  # -> read_me, geojson_file; inputs field: list, shp_geometry: list, run_it: Boolean; plug-in component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
